# Grasshopper definition 0.1_Rhino_Grasshopper_Python_Geometry_Graham_001.gh (Grasshopper 1.0.7)
# Copyright: Wickerson Studios

# Geometry
# Open Grasshopper in Rhino Command Line
# Drag in GhPython Script node from Maths.Script
ghpython_script = GhPythonScript()  # -> out, a
# ---------- ghpython_script: Python ----------
import Rhino.Geometry as rg

a = rg.Point3d(1,2,3)
print type(a)
print a.X
print a.Y
print a.Z
# ---------- end ghpython_script ----------
