# Grasshopper definition 0.1_Rhino_Grasshopper_Python_Geometry_Graham_002.gh (Grasshopper 1.0.7)
# Copyright: Wickerson Studios

# Geometry
# Open Grasshopper in Rhino Command Line
# Drag in GhPython Script node from Maths.Script
number_slider = Slider(2.91, range=0..10)
ghpython_script = GhPythonScript(amplitude=number_slider, length=Slider(66, range=0..100), frequency=Slider(0.37, range=0..1))  # -> out, a; inputs length: Int32
# ---------- ghpython_script: Python ----------
import Rhino.Geometry as rg
import math

points = []

for x in range(length):
    z = amplitude * math.sin(frequency * x)
    point = rg.Point3d(x, 0, z)
    points.append(point)
    
    
sineCurve = rg.NurbsCurve.CreateInterpolatedCurve(points, 3)


#a = points
a = sineCurve
# ---------- end ghpython_script ----------
