# Grasshopper definition 0.1_Rhino_Grasshopper_Python_Geometry_Graham_003.gh (Grasshopper 1.0.7)
# Copyright: Wickerson Studios

# Drag in GhPython Script node from Maths.Script
number_slider = Slider(7, range=0..10)
# Geometry
# Open Grasshopper in Rhino Command Line
ghpython_script = GhPythonScript(x=number_slider, y=number_slider, z=number_slider)  # -> out, pt1, pt2, line, brep, circle, plane, cone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; inputs x: Int32, y: Int32, z: Int32
# ---------- ghpython_script: Python ----------
import Rhino.Geometry as rg

#pt = Rhino.Geometry.Point3d(10, 0, 0)
pt1 = rg.Point3d(x,y,z)
pt2 = rg.Point3d(x+12,y,z)

#line = Rhino.Geometry.Line(Rhino.Geometry.Point3d(0, 0, 0), Rhino.Geometry.Point3d(10, 0, 0))
ln = rg.Line(pt1,pt2)
line = ln

#BrepBox
pt3 = rg.Point3d(x,y,z)
pt4 = rg.Point3d(x+10,y+10,z+10)
box = rg.BoundingBox(pt3, pt4)
brep = box.ToBrep()

#circle
center = pt4
radius = x
circle = rg.Circle(center, radius)

#plane = Rhino.Geometry.Plane(p0, p1, p3)
plane = rg.Plane(pt1, pt2, pt4)

#Cone
planeXY = rg.Plane.WorldXY
height = x
radius = y
cone = rg.Cone(planeXY, height, radius)
# ---------- end ghpython_script ----------
point = Point(ghpython_script.pt1)
circle = Circle(ghpython_script.circle)
point_2 = Point(ghpython_script.pt2)
box = Box(ghpython_script.brep)
plane = Plane(ghpython_script.plane)
line = Line(ghpython_script.line)
geometry = Geometry(ghpython_script.cone)
