# Grasshopper definition 0.1_Rhino_Grasshopper_Python_Geometry_LineCurve_011.gh (Grasshopper 1.0.7)
# Copyright: Wickerson Studios

# Geometry
# Open Grasshopper in Rhino Command Line
# Drag in GhPython Script node from Maths.Script
ghpython_script = GhPythonScript()  # -> out, points_OutputA, points_OutputB, line_Output
# ---------- ghpython_script: Python ----------
import Rhino.Geometry as rg
import math


pointsA = []
pointsB = []

for i in range(0,12,1):
    x = i
    y = i * 2
    z = i * 3
    
    pointA = rg.Point3d(x,y,z)
    pointsA.append(pointA)

points_OutputA = pointsA

for j in range(0,12,1):
    x = j * 3
    y = j * 2
    z = j 
    
    pointB = rg.Point3d(x,y,z)
    pointsB.append(pointB)

points_OutputB = pointsB

lines = []

for k in range(12):
    line = rg.Line(pointA, pointB)
    lines.append(line)

line_Output = line
# ---------- end ghpython_script ----------
point = Point(ghpython_script.points_OutputB)
line = Line(ghpython_script.line_Output)
point_2 = Point(ghpython_script.points_OutputA)
sphere = Sphere(Base=[point_2, point], Radius=1)
pipe = Pipe(Curve=line, Radius=1, Caps=0)
