# Grasshopper definition 0.1_Rhino_Grasshopper_Python_Geometry_PolylineCurveInterCurve_012.gh (Grasshopper 1.0.7)
# Copyright: Wickerson Studios

# Geometry
# Open Grasshopper in Rhino Command Line
# Drag in GhPython Script node from Maths.Script
number_slider = Slider(10, range=0..10)
populate_3d = Populate3D(
    Region={Plane=PlaneXY(0, 0, 0), X=Domain(0, 10), Y=Domain(0, 10), Z=Domain(0, 2)},
    Count=number_slider,
    Seed=Slider(42, range=0..100))
dispatch = Dispatch(List=populate_3d, DispatchPattern=[True, False])  # -> ListA, ListB
ghpython_script = GhPythonScript(pt1=dispatch.ListA, pt2=dispatch.ListB)  # -> out, curveA_out, curveB_out, curveC_out; inputs pt1: Point3d, pt2: Point3d
# ---------- ghpython_script: Python ----------
import Rhino.Geometry as rg
import math

curveA = rg.Line(pt1,pt2)

curveA_out = curveA
# ---------- end ghpython_script ----------
