# Grasshopper definition 0.1_Rhino_Grasshopper_Python_Geometry_Ramdom_008.gh (Grasshopper 1.0.7)
# Copyright: Wickerson Studios
# plug-ins: Bifocals

# Geometry
# Open Grasshopper in Rhino Command Line
# Drag in GhPython Script node from Maths.Script
number_slider = Slider(44, range=20..140)
ghpython_script = GhPythonScript(stop=number_slider)  # -> out, points, colour_Output1, colour_Output2, colour_Output3; inputs stop: Int32
# ---------- ghpython_script: Python ----------
import Rhino.Geometry as rg
import random as r
import math

points = []
colour1 = []
colour2 = []
colour3 = []

for x in range(0,256,r.randint(20,stop)):
    for y in range(0,256,r.randint(20,stop)):
        for z in range(0,256,r.randint(20,stop)):
            point = rg.Point3d(x,y,z)
            points.append(point)
            colour1.append(x)
            colour2.append(y)
            colour3.append(z)
points_Output = point
colour_Output1 = colour1
colour_Output2 = colour2
colour_Output3 = colour3
# ---------- end ghpython_script ----------
colour_rgb = ColourRGB(Alpha=255, Red=ghpython_script.colour_Output1, Green=ghpython_script.colour_Output2, Blue=ghpython_script.colour_Output3)
mesh_sphere = MeshSphere(Base=ghpython_script.points, Radius=10, UCount=10, VCount=20)
custom_preview = CustomPreview(Geometry=mesh_sphere, Material=colour_rgb)
