# Grasshopper definition 0.1_Rhino_Grasshopper_Python_Geometry_Ramdom_009.gh (Grasshopper 1.0.7)
# Copyright: Wickerson Studios
# plug-ins: Bifocals

# ----
# Geometry
# Open Grasshopper in Rhino Command Line
# Drag in GhPython Script node from Maths.Script
number_slider = Slider(10, range=1..10)
number_slider_2 = Slider(265, range=0..265)

division = Division(A=number_slider, B="10")
ghpython_script = GhPythonScript(floatStart=number_slider, floatStep=division)  # -> out, points_Output
# ---------- ghpython_script: Python ----------
import rhinoscriptsyntax as rs
import Rhino.Geometry as rg
#Does anyone know the equivatent of rc.RhinoList.(floatStart, 100.0, floatStep):
#in Rhino Common?  Could be Rhino.Collections.RhinoList.GetType...???
import Rhino.Collections as rc
import math as m

points = []

for i in rs.frange(floatStart,100.0, floatStep):
    x = i * m.sin(i*3)
    y = i * m.cos(i)
    z = i
    point = rg.Point3d(x,y,z)
    points.append(point)

points_Output = points

#github: mwickerson
# ---------- end ghpython_script ----------
construct_domain = ConstructDomain(DomainStart=Slider(0.1, range=0.1..10), DomainEnd=Slider(6.56, range=0..10))
list_length = ListLength(List=ghpython_script.points_Output)
range = Range(Domain=construct_domain, Steps=expr("x-1", list_length))
jitter = Jitter(List=range, Jitter=Slider(1, range=0..1), Seed=number_slider_2)  # -> Values, Indices
mesh_sphere = MeshSphere(Base=ghpython_script.points_Output, Radius=jitter.Values, UCount=10, VCount=20)
list_length_2 = ListLength(List=mesh_sphere)
range_2 = Range(Domain=number_slider_2, Steps=expr("x-1", list_length_2))
range_3 = Range(Domain=Slider(163, range=0..265), Steps=expr("x-1", list_length_2))
range_4 = Range(Domain=Slider(265, range=0..265), Steps=expr("x-1", list_length_2))
colour_rgb = ColourRGB(Alpha=255, Red=range_2, Green=range_3, Blue=range_4)  # -> graft(Colour)
custom_preview = CustomPreview(Geometry=graft(mesh_sphere), Material=colour_rgb)
