# Grasshopper definition 0.1_Rhino_Grasshopper_Python_WickersonStudios_Geometry_002.gh (Grasshopper 1.0.7)
# Copyright: Wickerson Studios
# plug-ins: Bifocals

number_slider = Slider(7, range=0..10)

ghpython_script = GhPythonScript(x=number_slider, y=Slider(3, range=0..10), z=number_slider)  # -> out, pt1, pt2, line, brep, circle, plane, cone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; inputs x: Int32, y: Int32, z: Int32
# ---------- ghpython_script: Python ----------
#Adding Objects https://developer.rhino3d.com/samples/#adding-objects

import Rhino.Geometry as rg
import Rhino.Collections as rc

#pt = Rhino.Geometry.Point3d(10, 0, 0)
pt1 = rg.Point3d(x,y,z)
pt2 = rg.Point3d(x+12,y,z)

#line = Rhino.Geometry.Line(Rhino.Geometry.Point3d(0, 0, 0), Rhino.Geometry.Point3d(10, 0, 0))
ln = rg.Line(pt1,pt2)
line = ln

#BrepBox
pt4 = rg.Point3d(x+10,y+10,z+10)
box = rg.BoundingBox(pt1, pt4)
brep = box.ToBrep()

#circle
center = pt4
radius = x
circle = rg.Circle(center, radius)

#plane = Rhino.Geometry.Plane(p0, p1, p3)
plane = rg.Plane(pt1, pt2, pt4)

#Cone
planeXY = rg.Plane.WorldYZ
height = x
radius = y
cone = rg.Cone(planeXY, height, radius)

#Cylinder
center_point = pt2
height_point = pt4
zaxis = height_point-center_point
planeCyl = rg.Plane(center_point, zaxis)
radiusCyl = x + y
circleCyl = rg.Circle(planeCyl, radiusCyl)
cylinder = rg.Cylinder(circleCyl, zaxis.Length)
brepCyl = cylinder.ToBrep(True, True)

#NurbsCurve
points = rc.Point3dList(5)
points.Add(10, 10, 10)
points.Add(0, 12, 0)
points.Add(12, 13, 0)
points.Add(14, 12, 0)
points.Add(14, 1, 0)

nurbsCurve = rg.NurbsCurve.Create(False, 3, points)

#sphere
center = pt4
radius = x
sphere = rg.Sphere(center, radius)

#Torus
major_radius = 5.00
minor_radius = 4.00
plane = rg.Plane.WorldYZ
torus = rg.Torus(plane, major_radius, minor_radius)
#revsrf = torus.ToRevSurface()

#Truncated Cone
bottom_pt = rg.Point3d(2,4,0)
bottom_radius = x
bottom_circle = rg.Circle(bottom_pt, bottom_radius)

top_pt = rg.Point3d(0,0,10)
top_radius = y
top_circle = rg.Circle(top_pt, top_radius)

shapeCurve = rg.LineCurve(bottom_circle.PointAt(0), top_circle.PointAt(0))
axis = rg.Line(bottom_circle.Center, top_circle.Center)
revsrf = rg.RevSurface.Create(shapeCurve, axis)
tcone_brep = rg.Brep.CreateFromRevSurface(revsrf, True, True)
# ---------- end ghpython_script ----------
# Geometry
# Open Grasshopper in Rhino Command Line
ghpython_script_2 = GhPythonScript()  # -> Out, A

point = Point(ghpython_script.pt1)
circle = Circle(ghpython_script.circle)
curve = Curve(ghpython_script.nurbsCurve)
brep = Brep(ghpython_script.tcone_brep)
point_2 = Point(ghpython_script.pt2)
box = Box(ghpython_script.brep)
geometry = Geometry(ghpython_script.revsrf)
geometry_2 = Geometry(ghpython_script.brepCyl)
plane = Plane(ghpython_script.plane)
geometry_3 = Geometry(ghpython_script.sphere)
line = Line(ghpython_script.line)
geometry_4 = Geometry(ghpython_script.cone)
geometry_5 = Geometry(ghpython_script.torus)
