# Grasshopper definition 0.1_Rhino_Grasshopper_Python_WickersonStudios_Geometry_003.gh (Grasshopper 1.0.7)
# Copyright: Wickerson Studios
# plug-ins: Bifocals

# ----
# Rhino Development: Rhino Common
# Add Annotation Text
point = Point(<point referenced from the Rhino model>)

ghpython_script = GhPythonScript(pt=point, text="I am so great!", height=Slider(6.18, range=0..20), font="Helvitica")  # -> out, id; inputs pt: Point3d, plane: Plane
# ---------- ghpython_script: Python ----------
import Rhino
import scriptcontext
import System.Guid

"""
pt = Rhino.Geometry.Point3d(10, 0, 0)
text = "Hello RhinoCommon"
height = 2.0
font = "Arial"
plane = scriptcontext.doc.Views.ActiveView.ActiveViewport.ConstructionPlane()
plane.Origin = pt
id = scriptcontext.doc.Objects.AddText(text, plane, height, font, False, False)
"""

"""= Rhino.Geometry.Point3d(10, 0, 0)
text = "Hello RhinoCommon"
height = 2.0
font = "Arial"
plane = scriptcontext.doc.Views.ActiveView.ActiveViewport.ConstructionPlane()
plane.Origin = pt
id = Rhino.RhinoDoc.ActiveDoc.Objects.AddText(text, plane, height, font, False, False)
"""

#Rhino.RhinoDoc.ActiveDoc
plane = scriptcontext.doc.Views.ActiveView.ActiveViewport.ConstructionPlane()
plane.Origin = pt
id = Rhino.RhinoDoc.ActiveDoc.Objects.AddText(text, plane, height, font, False, False)
# ---------- end ghpython_script ----------
panel = Panel(ghpython_script.id)
