# Grasshopper definition 0.1_Rhino_Grasshopper_Python_WickersonStudios_Geometry_004.gh (Grasshopper 1.0.7)
# Copyright: Wickerson Studios
# plug-ins: Bifocals

# ----
# Rhino Development: Rhino Common
# Add Arrowheads to Curves
number_slider = Slider(10, range=0..10)
number_slider_2 = Slider(9, range=0..10)

construct_domain = ConstructDomain(DomainStart=0, DomainEnd=number_slider_2)
construct_domain_2 = ConstructDomain(DomainStart=0, DomainEnd=Slider(6, range=0..10))
subtraction = Subtraction(A=number_slider, B="1")
range = Range(Domain=construct_domain, Steps=subtraction)
range_2 = Range(Domain=construct_domain_2, Steps=subtraction)
sine = Sine(Value=range_2)
cosine = Cosine(Value=range)
multiplication = Multiplication(A=sine, B=number_slider_2)
multiplication_2 = Multiplication(A=cosine, B=number_slider_2)
ghpython_script = GhPythonScript(x=number_slider, y=multiplication, z=multiplication_2)  # -> out, attribs, line; inputs x: Int32, y: Int32, z: Int32
# ---------- ghpython_script: Python ----------
import Rhino
import scriptcontext
#Rhino.RhinoDoc.ActiveDoc

# Define a line
line = Rhino.Geometry.Line(Rhino.Geometry.Point3d(0, 0, 0), Rhino.Geometry.Point3d(-x, y, z))

# Make a copy of Rhino's default object attributes
attribs = Rhino.RhinoDoc.ActiveDoc.CreateDefaultAttributes()

# Modify the object decoration style
attribs.ObjectDecoration = Rhino.DocObjects.ObjectDecoration.BothArrowhead

# Create a new curve object with our attributes
Rhino.RhinoDoc.ActiveDoc.Objects.AddLine(line, attribs)
Rhino.RhinoDoc.ActiveDoc.Views.Redraw()
# ---------- end ghpython_script ----------

panel = Panel(ghpython_script.line)
panel_2 = Panel(ghpython_script.attribs)
pipe = Pipe(Curve=ghpython_script.line, Radius=1, Caps="2")
