# Grasshopper definition 0.1_Rhino_Grasshopper_Python_WickersonStudios_Geometry_005.gh (Grasshopper 1.0.7)
# Copyright: Wickerson Studios
# plug-ins: Bifocals

# Rhino Development: Rhino Common
# Add Brep Box
ghpython_script = GhPythonScript()  # -> out, a
# ---------- ghpython_script: Python ----------
import Rhino
import scriptcontext
import System.Guid
#Rhino.RhinoDoc.ActiveDoc

pt0 = Rhino.Geometry.Point3d(0, 0, 0)
pt1 = Rhino.Geometry.Point3d(10, 10, 10)
box = Rhino.Geometry.BoundingBox(pt0, pt1)
brep = box.ToBrep()

"""
rc = Rhino.Commands.Result.Failure
if( Rhino.RhinoDoc.ActiveDoc.Objects.AddBrep(brep) != System.Guid.Empty ):
    rc = Rhino.Commands.Result.Success
    Rhino.RhinoDoc.ActiveDoc.Views.Redraw()
"""
# ---------- end ghpython_script ----------
