# Grasshopper definition 0.1_Rhino_Grasshopper_Python_WickersonStudios_Geometry_005b.gh (Grasshopper 1.0.7)
# Copyright: Wickerson Studios
# plug-ins: Bifocals

# Rhino Development: Rhino Common
# Add Brep Box
ghpython_script = GhPythonScript()  # -> out, a
# ---------- ghpython_script: Python ----------
import Rhino
import Rhino.Geometry as rg
import scriptcontext
import System.Guid
import random
#Rhino.RhinoDoc.ActiveDoc
breps = []
for i in range(0,100):
    x = random.uniform(0,100)
    y = random.uniform(0,100)
    z = random.uniform(0,100)
    pt0 = rg.Point3d(x, y, z)
    pt1 = rg.Point3d(x+10, y+10, z+10)
    box = rg.BoundingBox(pt0, pt1)
    brep = box.ToBrep()
    breps.append(brep)
a = breps
#rc = Rhino.Commands.Result.Failure
if( Rhino.RhinoDoc.ActiveDoc.Objects.AddBrep(brep) != System.Guid.Empty ):
    rc = Rhino.Commands.Result.Success
    Rhino.RhinoDoc.ActiveDoc.Views.Redraw()
# ---------- end ghpython_script ----------
brep = Brep(ghpython_script.a)
