# Grasshopper definition 0.1_Rhino_Grasshopper_Python_WickersonStudios_Geometry_006.gh (Grasshopper 1.0.7)

# ----
# AddBrepBox
# Base Script
ghpython_script = GhPythonScript()  # -> out, a
# ---------- ghpython_script: Python ----------
import Rhino
import scriptcontext
import System.Guid

def AddBrepBox():
    pt0 = Rhino.Geometry.Point3d(0, 0, 0)
    pt1 = Rhino.Geometry.Point3d(10, 10, 10)
    box = Rhino.Geometry.BoundingBox(pt0, pt1)
    brep = box.ToBrep()
    rc = Rhino.Commands.Result.Failure
    if( Rhino.RhinoDoc.ActiveDoc.Objects.AddBrep(brep) != System.Guid.Empty ):
        rc = Rhino.Commands.Result.Success
        Rhino.RhinoDoc.ActiveDoc.Views.Redraw()
    return rc

if( __name__ == "__main__" ):
    AddBrepBox()
# ---------- end ghpython_script ----------

# ----
# GhPython Node Play at Wickerson Studios
# Base Script
# AddAnnotationText
ghpython_script_2 = GhPythonScript()  # -> out, a
# ---------- ghpython_script_2: Python ----------
import Rhino
import scriptcontext
import System.Guid

def AddAnnotationText():
    pt = Rhino.Geometry.Point3d(10, 0, 0)
    text = "Hello RhinoCommon"
    height = 2.0
    font = "Arial"
    plane = Rhino.RhinoDoc.ActiveDoc.Views.ActiveView.ActiveViewport.ConstructionPlane()
    plane.Origin = pt
    id = Rhino.RhinoDoc.ActiveDoc.Objects.AddText(text, plane, height, font, False, False)
    if id!=System.Guid.Empty:
        Rhino.RhinoDoc.ActiveDoc.Views.Redraw()
        return Rhino.Commands.Result.Success
    return Rhino.Commands.Result.Failure


if __name__=="__main__":
    AddAnnotationText()
# ---------- end ghpython_script_2 ----------
# AddAnnotationText
# Base Script
ghpython_script_3 = GhPythonScript()  # -> out, a
# ---------- ghpython_script_3: Python ----------
import Rhino
import scriptcontext
import System.Guid

def AddCylinder():
    center_point = Rhino.Geometry.Point3d(0, 0, 0)
    height_point = Rhino.Geometry.Point3d(0, 0, 10)
    zaxis = height_point-center_point
    plane = Rhino.Geometry.Plane(center_point, zaxis)
    radius = 5
    circle = Rhino.Geometry.Circle(plane, radius)
    cylinder = Rhino.Geometry.Cylinder(circle, zaxis.Length)
    brep = cylinder.ToBrep(True, True)
    if brep:
        if Rhino.RhinoDoc.ActiveDoc.Objects.AddBrep(brep)!=System.Guid.Empty:
            Rhino.RhinoDoc.ActiveDoc.Views.Redraw()
            return Rhino.Commands.Result.Success
    return Rhino.Commands.Result.Failure

if __name__=="__main__":
    AddCylinder()
# ---------- end ghpython_script_3 ----------
# ObjectDecoration
# Base Script
ghpython_script_4 = GhPythonScript()  # -> out, a
# ---------- ghpython_script_4: Python ----------
import Rhino
import scriptcontext

def ObjectDecoration():
    # Define a line
    line = Rhino.Geometry.Line(Rhino.Geometry.Point3d(0, 0, 0), Rhino.Geometry.Point3d(10, 0, 0))

    # Make a copy of Rhino's default object attributes
    attribs = Rhino.RhinoDoc.ActiveDoc.CreateDefaultAttributes()

    # Modify the object decoration style
    attribs.ObjectDecoration = Rhino.DocObjects.ObjectDecoration.BothArrowhead

    # Create a new curve object with our attributes
    Rhino.RhinoDoc.ActiveDoc.Objects.AddLine(line, attribs)
    Rhino.RhinoDoc.ActiveDoc.Views.Redraw()

if __name__ == "__main__":
    ObjectDecoration()
# ---------- end ghpython_script_4 ----------
# Base Script
# AddBackgroundBitmap
ghpython_script_5 = GhPythonScript()  # -> out, a
# ---------- ghpython_script_5: Python ----------
import Rhino
import scriptcontext
import System.Windows.Forms.DialogResult
import System.Drawing.Image

def AddBackgroundBitmap():
    # Allow the user to select a bitmap file
    fd = Rhino.UI.OpenFileDialog()
    fd.Filter = "Image Files (*.bmp;*.png;*.jpg)|*.bmp;*.png;*.jpg"
    if not fd.ShowDialog():
        return Rhino.Commands.Result.Cancel

    # Verify the file that was selected
    image = None
    try:
        image = System.Drawing.Image.FromFile(fd.FileName)
    except:
        return Rhino.Commands.Result.Failure

    # Allow the user to pick the bitmap origin
    gp = Rhino.Input.Custom.GetPoint()
    gp.SetCommandPrompt("Bitmap Origin")
    gp.ConstrainToConstructionPlane(True)
    gp.Get()
    if gp.CommandResult()!=Rhino.Commands.Result.Success:
        return gp.CommandResult()

    # Get the view that the point was picked in.
    # This will be the view that the bitmap appears in.
    view = gp.View()
    if view is None:
        view = scriptcontext.doc.Views.ActiveView
        if view is None: return Rhino.Commands.Result.Failure

    # Allow the user to specify the bitmap with in model units
    gn = Rhino.Input.Custom.GetNumber()
    gn.SetCommandPrompt("Bitmap width")
    gn.SetLowerLimit(1.0, False)
    gn.Get()
    if gn.CommandResult()!=Rhino.Commands.Result.Success:
        return gn.CommandResult()

    # Cook up some scale factors
    w = gn.Number()
    h = w * (image.Width / image.Height)

    plane = view.ActiveViewport.ConstructionPlane()
    plane.Origin = gp.Point()
    view.ActiveViewport.SetTraceImage(fd.FileName, plane, w, h, False, False)
    view.Redraw()
    return Rhino.Commands.Result.Success

if __name__=="__main__":
    AddBackgroundBitmap()
# ---------- end ghpython_script_5 ----------
# Customized
number_slider = Slider(17, range=0..100)

# ----
# Customized
number_slider_2 = Slider(2, range=0..5)
unit_x = UnitX(Factor=1)
unit_y = UnitY(Factor=1)
unit_z = UnitZ(Factor=1)

# ----
# Customized
number_slider_3 = Slider(10, range=0..10)
bold_ariel = Panel("helvitica")
unit_x_2 = UnitX(Factor=1)
unit_y_2 = UnitY(Factor=1)
# Customized
unit_z_2 = UnitZ(Factor=1)

# ----
# Customized
number_slider_4 = Slider(0, range=0..10)
point = Point(Point(9.829775017, -9.158753082, -7.144659753))

number_slider_5 = Slider(6, range=0..100)

construct_point = ConstructPoint(XCoordinate=number_slider_3, YCoordinate=Slider(0, range=0..10), ZCoordinate=Slider(10, range=0..10))
construct_point_2 = ConstructPoint(XCoordinate=Slider(10, range=0..10), YCoordinate=Slider(0, range=0..10), ZCoordinate=Slider(0, range=0..10))
pi = Pi(Factor=Slider(0, range=0..2))
pi_2 = Pi(Factor=Slider(1.97, range=0..2))
center_box = CenterBox(Base=PlaneXY(0, 0, 0), X=number_slider_5, Y=number_slider_5, Z=number_slider_5)
line_sdl = LineSDL(Start=construct_point, Direction=unit_y_2, Length=1)
populate_3d = Populate3D(Region=center_box, Count="2", Seed=Slider(0, range=0..100))
construct_plane = ConstructPlane(Origin=construct_point, XAxis=Vector(1, 0, 0), YAxis=Vector(0, 1, 0))
line_sdl_2 = LineSDL(Start=construct_point_2, Direction=unit_y, Length=1)
construct_plane_2 = ConstructPlane(Origin=construct_point_2, XAxis=Vector(1, 0, 0), YAxis=Vector(0, 1, 0))
construct_point_3 = ConstructPoint(XCoordinate=number_slider_4, YCoordinate=Slider(2, range=0..10), ZCoordinate=Slider(4, range=0..10))
dispatch = Dispatch(List=flatten(populate_3d), DispatchPattern=[True, False])  # -> ListA, ListB
rotate_3d = Rotate3D(Geometry=construct_plane_2, Angle=pi_2, Center=construct_point_2, Axis=line_sdl_2)  # -> Geometry, Transform
construct_point_4 = ConstructPoint(XCoordinate=0, YCoordinate=0, ZCoordinate=0)
rotate_3d_2 = Rotate3D(Geometry=construct_plane, Angle=pi, Center=construct_point, Axis=line_sdl)  # -> Geometry, Transform
ghpython_script_6 = GhPythonScript(pt0=construct_point_3, pt1=point)  # -> out, AddBrepBox; inputs pt0: Point3d, pt1: Point3d
# ---------- ghpython_script_6: Python ----------
import Rhino
import scriptcontext
import System.Guid

def AddBrepBox():
    #pt0 = Rhino.Geometry.Point3d(0, 0, 0)
    #pt1 = Rhino.Geometry.Point3d(10, 10, 10)
    box = Rhino.Geometry.BoundingBox(pt0, pt1)
    brep = box.ToBrep()
    rc = Rhino.Commands.Result.Failure
    if( Rhino.RhinoDoc.ActiveDoc.Objects.AddBrep(brep) != System.Guid.Empty ):
        rc = Rhino.Commands.Result.Success
        Rhino.RhinoDoc.ActiveDoc.Views.Redraw()
    return rc

if( __name__ == "__main__" ):
    AddBrepBox()
# ---------- end ghpython_script_6 ----------
ghpython_script_7 = GhPythonScript(w=number_slider, h=number_slider)  # -> out, AddBackgroundBitmap; inputs w: Int32, h: Int32
# ---------- ghpython_script_7: Python ----------
import Rhino
import scriptcontext
import System.Windows.Forms.DialogResult
import System.Drawing.Image

def AddBackgroundBitmap():
    # Allow the user to select a bitmap file
    fd = Rhino.UI.OpenFileDialog()
    fd.Filter = "Image Files (*.bmp;*.png;*.jpg)|*.bmp;*.png;*.jpg"
    if not fd.ShowDialog():
        return Rhino.Commands.Result.Cancel

    # Verify the file that was selected
    image = None
    try:
        image = System.Drawing.Image.FromFile(fd.FileName)
    except:
        return Rhino.Commands.Result.Failure

    # Allow the user to pick the bitmap origin
    gp = Rhino.Input.Custom.GetPoint()
    gp.SetCommandPrompt("Bitmap Origin")
    gp.ConstrainToConstructionPlane(True)
    gp.Get()
    if gp.CommandResult()!=Rhino.Commands.Result.Success:
        return gp.CommandResult()

    # Get the view that the point was picked in.
    # This will be the view that the bitmap appears in.
    view = gp.View()
    if view is None:
        view = scriptcontext.doc.Views.ActiveView
        if view is None: return Rhino.Commands.Result.Failure

    # Allow the user to specify the bitmap with in model units
    #gn = Rhino.Input.Custom.GetNumber()
    #gn.SetCommandPrompt("Bitmap width")
    #gn.SetLowerLimit(1.0, False)
    #gn.Get()
    #if gn.CommandResult()!=Rhino.Commands.Result.Success:
    #    return gn.CommandResult()

    # Cook up some scale factors
    #w = gn.Number()
    #h = w * (image.Width / image.Height)

    plane = view.ActiveViewport.ConstructionPlane()
    plane.Origin = gp.Point()
    view.ActiveViewport.SetTraceImage(fd.FileName, plane, w, h, False, False)
    view.Redraw()
    return Rhino.Commands.Result.Success

if __name__=="__main__":
    AddBackgroundBitmap()
# ---------- end ghpython_script_7 ----------
ghpython_script_8 = GhPythonScript(center_point=construct_point_4, height_point=construct_point_2, plane=rotate_3d.Geometry, radius=number_slider_2)  # -> out, AddCylinder; inputs center_point: Point3d, height_point: Point3d, plane: Plane, radius: Int32
# ---------- ghpython_script_8: Python ----------
import Rhino
import scriptcontext
import System.Guid

def AddCylinder():
    #center_point = Rhino.Geometry.Point3d(0, 0, 0)
    #height_point = Rhino.Geometry.Point3d(0, 0, 10)
    zaxis = height_point-center_point
    #plane = Rhino.Geometry.Plane(center_point, zaxis)
    #radius = 5
    circle = Rhino.Geometry.Circle(plane, radius)
    cylinder = Rhino.Geometry.Cylinder(circle, zaxis.Length)
    brep = cylinder.ToBrep(True, True)
    if brep:
        if Rhino.RhinoDoc.ActiveDoc.Objects.AddBrep(brep)!=System.Guid.Empty:
            Rhino.RhinoDoc.ActiveDoc.Views.Redraw()
            return Rhino.Commands.Result.Success
    return Rhino.Commands.Result.Failure

if __name__=="__main__":
    AddCylinder()
# ---------- end ghpython_script_8 ----------
ghpython_script_9 = GhPythonScript(pt1=dispatch.ListA, pt2=dispatch.ListB)  # -> out, ObjectDecoration; inputs pt1: Point3d, pt2: Point3d
# ---------- ghpython_script_9: Python ----------
import Rhino
import scriptcontext

def ObjectDecoration():
    # Define a line
    line = Rhino.Geometry.Line(pt1, pt2)

    # Make a copy of Rhino's default object attributes
    attribs = Rhino.RhinoDoc.ActiveDoc.CreateDefaultAttributes()

    # Modify the object decoration style
    attribs.ObjectDecoration = Rhino.DocObjects.ObjectDecoration.BothArrowhead

    # Create a new curve object with our attributes
    Rhino.RhinoDoc.ActiveDoc.Objects.AddLine(line, attribs)
    Rhino.RhinoDoc.ActiveDoc.Views.Redraw()

if __name__ == "__main__":
    ObjectDecoration()
# ---------- end ghpython_script_9 ----------
ghpython_script_10 = GhPythonScript(pt=construct_plane, text="dEVIL_dANTE", height=Slider(5.68, range=0..6), font=bold_ariel, plane=rotate_3d_2.Geometry)  # -> out, AddAnnotationText; inputs pt: Point3d, plane: Plane
# ---------- ghpython_script_10: Python ----------
import Rhino
import scriptcontext
import System.Guid

def AddAnnotationText():
    #pt = Rhino.Geometry.Point3d(10, 0, 0)
    #text = "Hello RhinoCommon"
    #height = 2.0
    #font = "Arial"
    #plane = Rhino.RhinoDoc.ActiveDoc.Views.ActiveView.ActiveViewport.ConstructionPlane()
    plane.Origin = pt
    id = Rhino.RhinoDoc.ActiveDoc.Objects.AddText(text, plane, height, font, False, False)
    if id!=System.Guid.Empty:
        Rhino.RhinoDoc.ActiveDoc.Views.Redraw()
        return Rhino.Commands.Result.Success
    return Rhino.Commands.Result.Failure


if __name__=="__main__":
    AddAnnotationText()

id = id
# ---------- end ghpython_script_10 ----------
c_script = CSharpScript()  # -> Out, A
panel = Panel(ghpython_script_6.AddBrepBox)
panel_2 = Panel(ghpython_script_7.AddBackgroundBitmap)
panel_3 = Panel(ghpython_script_9.ObjectDecoration)
panel_4 = Panel(ghpython_script_8.AddCylinder)
panel_5 = Panel(ghpython_script_10.AddAnnotationText)
