# Grasshopper definition 0.1_Rhino_Grasshopper_Python_WickersonStudios_Geometry_007.gh (Grasshopper 1.0.7)

# ----
# AddCircle
# Base Script
ghpython_script = GhPythonScript()  # -> out, AddCircle; disabled
# ---------- ghpython_script: Python ----------
import Rhino
import scriptcontext
import System.Guid

def AddCircle():
    center = Rhino.Geometry.Point3d(0, 0, 0)
    radius = 10.0
    c = Rhino.Geometry.Circle(center, radius)
    if Rhino.RhinoDoc.ActiveDoc.Objects.AddCircle(c)!=System.Guid.Empty:
        Rhino.RhinoDoc.ActiveDoc.Views.Redraw()
        return Rhino.Commands.Result.Success
    return Rhino.Commands.Result.Failure

if __name__=="__main__":
    AddCircle()
# ---------- end ghpython_script ----------

# ----
# Base Script
# AddBrepBox
ghpython_script_2 = GhPythonScript()  # -> out, a
# ---------- ghpython_script_2: Python ----------
import Rhino
import scriptcontext
import System.Windows.Forms.DialogResult
import System.Drawing.Image

def AddBackgroundBitmap():
    # Allow the user to select a bitmap file
    fd = Rhino.UI.OpenFileDialog()
    fd.Filter = "Image Files (*.bmp;*.png;*.jpg)|*.bmp;*.png;*.jpg"
    if not fd.ShowDialog():
        return Rhino.Commands.Result.Cancel

    # Verify the file that was selected
    image = None
    try:
        image = System.Drawing.Image.FromFile(fd.FileName)
    except:
        return Rhino.Commands.Result.Failure

    # Allow the user to pick the bitmap origin
    gp = Rhino.Input.Custom.GetPoint()
    gp.SetCommandPrompt("Bitmap Origin")
    gp.ConstrainToConstructionPlane(True)
    gp.Get()
    if gp.CommandResult()!=Rhino.Commands.Result.Success:
        return gp.CommandResult()

    # Get the view that the point was picked in.
    # This will be the view that the bitmap appears in.
    view = gp.View()
    if view is None:
        view = scriptcontext.doc.Views.ActiveView
        if view is None: return Rhino.Commands.Result.Failure

    # Allow the user to specify the bitmap with in model units
    gn = Rhino.Input.Custom.GetNumber()
    gn.SetCommandPrompt("Bitmap width")
    gn.SetLowerLimit(1.0, False)
    gn.Get()
    if gn.CommandResult()!=Rhino.Commands.Result.Success:
        return gn.CommandResult()

    # Cook up some scale factors
    w = gn.Number()
    h = w * (image.Width / image.Height)

    plane = view.ActiveViewport.ConstructionPlane()
    plane.Origin = gp.Point()
    view.ActiveViewport.SetTraceImage(fd.FileName, plane, w, h, False, False)
    view.Redraw()
    return Rhino.Commands.Result.Success

if __name__=="__main__":
    AddBackgroundBitmap()
# ---------- end ghpython_script_2 ----------

# ----
# AddCylinder
# Base Script
ghpython_script_3 = GhPythonScript()  # -> out, a
# ---------- ghpython_script_3: Python ----------
import Rhino
import scriptcontext
import System.Guid

def AddCylinder():
    center_point = Rhino.Geometry.Point3d(0, 0, 0)
    height_point = Rhino.Geometry.Point3d(0, 0, 10)
    zaxis = height_point-center_point
    plane = Rhino.Geometry.Plane(center_point, zaxis)
    radius = 5
    circle = Rhino.Geometry.Circle(plane, radius)
    cylinder = Rhino.Geometry.Cylinder(circle, zaxis.Length)
    brep = cylinder.ToBrep(True, True)
    if brep:
        if Rhino.RhinoDoc.ActiveDoc.Objects.AddBrep(brep)!=System.Guid.Empty:
            Rhino.RhinoDoc.ActiveDoc.Views.Redraw()
            return Rhino.Commands.Result.Success
    return Rhino.Commands.Result.Failure

if __name__=="__main__":
    AddCylinder()
# ---------- end ghpython_script_3 ----------

# ----
# ObjectDecoration
# Base Script
# AddBackgroundBitmap
ghpython_script_4 = GhPythonScript()  # -> out, a
# ---------- ghpython_script_4: Python ----------
import Rhino
import scriptcontext

def ObjectDecoration():
    # Define a line
    line = Rhino.Geometry.Line(Rhino.Geometry.Point3d(0, 0, 0), Rhino.Geometry.Point3d(10, 0, 0))

    # Make a copy of Rhino's default object attributes
    attribs = Rhino.RhinoDoc.ActiveDoc.CreateDefaultAttributes()

    # Modify the object decoration style
    attribs.ObjectDecoration = Rhino.DocObjects.ObjectDecoration.BothArrowhead

    # Create a new curve object with our attributes
    Rhino.RhinoDoc.ActiveDoc.Objects.AddLine(line, attribs)
    Rhino.RhinoDoc.ActiveDoc.Views.Redraw()

if __name__ == "__main__":
    ObjectDecoration()
# ---------- end ghpython_script_4 ----------

# ----
# Base Script
ghpython_script_5 = GhPythonScript()  # -> out, a
# ---------- ghpython_script_5: Python ----------
import Rhino
import scriptcontext
import System.Guid

def AddBrepBox():
    pt0 = Rhino.Geometry.Point3d(0, 0, 0)
    pt1 = Rhino.Geometry.Point3d(10, 10, 10)
    box = Rhino.Geometry.BoundingBox(pt0, pt1)
    brep = box.ToBrep()
    rc = Rhino.Commands.Result.Failure
    if( Rhino.RhinoDoc.ActiveDoc.Objects.AddBrep(brep) != System.Guid.Empty ):
        rc = Rhino.Commands.Result.Success
        Rhino.RhinoDoc.ActiveDoc.Views.Redraw()
    return rc

if( __name__ == "__main__" ):
    AddBrepBox()
# ---------- end ghpython_script_5 ----------

# ----
# GhPython Node Play at Wickerson Studios
# AddAnnotationText
# Base Script
ghpython_script_6 = GhPythonScript()  # -> out, a
# ---------- ghpython_script_6: Python ----------
import Rhino
import scriptcontext
import System.Guid

def AddAnnotationText():
    pt = Rhino.Geometry.Point3d(10, 0, 0)
    text = "Hello RhinoCommon"
    height = 2.0
    font = "Arial"
    plane = Rhino.RhinoDoc.ActiveDoc.Views.ActiveView.ActiveViewport.ConstructionPlane()
    plane.Origin = pt
    id = Rhino.RhinoDoc.ActiveDoc.Objects.AddText(text, plane, height, font, False, False)
    if id!=System.Guid.Empty:
        Rhino.RhinoDoc.ActiveDoc.Views.Redraw()
        return Rhino.Commands.Result.Success
    return Rhino.Commands.Result.Failure


if __name__=="__main__":
    AddAnnotationText()
# ---------- end ghpython_script_6 ----------

# ----
# AddChildLayer
# Base Script
ghpython_script_7 = GhPythonScript()  # -> out, AddChildLayer; disabled
# ---------- ghpython_script_7: Python ----------
import Rhino
import scriptcontext
import System.Drawing.Color

def AddChildLayer():
    # Get an existing layer
    default_name = Rhino.RhinoDoc.ActiveDoc.Layers.CurrentLayer.Name
    # Prompt the user to enter a layer name
    gs = Rhino.Input.Custom.GetString()
    gs.SetCommandPrompt("Name of existing layer")
    gs.SetDefaultString(default_name)
    gs.AcceptNothing(True)
    gs.Get()
    if gs.CommandResult()!=Rhino.Commands.Result.Success:
        return gs.CommandResult()

    # Was a layer named entered?
    layer_name = gs.StringResult().Trim()
    index = Rhino.RhinoDoc.ActiveDoc.Layers.Find(layer_name, True)
    if index<0: return Rhino.Commands.Result.Cancel

    parent_layer = Rhino.RhinoDoc.ActiveDoc.Layers[index]

    # Create a child layer
    child_name = parent_layer.Name + "_child"
    childlayer = Rhino.DocObjects.Layer()
    childlayer.ParentLayerId = parent_layer.Id
    childlayer.Name = child_name
    childlayer.Color = System.Drawing.Color.Red

    index = Rhino.RhinoDoc.ActiveDocMichael.Layers.Add(childlayer)
    if index<0:
        print "Unable to add", child_name, "layer."
        return Rhino.Commands.Result.Failure
    return Rhino.Commands.Result.Success

if __name__=="__main__":
    AddChildLayer()
# ---------- end ghpython_script_7 ----------

panel = Panel(ghpython_script.AddCircle)  # disabled
panel_2 = Panel(ghpython_script_7.AddChildLayer)  # disabled

# ----
# Customized
number_slider = Slider(17, range=0..100)

# ----
# Customized
number_slider_2 = Slider(0, range=0..2)
bold_ariel = Panel("helvitica")
unit_x = UnitX(Factor=1)
unit_y = UnitY(Factor=1)
unit_z = UnitZ(Factor=1)

# ----
# Customized
number_slider_3 = Slider(10, range=0..10)
unit_x_2 = UnitX(Factor=1)
unit_y_2 = UnitY(Factor=1)
unit_z_2 = UnitZ(Factor=1)

# ----
# Customized
number_slider_4 = Slider(6, range=0..100)

# ----
# Customized
number_slider_5 = Slider(10, range=0..10)
point = Point(Point(-6.426388837, 61.61644501, 61.29739006))

# ----
# Customized
number_slider_6 = Slider(10, range=0..20)  # disabled
number_slider_7 = Slider(7, range=0..10)  # disabled
number_slider_8 = Slider(46, range=0..100)  # disabled

construct_point = ConstructPoint(XCoordinate=number_slider_5, YCoordinate=Slider(7, range=0..10), ZCoordinate=Slider(0, range=0..10))
construct_point_2 = ConstructPoint(XCoordinate=Slider(0, range=0..10), YCoordinate=Slider(0, range=0..10), ZCoordinate=Slider(0, range=0..10))
pi = Pi(Factor=number_slider_2)
construct_point_3 = ConstructPoint(XCoordinate=Slider(0, range=0..10), YCoordinate=number_slider_3, ZCoordinate=Slider(0, range=0..10))
range = Range(Domain=number_slider_8, Steps=number_slider_8)  # disabled
center_box = CenterBox(Base=PlaneXY(0, 0, 0), X=number_slider_4, Y=number_slider_4, Z=number_slider_4)
pi_2 = Pi(Factor=Slider(1.97, range=0..2))
ghpython_script_8 = GhPythonScript(pt0=construct_point, pt1=point)  # -> out, AddBrepBox; inputs pt0: Point3d, pt1: Point3d
# ---------- ghpython_script_8: Python ----------
import Rhino
import scriptcontext
import System.Guid

def AddBrepBox():
    #pt0 = Rhino.Geometry.Point3d(0, 0, 0)
    #pt1 = Rhino.Geometry.Point3d(10, 10, 10)
    box = Rhino.Geometry.BoundingBox(pt0, pt1)
    brep = box.ToBrep()
    rc = Rhino.Commands.Result.Failure
    if( Rhino.RhinoDoc.ActiveDoc.Objects.AddBrep(brep) != System.Guid.Empty ):
        rc = Rhino.Commands.Result.Success
        Rhino.RhinoDoc.ActiveDoc.Views.Redraw()
    return rc

if( __name__ == "__main__" ):
    AddBrepBox()
# ---------- end ghpython_script_8 ----------
cosine = Cosine(Value=range)  # disabled
sine = Sine(Value=range)  # disabled
line_sdl = LineSDL(Start=construct_point_2, Direction=unit_x, Length=1)
populate_3d = Populate3D(Region=center_box, Count="2", Seed=Slider(0, range=0..100))
construct_plane = ConstructPlane(Origin=construct_point_2, XAxis=Vector(1, 0, 0), YAxis=Vector(0, 1, 0))
line_sdl_2 = LineSDL(Start=construct_point_3, Direction=unit_y_2, Length=1)
construct_plane_2 = ConstructPlane(Origin=construct_point_3, XAxis=Vector(1, 0, 0), YAxis=Vector(0, 1, 0))
multiplication = Multiplication(A=cosine, B=number_slider_7)  # disabled
dispatch = Dispatch(List=flatten(populate_3d), DispatchPattern=[True, False])  # -> ListA, ListB
rotate_3d = Rotate3D(Geometry=construct_plane_2, Angle=pi_2, Center=construct_point_3, Axis=line_sdl_2)  # -> Geometry, Transform
construct_point_4 = ConstructPoint(XCoordinate=0, YCoordinate=0, ZCoordinate=0)
rotate_3d_2 = Rotate3D(Geometry=construct_plane, Angle=pi, Center=construct_point_2, Axis=line_sdl)  # -> Geometry, Transform
construct_point_5 = ConstructPoint(XCoordinate=multiplication, YCoordinate=sine, ZCoordinate=range)  # disabled
ghpython_script_9 = GhPythonScript()  # -> Out, A
ghpython_script_10 = GhPythonScript(pt=construct_plane, text="dEVIL_dANTE", height=Slider(3.03, range=0..6), font=bold_ariel, plane=rotate_3d_2.Geometry)  # -> out, AddAnnotationText; inputs pt: Point3d, plane: Plane
# ---------- ghpython_script_10: Python ----------
import Rhino
import scriptcontext
import System.Guid

def AddAnnotationText():
    #pt = Rhino.Geometry.Point3d(10, 0, 0)
    #text = "Hello RhinoCommon"
    #height = 2.0
    #font = "Arial"
    #plane = Rhino.RhinoDoc.ActiveDoc.Views.ActiveView.ActiveViewport.ConstructionPlane()
    plane.Origin = pt
    id = Rhino.RhinoDoc.ActiveDoc.Objects.AddText(text, plane, height, font, False, False)
    if id!=System.Guid.Empty:
        Rhino.RhinoDoc.ActiveDoc.Views.Redraw()
        return Rhino.Commands.Result.Success
    return Rhino.Commands.Result.Failure


if __name__=="__main__":
    AddAnnotationText()

id = id
# ---------- end ghpython_script_10 ----------
ghpython_script_11 = GhPythonScript(center_point=construct_point_4, height_point=construct_point_3, plane=rotate_3d.Geometry, radius=Slider(5, range=0..5))  # -> out, AddCylinder, brep; inputs center_point: Point3d, height_point: Point3d, plane: Plane, radius: Int32
# ---------- ghpython_script_11: Python ----------
import Rhino
import scriptcontext
import System.Guid

#center_point = Rhino.Geometry.Point3d(0, 0, 0)
#height_point = Rhino.Geometry.Point3d(0, 0, 10)
zaxis = height_point-center_point
#plane = Rhino.Geometry.Plane(center_point, zaxis)
#radius = 5
circle = Rhino.Geometry.Circle(plane, radius)
cylinder = Rhino.Geometry.Cylinder(circle, zaxis.Length)
brep = cylinder.ToBrep(True, True)

def AddCylinder():
    #center_point = Rhino.Geometry.Point3d(0, 0, 0)
    #height_point = Rhino.Geometry.Point3d(0, 0, 10)
    zaxis = height_point-center_point
    #plane = Rhino.Geometry.Plane(center_point, zaxis)
    #radius = 5
    circle = Rhino.Geometry.Circle(plane, radius)
    cylinder = Rhino.Geometry.Cylinder(circle, zaxis.Length)
    brep = cylinder.ToBrep(True, True)
    if brep:
        if Rhino.RhinoDoc.ActiveDoc.Objects.AddBrep(brep)!=System.Guid.Empty:
            Rhino.RhinoDoc.ActiveDoc.Views.Redraw()
            return Rhino.Commands.Result.Success
    return Rhino.Commands.Result.Failure

if __name__=="__main__":
    AddCylinder()
# ---------- end ghpython_script_11 ----------
ghpython_script_12 = GhPythonScript(w=number_slider, h=number_slider)  # -> out, AddBackgroundBitmap; inputs w: Int32, h: Int32
# ---------- ghpython_script_12: Python ----------
import Rhino
import scriptcontext
import System.Windows.Forms.DialogResult
import System.Drawing.Image

def AddBackgroundBitmap():
    # Allow the user to select a bitmap file
    fd = Rhino.UI.OpenFileDialog()
    fd.Filter = "Image Files (*.bmp;*.png;*.jpg)|*.bmp;*.png;*.jpg"
    if not fd.ShowDialog():
        return Rhino.Commands.Result.Cancel

    # Verify the file that was selected
    image = None
    try:
        image = System.Drawing.Image.FromFile(fd.FileName)
    except:
        return Rhino.Commands.Result.Failure

    # Allow the user to pick the bitmap origin
    gp = Rhino.Input.Custom.GetPoint()
    gp.SetCommandPrompt("Bitmap Origin")
    gp.ConstrainToConstructionPlane(True)
    gp.Get()
    if gp.CommandResult()!=Rhino.Commands.Result.Success:
        return gp.CommandResult()

    # Get the view that the point was picked in.
    # This will be the view that the bitmap appears in.
    view = gp.View()
    if view is None:
        view = scriptcontext.doc.Views.ActiveView
        if view is None: return Rhino.Commands.Result.Failure

    # Allow the user to specify the bitmap with in model units
    #gn = Rhino.Input.Custom.GetNumber()
    #gn.SetCommandPrompt("Bitmap width")
    #gn.SetLowerLimit(1.0, False)
    #gn.Get()
    #if gn.CommandResult()!=Rhino.Commands.Result.Success:
    #    return gn.CommandResult()

    # Cook up some scale factors
    #w = gn.Number()
    #h = w * (image.Width / image.Height)

    plane = view.ActiveViewport.ConstructionPlane()
    plane.Origin = gp.Point()
    view.ActiveViewport.SetTraceImage(fd.FileName, plane, w, h, False, False)
    view.Redraw()
    return Rhino.Commands.Result.Success

if __name__=="__main__":
    AddBackgroundBitmap()
# ---------- end ghpython_script_12 ----------
ghpython_script_13 = GhPythonScript(pt1=dispatch.ListA, pt2=dispatch.ListB)  # -> out, ObjectDecoration; inputs pt1: Point3d, pt2: Point3d
# ---------- ghpython_script_13: Python ----------
import Rhino
import scriptcontext

def ObjectDecoration():
    # Define a line
    line = Rhino.Geometry.Line(pt1, pt2)

    # Make a copy of Rhino's default object attributes
    attribs = Rhino.RhinoDoc.ActiveDoc.CreateDefaultAttributes()

    # Modify the object decoration style
    attribs.ObjectDecoration = Rhino.DocObjects.ObjectDecoration.BothArrowhead

    # Create a new curve object with our attributes
    Rhino.RhinoDoc.ActiveDoc.Objects.AddLine(line, attribs)
    Rhino.RhinoDoc.ActiveDoc.Views.Redraw()

if __name__ == "__main__":
    ObjectDecoration()
# ---------- end ghpython_script_13 ----------
ghpython_script_14 = GhPythonScript(center=construct_point_5, radius=number_slider_6)  # -> out, AddCircle, c; inputs center: Point3d, radius: Int32; disabled
# ---------- ghpython_script_14: Python ----------
import Rhino
import scriptcontext
import System.Guid

def AddCircle():
    #center = Rhino.Geometry.Point3d(0, 0, 0)
    #radius = 10.0
    c = Rhino.Geometry.Circle(center, radius)
    if Rhino.RhinoDoc.ActiveDoc.Objects.AddCircle(c)!=System.Guid.Empty:
        Rhino.RhinoDoc.ActiveDoc.Views.Redraw()
        return Rhino.Commands.Result.Success
    return Rhino.Commands.Result.Failure

if __name__=="__main__":
    AddCircle()
    
c = Rhino.Geometry.Circle(center, radius)
# ---------- end ghpython_script_14 ----------
panel_3 = Panel(ghpython_script_14.AddCircle)  # disabled
panel_4 = Panel(ghpython_script_14.c)  # disabled
panel_5 = Panel(ghpython_script_10.AddAnnotationText)
panel_6 = Panel(ghpython_script_11.AddCylinder)
panel_7 = Panel(ghpython_script_8.AddBrepBox)
panel_8 = Panel(ghpython_script_13.ObjectDecoration)
panel_9 = Panel(ghpython_script_12.AddBackgroundBitmap)
loft = Loft(
    Curves=ghpython_script_14.c,
    Options={Adjust=False, Closed=False, LoftEnds=0, LoftSimp=0, LoftType=0, Rebuild=10, Refit=0.01})  # disabled

panel_10 = Panel(ghpython_script_11.brep)
brep = Brep(ghpython_script_11.brep)
