# Grasshopper definition 0.1_Rhino_Grasshopper_Python_WickersonStudios_Geometry_008.gh (Grasshopper 1.0.7)

# ----
# AddCircle
# Base Script
ghpython_script = GhPythonScript()  # -> out, AddCircle; disabled
# ---------- ghpython_script: Python ----------
import Rhino
import scriptcontext
import System.Guid

def AddCircle():
    center = Rhino.Geometry.Point3d(0, 0, 0)
    radius = 10.0
    c = Rhino.Geometry.Circle(center, radius)
    if Rhino.RhinoDoc.ActiveDoc.Objects.AddCircle(c)!=System.Guid.Empty:
        Rhino.RhinoDoc.ActiveDoc.Views.Redraw()
        return Rhino.Commands.Result.Success
    return Rhino.Commands.Result.Failure

if __name__=="__main__":
    AddCircle()
# ---------- end ghpython_script ----------

# ----
# AddClippingPlane
# Base Script
ghpython_script_2 = GhPythonScript()  # -> out, AddClippingPlane; disabled
# ---------- ghpython_script_2: Python ----------
import Rhino
import scriptcontext
import System.Guid

def AddClippingPlane():
    # Define the corners of the clipping plane
    rc, corners = Rhino.Input.RhinoGet.GetRectangle()
    if rc!=Rhino.Commands.Result.Success: return rc

    # Get the active view
    view = Rhino.RhinoDoc.ActiveDoc.Views.ActiveView
    if view is None: return Rhino.Commands.Result.Failure

    p0, p1, p2, p3 = corners
    # Create a plane from the corner points
    plane = Rhino.Geometry.Plane(p0, p1, p3)

    # Add a clipping plane object to the document
    id = Rhino.RhinoDoc.ActiveDoc.Objects.AddClippingPlane(plane, p0.DistanceTo(p1), p0.DistanceTo(p3), view.ActiveViewportID)
    if id!=System.Guid.Empty:
        Rhino.RhinoDoc.ActiveDoc.Views.Redraw()
        return Rhino.Commands.Result.Success
    return Rhino.Commands.Result.Failure

if __name__=="__main__":
    AddClippingPlane()
# ---------- end ghpython_script_2 ----------

# ----
# CommandLineOptions
# Base Script
# AddCone
ghpython_script_3 = GhPythonScript()  # -> out, CommandLineOptions; disabled
# ---------- ghpython_script_3: Python ----------
import Rhino
import scriptcontext

def CommandLineOptions():
    # For this example we will use a GetPoint class, but all of the custom
    # "Get" classes support command line options.
    gp = Rhino.Input.Custom.GetPoint()
    gp.SetCommandPrompt("GetPoint with options")

    # set up the options
    intOption = Rhino.Input.Custom.OptionInteger(1, 1, 99)
    dblOption = Rhino.Input.Custom.OptionDouble(2.2, 0, 99.9)
    boolOption = Rhino.Input.Custom.OptionToggle(True, "Off", "On")
    listValues = "Item0", "Item1", "Item2", "Item3", "Item4"

    gp.AddOptionInteger("Integer", intOption)
    gp.AddOptionDouble("Double", dblOption)
    gp.AddOptionToggle("Boolean", boolOption)
    listIndex = 3
    opList = gp.AddOptionList("List", listValues, listIndex)
    while True:
        # perform the get operation. This will prompt the user to
        # input a point, but also allow for command line options
        # defined above
        get_rc = gp.Get()
        if gp.CommandResult()!=Rhino.Commands.Result.Success:
            return gp.CommandResult()
        if get_rc==Rhino.Input.GetResult.Point:
            point = gp.Point()
            scriptcontext.doc.Objects.AddPoint(point)
            scriptcontext.doc.Views.Redraw()
            print "Command line option values are"
            print " Integer =", intOption.CurrentValue
            print " Double =", dblOption.CurrentValue
            print " Boolean =", boolOption.CurrentValue
            print " List =", listValues[listIndex]
        elif get_rc==Rhino.Input.GetResult.Option:
            if gp.OptionIndex()==opList:
                listIndex = gp.Option().CurrentListOptionIndex
            continue
        break
    return Rhino.Commands.Result.Success


if __name__ == "__main__":
    CommandLineOptions()
# ---------- end ghpython_script_3 ----------

# ----
# Base Script
ghpython_script_4 = GhPythonScript()  # -> out, AddCone; disabled
# ---------- ghpython_script_4: Python ----------
import Rhino
import scriptcontext

def AddCone():
    plane = Rhino.Geometry.Plane.WorldXY
    height = 10
    radius = 5
    cone = Rhino.Geometry.Cone(plane, height, radius)
    if cone.IsValid:
        cap_bottom = True
        cone_brep = cone.ToBrep(cap_bottom)
        if cone_brep:
            Rhino.RhinoDoc.ActiveDoc.Objects.AddBrep(cone_brep)
            Rhino.RhinoDoc.ActiveDoc.Views.Redraw()
    return Rhino.Commands.Result.Success

if __name__=="__main__":
    AddCone()
# ---------- end ghpython_script_4 ----------

# ----
# Base Script
# AddBrepBox
ghpython_script_5 = GhPythonScript()  # -> out, a; disabled
# ---------- ghpython_script_5: Python ----------
import Rhino
import scriptcontext
import System.Windows.Forms.DialogResult
import System.Drawing.Image

def AddBackgroundBitmap():
    # Allow the user to select a bitmap file
    fd = Rhino.UI.OpenFileDialog()
    fd.Filter = "Image Files (*.bmp;*.png;*.jpg)|*.bmp;*.png;*.jpg"
    if not fd.ShowDialog():
        return Rhino.Commands.Result.Cancel

    # Verify the file that was selected
    image = None
    try:
        image = System.Drawing.Image.FromFile(fd.FileName)
    except:
        return Rhino.Commands.Result.Failure

    # Allow the user to pick the bitmap origin
    gp = Rhino.Input.Custom.GetPoint()
    gp.SetCommandPrompt("Bitmap Origin")
    gp.ConstrainToConstructionPlane(True)
    gp.Get()
    if gp.CommandResult()!=Rhino.Commands.Result.Success:
        return gp.CommandResult()

    # Get the view that the point was picked in.
    # This will be the view that the bitmap appears in.
    view = gp.View()
    if view is None:
        view = scriptcontext.doc.Views.ActiveView
        if view is None: return Rhino.Commands.Result.Failure

    # Allow the user to specify the bitmap with in model units
    gn = Rhino.Input.Custom.GetNumber()
    gn.SetCommandPrompt("Bitmap width")
    gn.SetLowerLimit(1.0, False)
    gn.Get()
    if gn.CommandResult()!=Rhino.Commands.Result.Success:
        return gn.CommandResult()

    # Cook up some scale factors
    w = gn.Number()
    h = w * (image.Width / image.Height)

    plane = view.ActiveViewport.ConstructionPlane()
    plane.Origin = gp.Point()
    view.ActiveViewport.SetTraceImage(fd.FileName, plane, w, h, False, False)
    view.Redraw()
    return Rhino.Commands.Result.Success

if __name__=="__main__":
    AddBackgroundBitmap()
# ---------- end ghpython_script_5 ----------

# ----
# AddCylinder
# Base Script
ghpython_script_6 = GhPythonScript()  # -> out, a; disabled
# ---------- ghpython_script_6: Python ----------
import Rhino
import scriptcontext
import System.Guid

def AddCylinder():
    center_point = Rhino.Geometry.Point3d(0, 0, 0)
    height_point = Rhino.Geometry.Point3d(0, 0, 10)
    zaxis = height_point-center_point
    plane = Rhino.Geometry.Plane(center_point, zaxis)
    radius = 5
    circle = Rhino.Geometry.Circle(plane, radius)
    cylinder = Rhino.Geometry.Cylinder(circle, zaxis.Length)
    brep = cylinder.ToBrep(True, True)
    if brep:
        if Rhino.RhinoDoc.ActiveDoc.Objects.AddBrep(brep)!=System.Guid.Empty:
            Rhino.RhinoDoc.ActiveDoc.Views.Redraw()
            return Rhino.Commands.Result.Success
    return Rhino.Commands.Result.Failure

if __name__=="__main__":
    AddCylinder()
# ---------- end ghpython_script_6 ----------

# ----
# ObjectDecoration
# Base Script
# AddBackgroundBitmap
ghpython_script_7 = GhPythonScript()  # -> out, a; disabled
# ---------- ghpython_script_7: Python ----------
import Rhino
import scriptcontext

def ObjectDecoration():
    # Define a line
    line = Rhino.Geometry.Line(Rhino.Geometry.Point3d(0, 0, 0), Rhino.Geometry.Point3d(10, 0, 0))

    # Make a copy of Rhino's default object attributes
    attribs = Rhino.RhinoDoc.ActiveDoc.CreateDefaultAttributes()

    # Modify the object decoration style
    attribs.ObjectDecoration = Rhino.DocObjects.ObjectDecoration.BothArrowhead

    # Create a new curve object with our attributes
    Rhino.RhinoDoc.ActiveDoc.Objects.AddLine(line, attribs)
    Rhino.RhinoDoc.ActiveDoc.Views.Redraw()

if __name__ == "__main__":
    ObjectDecoration()
# ---------- end ghpython_script_7 ----------

# ----
# Base Script
ghpython_script_8 = GhPythonScript()  # -> out, AddBrepBox; disabled
# ---------- ghpython_script_8: Python ----------
import Rhino
import scriptcontext
import System.Guid

def AddBrepBox():
    pt0 = Rhino.Geometry.Point3d(0, 0, 0)
    pt1 = Rhino.Geometry.Point3d(10, 10, 10)
    box = Rhino.Geometry.BoundingBox(pt0, pt1)
    brep = box.ToBrep()
    rc = Rhino.Commands.Result.Failure
    if( Rhino.RhinoDoc.ActiveDoc.Objects.AddBrep(brep) != System.Guid.Empty ):
        rc = Rhino.Commands.Result.Success
        Rhino.RhinoDoc.ActiveDoc.Views.Redraw()
    return rc

if( __name__ == "__main__" ):
    AddBrepBox()
# ---------- end ghpython_script_8 ----------

# ----
# GhPython Node Play at Wickerson Studios
# AddAnnotationText
# Base Script
ghpython_script_9 = GhPythonScript()  # -> out, a; disabled
# ---------- ghpython_script_9: Python ----------
import Rhino
import scriptcontext
import System.Guid

def AddAnnotationText():
    pt = Rhino.Geometry.Point3d(10, 0, 0)
    text = "Hello RhinoCommon"
    height = 2.0
    font = "Arial"
    plane = Rhino.RhinoDoc.ActiveDoc.Views.ActiveView.ActiveViewport.ConstructionPlane()
    plane.Origin = pt
    id = Rhino.RhinoDoc.ActiveDoc.Objects.AddText(text, plane, height, font, False, False)
    if id!=System.Guid.Empty:
        Rhino.RhinoDoc.ActiveDoc.Views.Redraw()
        return Rhino.Commands.Result.Success
    return Rhino.Commands.Result.Failure


if __name__=="__main__":
    AddAnnotationText()
# ---------- end ghpython_script_9 ----------

# ----
# AddChildLayer
# Base Script
ghpython_script_10 = GhPythonScript()  # -> out, AddChildLayer; disabled
# ---------- ghpython_script_10: Python ----------
import Rhino
import scriptcontext
import System.Drawing.Color

def AddChildLayer():
    # Get an existing layer
    default_name = Rhino.RhinoDoc.ActiveDoc.Layers.CurrentLayer.Name
    # Prompt the user to enter a layer name
    gs = Rhino.Input.Custom.GetString()
    gs.SetCommandPrompt("Name of existing layer")
    gs.SetDefaultString(default_name)
    gs.AcceptNothing(True)
    gs.Get()
    if gs.CommandResult()!=Rhino.Commands.Result.Success:
        return gs.CommandResult()

    # Was a layer named entered?
    layer_name = gs.StringResult().Trim()
    index = Rhino.RhinoDoc.ActiveDoc.Layers.Find(layer_name, True)
    if index<0: return Rhino.Commands.Result.Cancel

    parent_layer = Rhino.RhinoDoc.ActiveDoc.Layers[index]

    # Create a child layer
    child_name = parent_layer.Name + "_child"
    childlayer = Rhino.DocObjects.Layer()
    childlayer.ParentLayerId = parent_layer.Id
    childlayer.Name = child_name
    childlayer.Color = System.Drawing.Color.Red

    index = Rhino.RhinoDoc.ActiveDocMichael.Layers.Add(childlayer)
    if index<0:
        print "Unable to add", child_name, "layer."
        return Rhino.Commands.Result.Failure
    return Rhino.Commands.Result.Success

if __name__=="__main__":
    AddChildLayer()d
# ---------- end ghpython_script_10 ----------

panel = Panel(ghpython_script.AddCircle)  # disabled
panel_2 = Panel(ghpython_script_2.AddClippingPlane)  # disabled
panel_3 = Panel(ghpython_script_3.CommandLineOptions)  # disabled
panel_4 = Panel(ghpython_script_8.AddBrepBox)  # disabled

number_slider = Slider(20, range=0..23)  # disabled
number_slider_2 = Slider(3, range=0..10)  # disabled
number_slider_3 = Slider(1.52, range=0..2)  # disabled

panel_5 = Panel(ghpython_script_10.AddChildLayer)  # disabled

# ----
# Customized
number_slider_4 = Slider(17, range=0..100)  # disabled

# ----
# Customized
number_slider_5 = Slider(0, range=0..2)  # disabled
number_slider_6 = Slider(0, range=0..10)  # disabled
number_slider_7 = Slider(0, range=0..10)  # disabled
number_slider_8 = Slider(3.03, range=0..6)  # disabled
bold_ariel = Panel("helvitica")  # disabled
number_slider_9 = Slider(0, range=0..10)  # disabled
panel_6 = Panel("dEVIL_dANTE")  # disabled
unit_x = UnitX(Factor=1)  # disabled
unit_y = UnitY(Factor=1)  # disabled
unit_z = UnitZ(Factor=1)  # disabled

# ----
# Customized
number_slider_10 = Slider(10, range=0..10)  # disabled
number_slider_11 = Slider(0, range=0..10)  # disabled
number_slider_12 = Slider(5, range=0..5)  # disabled
number_slider_13 = Slider(0, range=0..10)  # disabled
number_slider_14 = Slider(1.25, range=0..2)  # disabled
unit_x_2 = UnitX(Factor=1)  # disabled
unit_y_2 = UnitY(Factor=1)  # disabled
unit_z_2 = UnitZ(Factor=1)  # disabled

# ----
# Customized
number_slider_15 = Slider(6, range=0..100)  # disabled
number_slider_16 = Slider(0, range=0..100)  # disabled
panel_7 = Panel("2")  # disabled

# ----
# Customized
number_slider_17 = Slider(10, range=0..10)  # disabled
number_slider_18 = Slider(0, range=0..10)  # disabled
number_slider_19 = Slider(7, range=0..10)  # disabled
point = Point(Point(-6.426388837, 61.61644501, 61.29739006))  # disabled

# ----
# Customized
number_slider_20 = Slider(10, range=0..20)  # disabled
number_slider_21 = Slider(7, range=0..10)  # disabled
number_slider_22 = Slider(46, range=0..100)  # disabled

vector_xyz = VectorXYZ(XComponent=number_slider, YComponent=number_slider_2, ZComponent=number_slider)  # -> Vector, Length; disabled
construct_point = ConstructPoint(XCoordinate=0, YCoordinate=0, ZCoordinate=0)  # disabled

number_slider_23 = Slider(110, range=0..110)  # disabled
number_slider_24 = Slider(4, range=0..10)  # disabled
number_slider_25 = Slider(49, range=0..110)  # disabled

number_slider_26 = Slider(63, range=0..110)  # disabled
construct_point_2 = ConstructPoint(XCoordinate=number_slider_17, YCoordinate=number_slider_19, ZCoordinate=number_slider_18)  # disabled
construct_point_3 = ConstructPoint(XCoordinate=number_slider_6, YCoordinate=number_slider_7, ZCoordinate=number_slider_9)  # disabled
pi = Pi(Factor=number_slider_5)  # disabled
construct_point_4 = ConstructPoint(XCoordinate=number_slider_13, YCoordinate=number_slider_10, ZCoordinate=number_slider_11)  # disabled
range = Range(Domain=number_slider_22, Steps=number_slider_22)  # disabled
center_box = CenterBox(Base=PlaneXY(0, 0, 0), X=number_slider_15, Y=number_slider_15, Z=number_slider_15)  # disabled
pi_2 = Pi(Factor=number_slider_14)  # disabled
construct_plane = ConstructPlane(Origin=Point(0, 0, 0), XAxis=Vector(1, 0, 0), YAxis=vector_xyz.Vector)  # disabled
pi_3 = Pi(Factor=number_slider_3)  # disabled
line_sdl = LineSDL(Start=construct_point, Direction=vector_xyz.Vector, Length=1)  # disabled
ghpython_script_11 = GhPythonScript(pt0=construct_point_2, pt1=point)  # -> out, AddBrepBox; inputs pt0: Point3d, pt1: Point3d; disabled
# ---------- ghpython_script_11: Python ----------
import Rhino
import scriptcontext
import System.Guid

def AddBrepBox():
    #pt0 = Rhino.Geometry.Point3d(0, 0, 0)
    #pt1 = Rhino.Geometry.Point3d(10, 10, 10)
    box = Rhino.Geometry.BoundingBox(pt0, pt1)
    brep = box.ToBrep()
    rc = Rhino.Commands.Result.Failure
    if( Rhino.RhinoDoc.ActiveDoc.Objects.AddBrep(brep) != System.Guid.Empty ):
        rc = Rhino.Commands.Result.Success
        Rhino.RhinoDoc.ActiveDoc.Views.Redraw()
    return rc

if( __name__ == "__main__" ):
    AddBrepBox()
# ---------- end ghpython_script_11 ----------
cosine = Cosine(Value=range)  # disabled
sine = Sine(Value=range)  # disabled
line_sdl_2 = LineSDL(Start=construct_point_3, Direction=unit_x, Length=1)  # disabled
populate_3d = Populate3D(Region=center_box, Count=panel_7, Seed=number_slider_16)  # disabled
construct_plane_2 = ConstructPlane(Origin=construct_point_3, XAxis=Vector(1, 0, 0), YAxis=Vector(0, 1, 0))  # disabled
line_sdl_3 = LineSDL(Start=construct_point_4, Direction=unit_y_2, Length=1)  # disabled
construct_plane_3 = ConstructPlane(Origin=construct_point_4, XAxis=Vector(1, 0, 0), YAxis=Vector(0, 1, 0))  # disabled
rotate_3d = Rotate3D(Geometry=construct_plane, Angle=pi_3, Center=Point(0, 0, 0), Axis=line_sdl)  # -> Geometry, Transform; disabled
multiplication = Multiplication(A=cosine, B=number_slider_21)  # disabled
dispatch = Dispatch(List=flatten(populate_3d), DispatchPattern=[True, False])  # -> ListA, ListB; disabled
construct_point_5 = ConstructPoint(XCoordinate=number_slider_24, YCoordinate=number_slider_23, ZCoordinate=number_slider_25)  # disabled
construct_point_6 = ConstructPoint(XCoordinate=number_slider_23, YCoordinate=number_slider_24, ZCoordinate=number_slider_25)  # disabled
construct_point_7 = ConstructPoint(XCoordinate=number_slider_23, YCoordinate=number_slider_25, ZCoordinate=number_slider_26)  # disabled
rotate_3d_2 = Rotate3D(Geometry=construct_plane_3, Angle=pi_2, Center=construct_point_4, Axis=line_sdl_3)  # -> Geometry, Transform; disabled
construct_point_8 = ConstructPoint(XCoordinate=0, YCoordinate=0, ZCoordinate=0)  # disabled
rotate_3d_3 = Rotate3D(Geometry=construct_plane_2, Angle=pi, Center=construct_point_3, Axis=line_sdl_2)  # -> Geometry, Transform; disabled
ghpython_script_12 = GhPythonScript(plane=rotate_3d.Geometry, height=number_slider, radius=number_slider_2)  # -> out, AddCone, cone; inputs plane: Plane, height: Int32, radius: Int32; disabled
# ---------- ghpython_script_12: Python ----------
import Rhino
import scriptcontext

def AddCone():
    #plane = Rhino.Geometry.Plane.WorldXY
    #height = 10
    #radius = 5
    cone = Rhino.Geometry.Cone(plane, height, radius)
    if cone.IsValid:
        cap_bottom = True
        cone_brep = cone.ToBrep(cap_bottom)
        if cone_brep:
            Rhino.RhinoDoc.ActiveDoc.Objects.AddBrep(cone_brep)
            Rhino.RhinoDoc.ActiveDoc.Views.Redraw()
    return Rhino.Commands.Result.Success

if __name__=="__main__":
    AddCone()

cone = Rhino.Geometry.Cone(plane, height, radius)
# ---------- end ghpython_script_12 ----------
construct_point_9 = ConstructPoint(XCoordinate=multiplication, YCoordinate=sine, ZCoordinate=range)  # disabled
ghpython_script_13 = GhPythonScript()  # -> Out, A; disabled
ghpython_script_14 = GhPythonScript(pt=construct_plane_2, text=panel_6, height=number_slider_8, font=bold_ariel, plane=rotate_3d_3.Geometry)  # -> out, AddAnnotationText; inputs pt: Point3d, plane: Plane; disabled
# ---------- ghpython_script_14: Python ----------
import Rhino
import scriptcontext
import System.Guid

def AddAnnotationText():
    #pt = Rhino.Geometry.Point3d(10, 0, 0)
    #text = "Hello RhinoCommon"
    #height = 2.0
    #font = "Arial"
    #plane = Rhino.RhinoDoc.ActiveDoc.Views.ActiveView.ActiveViewport.ConstructionPlane()
    plane.Origin = pt
    id = Rhino.RhinoDoc.ActiveDoc.Objects.AddText(text, plane, height, font, False, False)
    if id!=System.Guid.Empty:
        Rhino.RhinoDoc.ActiveDoc.Views.Redraw()
        return Rhino.Commands.Result.Success
    return Rhino.Commands.Result.Failure


if __name__=="__main__":
    AddAnnotationText()

id = id
# ---------- end ghpython_script_14 ----------
ghpython_script_15 = GhPythonScript(center_point=construct_point_8, height_point=construct_point_4, plane=rotate_3d_2.Geometry, radius=number_slider_12)  # -> out, AddCylinder, brep; inputs center_point: Point3d, height_point: Point3d, plane: Plane, radius: Int32; disabled
# ---------- ghpython_script_15: Python ----------
import Rhino
import scriptcontext
import System.Guid

#center_point = Rhino.Geometry.Point3d(0, 0, 0)
#height_point = Rhino.Geometry.Point3d(0, 0, 10)
zaxis = height_point-center_point
#plane = Rhino.Geometry.Plane(center_point, zaxis)
#radius = 5
circle = Rhino.Geometry.Circle(plane, radius)
cylinder = Rhino.Geometry.Cylinder(circle, zaxis.Length)
brep = cylinder.ToBrep(True, True)

def AddCylinder():
    #center_point = Rhino.Geometry.Point3d(0, 0, 0)
    #height_point = Rhino.Geometry.Point3d(0, 0, 10)
    zaxis = height_point-center_point
    #plane = Rhino.Geometry.Plane(center_point, zaxis)
    #radius = 5
    circle = Rhino.Geometry.Circle(plane, radius)
    cylinder = Rhino.Geometry.Cylinder(circle, zaxis.Length)
    brep = cylinder.ToBrep(True, True)
    if brep:
        if Rhino.RhinoDoc.ActiveDoc.Objects.AddBrep(brep)!=System.Guid.Empty:
            Rhino.RhinoDoc.ActiveDoc.Views.Redraw()
            return Rhino.Commands.Result.Success
    return Rhino.Commands.Result.Failure

if __name__=="__main__":
    AddCylinder()
# ---------- end ghpython_script_15 ----------
ghpython_script_16 = GhPythonScript(w=number_slider_4, h=number_slider_4)  # -> out, AddBackgroundBitmap; inputs w: Int32, h: Int32; disabled
# ---------- ghpython_script_16: Python ----------
import Rhino
import scriptcontext
import System.Windows.Forms.DialogResult
import System.Drawing.Image

def AddBackgroundBitmap():
    # Allow the user to select a bitmap file
    fd = Rhino.UI.OpenFileDialog()
    fd.Filter = "Image Files (*.bmp;*.png;*.jpg)|*.bmp;*.png;*.jpg"
    if not fd.ShowDialog():
        return Rhino.Commands.Result.Cancel

    # Verify the file that was selected
    image = None
    try:
        image = System.Drawing.Image.FromFile(fd.FileName)
    except:
        return Rhino.Commands.Result.Failure

    # Allow the user to pick the bitmap origin
    gp = Rhino.Input.Custom.GetPoint()
    gp.SetCommandPrompt("Bitmap Origin")
    gp.ConstrainToConstructionPlane(True)
    gp.Get()
    if gp.CommandResult()!=Rhino.Commands.Result.Success:
        return gp.CommandResult()

    # Get the view that the point was picked in.
    # This will be the view that the bitmap appears in.
    view = gp.View()
    if view is None:
        view = scriptcontext.doc.Views.ActiveView
        if view is None: return Rhino.Commands.Result.Failure

    # Allow the user to specify the bitmap with in model units
    #gn = Rhino.Input.Custom.GetNumber()
    #gn.SetCommandPrompt("Bitmap width")
    #gn.SetLowerLimit(1.0, False)
    #gn.Get()
    #if gn.CommandResult()!=Rhino.Commands.Result.Success:
    #    return gn.CommandResult()

    # Cook up some scale factors
    #w = gn.Number()
    #h = w * (image.Width / image.Height)

    plane = view.ActiveViewport.ConstructionPlane()
    plane.Origin = gp.Point()
    view.ActiveViewport.SetTraceImage(fd.FileName, plane, w, h, False, False)
    view.Redraw()
    return Rhino.Commands.Result.Success

if __name__=="__main__":
    AddBackgroundBitmap()
# ---------- end ghpython_script_16 ----------
ghpython_script_17 = GhPythonScript(pt1=dispatch.ListA, pt2=dispatch.ListB)  # -> out, ObjectDecoration; inputs pt1: Point3d, pt2: Point3d; disabled
# ---------- ghpython_script_17: Python ----------
import Rhino
import scriptcontext

def ObjectDecoration():
    # Define a line
    line = Rhino.Geometry.Line(pt1, pt2)

    # Make a copy of Rhino's default object attributes
    attribs = Rhino.RhinoDoc.ActiveDoc.CreateDefaultAttributes()

    # Modify the object decoration style
    attribs.ObjectDecoration = Rhino.DocObjects.ObjectDecoration.BothArrowhead

    # Create a new curve object with our attributes
    Rhino.RhinoDoc.ActiveDoc.Objects.AddLine(line, attribs)
    Rhino.RhinoDoc.ActiveDoc.Views.Redraw()

if __name__ == "__main__":
    ObjectDecoration()
# ---------- end ghpython_script_17 ----------
panel_8 = Panel(ghpython_script_12.AddCone)  # disabled
sphere = Sphere(Base=construct_point, Radius=number_slider)  # disabled
ghpython_script_18 = GhPythonScript(center=construct_point_9, radius=number_slider_20)  # -> out, AddCircle, c; inputs center: Point3d, radius: Int32; disabled
# ---------- ghpython_script_18: Python ----------
import Rhino
import scriptcontext
import System.Guid

def AddCircle():
    #center = Rhino.Geometry.Point3d(0, 0, 0)
    #radius = 10.0
    c = Rhino.Geometry.Circle(center, radius)
    if Rhino.RhinoDoc.ActiveDoc.Objects.AddCircle(c)!=System.Guid.Empty:
        Rhino.RhinoDoc.ActiveDoc.Views.Redraw()
        return Rhino.Commands.Result.Success
    return Rhino.Commands.Result.Failure

if __name__=="__main__":
    AddCircle()
    
c = Rhino.Geometry.Circle(center, radius)
# ---------- end ghpython_script_18 ----------
geometry = Geometry(ghpython_script_12.cone)  # disabled
ghpython_script_19 = GhPythonScript(x=construct_point_5, y=construct_point_6, z=construct_point_7)  # -> out, AddCircle, id; inputs x: Point3d, y: Point3d, z: Point3d; disabled
# ---------- ghpython_script_19: Python ----------
import Rhino
import scriptcontext
import System.Guid

def AddClippingPlane():
    # Define the corners of the clipping plane
    #rc, corners = Rhino.Input.RhinoGet.GetRectangle()
    #if rc!=Rhino.Commands.Result.Success: return rc

    # Get the active view
    view = Rhino.RhinoDoc.ActiveDoc.Views.ActiveView
    if view is None: return Rhino.Commands.Result.Failure

    #p0, p1, p2, p3 = corners
    # Create a plane from the corner points
    #plane = Rhino.Geometry.Plane(p0, p1, p3)
    plane = Rhino.Geometry.Plane(x, y, z)

    # Add a clipping plane object to the document
    id = Rhino.RhinoDoc.ActiveDoc.Objects.AddClippingPlane(plane, x.DistanceTo(y), y.DistanceTo(z), view.ActiveViewportID)
    if id!=System.Guid.Empty:
        Rhino.RhinoDoc.ActiveDoc.Views.Redraw()
        return Rhino.Commands.Result.Success
    return Rhino.Commands.Result.Failure

if __name__=="__main__":
    AddClippingPlane()
    
view = Rhino.RhinoDoc.ActiveDoc.Views.ActiveView
plane = Rhino.Geometry.Plane(x, y, z)
id = Rhino.RhinoDoc.ActiveDoc.Objects.AddClippingPlane(plane, x.DistanceTo(y), y.DistanceTo(z), view.ActiveViewportID)
# ---------- end ghpython_script_19 ----------
panel_9 = Panel(ghpython_script_18.AddCircle)  # disabled
panel_10 = Panel(ghpython_script_18.c)  # disabled
panel_11 = Panel(ghpython_script_14.AddAnnotationText)  # disabled
panel_12 = Panel(ghpython_script_15.AddCylinder)  # disabled
panel_13 = Panel(ghpython_script_11.AddBrepBox)  # disabled
panel_14 = Panel(ghpython_script_17.ObjectDecoration)  # disabled
panel_15 = Panel(ghpython_script_16.AddBackgroundBitmap)  # disabled
panel_16 = Panel(ghpython_script_19.AddCircle)  # disabled
plane = Plane(ghpython_script_19.id)  # disabled
loft = Loft(
    Curves=ghpython_script_18.c,
    Options={Adjust=False, Closed=False, LoftEnds=0, LoftSimp=0, LoftType=0, Rebuild=10, Refit=0.01})  # disabled

panel_17 = Panel(ghpython_script_15.brep)  # disabled
brep = Brep(ghpython_script_15.brep)  # disabled
