# Grasshopper definition 0.1_Rhino_Grasshopper_Python_WickersonStudios_Geometry_009.gh (Grasshopper 1.0.7)

# ----
# AddCircle
# Base Script
ghpython_script = GhPythonScript()  # -> out, AddCircle; disabled
# ---------- ghpython_script: Python ----------
import Rhino
import scriptcontext
import System.Guid

def AddCircle():
    center = Rhino.Geometry.Point3d(0, 0, 0)
    radius = 10.0
    c = Rhino.Geometry.Circle(center, radius)
    if Rhino.RhinoDoc.ActiveDoc.Objects.AddCircle(c)!=System.Guid.Empty:
        Rhino.RhinoDoc.ActiveDoc.Views.Redraw()
        return Rhino.Commands.Result.Success
    return Rhino.Commands.Result.Failure

if __name__=="__main__":
    AddCircle()
# ---------- end ghpython_script ----------

# ----
# AddClippingPlane
# Base Script
ghpython_script_2 = GhPythonScript()  # -> out, AddClippingPlane; disabled
# ---------- ghpython_script_2: Python ----------
import Rhino
import scriptcontext
import System.Guid

def AddClippingPlane():
    # Define the corners of the clipping plane
    rc, corners = Rhino.Input.RhinoGet.GetRectangle()
    if rc!=Rhino.Commands.Result.Success: return rc

    # Get the active view
    view = Rhino.RhinoDoc.ActiveDoc.Views.ActiveView
    if view is None: return Rhino.Commands.Result.Failure

    p0, p1, p2, p3 = corners
    # Create a plane from the corner points
    plane = Rhino.Geometry.Plane(p0, p1, p3)

    # Add a clipping plane object to the document
    id = Rhino.RhinoDoc.ActiveDoc.Objects.AddClippingPlane(plane, p0.DistanceTo(p1), p0.DistanceTo(p3), view.ActiveViewportID)
    if id!=System.Guid.Empty:
        Rhino.RhinoDoc.ActiveDoc.Views.Redraw()
        return Rhino.Commands.Result.Success
    return Rhino.Commands.Result.Failure

if __name__=="__main__":
    AddClippingPlane()
# ---------- end ghpython_script_2 ----------

# ----
# CommandLineOptions
# Base Script
ghpython_script_3 = GhPythonScript()  # -> out, CommandLineOptions; disabled
# ---------- ghpython_script_3: Python ----------
import Rhino
import scriptcontext

def CommandLineOptions():
    # For this example we will use a GetPoint class, but all of the custom
    # "Get" classes support command line options.
    gp = Rhino.Input.Custom.GetPoint()
    gp.SetCommandPrompt("GetPoint with options")

    # set up the options
    intOption = Rhino.Input.Custom.OptionInteger(1, 1, 99)
    dblOption = Rhino.Input.Custom.OptionDouble(2.2, 0, 99.9)
    boolOption = Rhino.Input.Custom.OptionToggle(True, "Off", "On")
    listValues = "Item0", "Item1", "Item2", "Item3", "Item4"

    gp.AddOptionInteger("Integer", intOption)
    gp.AddOptionDouble("Double", dblOption)
    gp.AddOptionToggle("Boolean", boolOption)
    listIndex = 3
    opList = gp.AddOptionList("List", listValues, listIndex)
    while True:
        # perform the get operation. This will prompt the user to
        # input a point, but also allow for command line options
        # defined above
        get_rc = gp.Get()
        if gp.CommandResult()!=Rhino.Commands.Result.Success:
            return gp.CommandResult()
        if get_rc==Rhino.Input.GetResult.Point:
            point = gp.Point()
            scriptcontext.doc.Objects.AddPoint(point)
            scriptcontext.doc.Views.Redraw()
            print "Command line option values are"
            print " Integer =", intOption.CurrentValue
            print " Double =", dblOption.CurrentValue
            print " Boolean =", boolOption.CurrentValue
            print " List =", listValues[listIndex]
        elif get_rc==Rhino.Input.GetResult.Option:
            if gp.OptionIndex()==opList:
                listIndex = gp.Option().CurrentListOptionIndex
            continue
        break
    return Rhino.Commands.Result.Success


if __name__ == "__main__":
    CommandLineOptions()
# ---------- end ghpython_script_3 ----------

# ----
# AddCone
# Base Script
ghpython_script_4 = GhPythonScript()  # -> out, AddCone; disabled
# ---------- ghpython_script_4: Python ----------
import Rhino
import scriptcontext

def AddCone():
    plane = Rhino.Geometry.Plane.WorldXY
    height = 10
    radius = 5
    cone = Rhino.Geometry.Cone(plane, height, radius)
    if cone.IsValid:
        cap_bottom = True
        cone_brep = cone.ToBrep(cap_bottom)
        if cone_brep:
            Rhino.RhinoDoc.ActiveDoc.Objects.AddBrep(cone_brep)
            Rhino.RhinoDoc.ActiveDoc.Views.Redraw()
    return Rhino.Commands.Result.Success

if __name__=="__main__":
    AddCone()
# ---------- end ghpython_script_4 ----------

# ----
# Base Script
# AddBrepBox
ghpython_script_5 = GhPythonScript()  # -> out, a; disabled
# ---------- ghpython_script_5: Python ----------
import Rhino
import scriptcontext
import System.Windows.Forms.DialogResult
import System.Drawing.Image

def AddBackgroundBitmap():
    # Allow the user to select a bitmap file
    fd = Rhino.UI.OpenFileDialog()
    fd.Filter = "Image Files (*.bmp;*.png;*.jpg)|*.bmp;*.png;*.jpg"
    if not fd.ShowDialog():
        return Rhino.Commands.Result.Cancel

    # Verify the file that was selected
    image = None
    try:
        image = System.Drawing.Image.FromFile(fd.FileName)
    except:
        return Rhino.Commands.Result.Failure

    # Allow the user to pick the bitmap origin
    gp = Rhino.Input.Custom.GetPoint()
    gp.SetCommandPrompt("Bitmap Origin")
    gp.ConstrainToConstructionPlane(True)
    gp.Get()
    if gp.CommandResult()!=Rhino.Commands.Result.Success:
        return gp.CommandResult()

    # Get the view that the point was picked in.
    # This will be the view that the bitmap appears in.
    view = gp.View()
    if view is None:
        view = scriptcontext.doc.Views.ActiveView
        if view is None: return Rhino.Commands.Result.Failure

    # Allow the user to specify the bitmap with in model units
    gn = Rhino.Input.Custom.GetNumber()
    gn.SetCommandPrompt("Bitmap width")
    gn.SetLowerLimit(1.0, False)
    gn.Get()
    if gn.CommandResult()!=Rhino.Commands.Result.Success:
        return gn.CommandResult()

    # Cook up some scale factors
    w = gn.Number()
    h = w * (image.Width / image.Height)

    plane = view.ActiveViewport.ConstructionPlane()
    plane.Origin = gp.Point()
    view.ActiveViewport.SetTraceImage(fd.FileName, plane, w, h, False, False)
    view.Redraw()
    return Rhino.Commands.Result.Success

if __name__=="__main__":
    AddBackgroundBitmap()
# ---------- end ghpython_script_5 ----------

# ----
# AddCylinder
# Base Script
ghpython_script_6 = GhPythonScript()  # -> out, a; disabled
# ---------- ghpython_script_6: Python ----------
import Rhino
import scriptcontext
import System.Guid

def AddCylinder():
    center_point = Rhino.Geometry.Point3d(0, 0, 0)
    height_point = Rhino.Geometry.Point3d(0, 0, 10)
    zaxis = height_point-center_point
    plane = Rhino.Geometry.Plane(center_point, zaxis)
    radius = 5
    circle = Rhino.Geometry.Circle(plane, radius)
    cylinder = Rhino.Geometry.Cylinder(circle, zaxis.Length)
    brep = cylinder.ToBrep(True, True)
    if brep:
        if Rhino.RhinoDoc.ActiveDoc.Objects.AddBrep(brep)!=System.Guid.Empty:
            Rhino.RhinoDoc.ActiveDoc.Views.Redraw()
            return Rhino.Commands.Result.Success
    return Rhino.Commands.Result.Failure

if __name__=="__main__":
    AddCylinder()
# ---------- end ghpython_script_6 ----------

# ----
# ObjectDecoration
# Base Script
# AddBackgroundBitmap
ghpython_script_7 = GhPythonScript()  # -> out, a; disabled
# ---------- ghpython_script_7: Python ----------
import Rhino
import scriptcontext

def ObjectDecoration():
    # Define a line
    line = Rhino.Geometry.Line(Rhino.Geometry.Point3d(0, 0, 0), Rhino.Geometry.Point3d(10, 0, 0))

    # Make a copy of Rhino's default object attributes
    attribs = Rhino.RhinoDoc.ActiveDoc.CreateDefaultAttributes()

    # Modify the object decoration style
    attribs.ObjectDecoration = Rhino.DocObjects.ObjectDecoration.BothArrowhead

    # Create a new curve object with our attributes
    Rhino.RhinoDoc.ActiveDoc.Objects.AddLine(line, attribs)
    Rhino.RhinoDoc.ActiveDoc.Views.Redraw()

if __name__ == "__main__":
    ObjectDecoration()
# ---------- end ghpython_script_7 ----------

# ----
# Base Script
ghpython_script_8 = GhPythonScript()  # -> out, AddBrepBox; disabled
# ---------- ghpython_script_8: Python ----------
import Rhino
import scriptcontext
import System.Guid

def AddBrepBox():
    pt0 = Rhino.Geometry.Point3d(0, 0, 0)
    pt1 = Rhino.Geometry.Point3d(10, 10, 10)
    box = Rhino.Geometry.BoundingBox(pt0, pt1)
    brep = box.ToBrep()
    rc = Rhino.Commands.Result.Failure
    if( Rhino.RhinoDoc.ActiveDoc.Objects.AddBrep(brep) != System.Guid.Empty ):
        rc = Rhino.Commands.Result.Success
        Rhino.RhinoDoc.ActiveDoc.Views.Redraw()
    return rc

if( __name__ == "__main__" ):
    AddBrepBox()
# ---------- end ghpython_script_8 ----------

# ----
# AddCylinder
ghpython_script_9 = GhPythonScript()  # -> out, a; disabled; same code as ghpython_script_6

# ----
# GhPython Node Play at Wickerson Studios
# AddAnnotationText
# Base Script
ghpython_script_10 = GhPythonScript()  # -> out, a; disabled
# ---------- ghpython_script_10: Python ----------
import Rhino
import scriptcontext
import System.Guid

def AddAnnotationText():
    pt = Rhino.Geometry.Point3d(10, 0, 0)
    text = "Hello RhinoCommon"
    height = 2.0
    font = "Arial"
    plane = Rhino.RhinoDoc.ActiveDoc.Views.ActiveView.ActiveViewport.ConstructionPlane()
    plane.Origin = pt
    id = Rhino.RhinoDoc.ActiveDoc.Objects.AddText(text, plane, height, font, False, False)
    if id!=System.Guid.Empty:
        Rhino.RhinoDoc.ActiveDoc.Views.Redraw()
        return Rhino.Commands.Result.Success
    return Rhino.Commands.Result.Failure


if __name__=="__main__":
    AddAnnotationText()
# ---------- end ghpython_script_10 ----------

# ----
# AddChildLayer
# Base Script
ghpython_script_11 = GhPythonScript()  # -> out, AddChildLayer; disabled
# ---------- ghpython_script_11: Python ----------
import Rhino
import scriptcontext
import System.Drawing.Color

def AddChildLayer():
    # Get an existing layer
    default_name = Rhino.RhinoDoc.ActiveDoc.Layers.CurrentLayer.Name
    # Prompt the user to enter a layer name
    gs = Rhino.Input.Custom.GetString()
    gs.SetCommandPrompt("Name of existing layer")
    gs.SetDefaultString(default_name)
    gs.AcceptNothing(True)
    gs.Get()
    if gs.CommandResult()!=Rhino.Commands.Result.Success:
        return gs.CommandResult()

    # Was a layer named entered?
    layer_name = gs.StringResult().Trim()
    index = Rhino.RhinoDoc.ActiveDoc.Layers.Find(layer_name, True)
    if index<0: return Rhino.Commands.Result.Cancel

    parent_layer = Rhino.RhinoDoc.ActiveDoc.Layers[index]

    # Create a child layer
    child_name = parent_layer.Name + "_child"
    childlayer = Rhino.DocObjects.Layer()
    childlayer.ParentLayerId = parent_layer.Id
    childlayer.Name = child_name
    childlayer.Color = System.Drawing.Color.Red

    index = Rhino.RhinoDoc.ActiveDocMichael.Layers.Add(childlayer)
    if index<0:
        print "Unable to add", child_name, "layer."
        return Rhino.Commands.Result.Failure
    return Rhino.Commands.Result.Success

if __name__=="__main__":
    AddChildLayer()d
# ---------- end ghpython_script_11 ----------

# ----
# AddLine
ghpython_script_12 = GhPythonScript()  # -> out; disabled
# ---------- ghpython_script_12: Python ----------
import Rhino
import scriptcontext
import System.Guid




def AddLine():
    gp = Rhino.Input.Custom.GetPoint()
    gp.SetCommandPrompt("Start of line")
    gp.Get()
    if gp.CommandResult()!=Rhino.Commands.Result.Success:
        return gp.CommandResult()
    pt_start = gp.Point()

    gp.SetCommandPrompt("End of line")
    gp.SetBasePoint(pt_start, False)
    gp.DrawLineFromPoint(pt_start, True)
    gp.Get()
    if gp.CommandResult() != Rhino.Commands.Result.Success:
        return gp.CommandResult()
    pt_end = gp.Point()
    v = pt_end - pt_start
    if v.IsTiny(Rhino.RhinoMath.ZeroTolerance):
        return Rhino.Commands.Result.Nothing

    id = Rhino.RhinoDoc.ActiveDoc.Objects.AddLine(pt_start, pt_end)
    if id!=System.Guid.Empty:
        Rhino.RhinoDoc.ActiveDoc.Views.Redraw()
        return Rhino.Commands.Result.Success
    return Rhino.Commands.Result.Failure

if __name__=="__main__":
    AddLine()
# ---------- end ghpython_script_12 ----------
panel = Panel(ghpython_script.AddCircle)  # disabled
# AddLinearDimension
# AddLinearDimension2
ghpython_script_13 = GhPythonScript()  # -> out; disabled
# ---------- ghpython_script_13: Python ----------
import Rhino
import scriptcontext
import System.Guid

def AddLinearDimension():
    rc, dimension = Rhino.Input.RhinoGet.GetLinearDimension()
    if rc==Rhino.Commands.Result.Success:
        if Rhino.RhinoDoc.ActiveDoc.Objects.AddLinearDimension(dimension)==System.Guid.Empty:
            rc = Rhino.Commands.Result.Failure
        else:
            Rhino.RhinoDoc.ActiveDoc.Views.Redraw()
    return rc


if __name__=="__main__":
    AddLinearDimension()

rc, dimension = Rhino.Input.RhinoGet.GetLinearDimension()
# ---------- end ghpython_script_13 ----------
panel_2 = Panel(ghpython_script_2.AddClippingPlane)  # disabled
ghpython_script_14 = GhPythonScript()  # -> out, a; disabled
# ---------- ghpython_script_14: Python ----------
import Rhino
import scriptcontext
import System.Guid

def AddLinearDimension2():
    origin = Rhino.Geometry.Point3d(1,1,0)
    offset = Rhino.Geometry.Point3d(11,1,0)
    pt = Rhino.Geometry.Point3d((offset.X-origin.X)/2.0,3,0)
    plane = Rhino.Geometry.Plane.WorldXY
    plane.Origin = origin

    rc, u, v = plane.ClosestParameter(origin)
    ext1 = Rhino.Geometry.Point2d(u,v)
    rc, u, v = plane.ClosestParameter(offset)
    ext2 = Rhino.Geometry.Point2d(u,v)
    rc, u, v = plane.ClosestParameter(pt)
    linePt = Rhino.Geometry.Point2d(u,v)

    dimension = Rhino.Geometry.LinearDimension(plane, ext1, ext2, linePt)
    if Rhino.RhinoDoc.ActiveDoc.Objects.AddLinearDimension(dimension)!=System.Guid.Empty:
        Rhino.RhinoDoc.ActiveDoc.Views.Redraw()
        return Rhino.Commands.Result.Success
    return Rhino.Commands.Result.Failure

if __name__=="__main__":
    AddLinearDimension2()
# ---------- end ghpython_script_14 ----------
# AddMaterial
ghpython_script_15 = GhPythonScript()  # -> out, a; disabled
# ---------- ghpython_script_15: Python ----------
import Rhino
import scriptcontext
import System.Drawing

def AddMaterial():
    # materials are stored in the document's material table
    index = Rhino.RhinoDoc.ActiveDoc.Materials.Add()
    mat = Rhino.RhinoDoc.ActiveDoc.Materials[index]
    mat.DiffuseColor = System.Drawing.Color.Chocolate
    mat.SpecularColor = System.Drawing.Color.CadetBlue
    mat.CommitChanges()

    # set up object attributes to say they use a specific material
    sp = Rhino.Geometry.Sphere(Rhino.Geometry.Plane.WorldXY, 5)
    attr = Rhino.DocObjects.ObjectAttributes()
    attr.MaterialIndex = index
    attr.MaterialSource = Rhino.DocObjects.ObjectMaterialSource.MaterialFromObject
    Rhino.RhinoDoc.ActiveDoc.Objects.AddSphere(sp, attr)

    # add a sphere without the material attributes set
    sp.Center = Rhino.Geometry.Point3d(10, 10, 0)
    Rhino.RhinoDoc.ActiveDoc.Objects.AddSphere(sp)

    Rhino.RhinoDoc.ActiveDoc.Views.Redraw();

if __name__=="__main__":
    AddMaterial()
# ---------- end ghpython_script_15 ----------
panel_3 = Panel(ghpython_script_3.CommandLineOptions)  # disabled
panel_4 = Panel(ghpython_script_8.AddBrepBox)  # disabled

number_slider = Slider(20, range=0..23)  # disabled
number_slider_2 = Slider(3, range=0..10)  # disabled
number_slider_3 = Slider(1.52, range=0..2)  # disabled

number_slider_4 = Slider(4, range=0..10)  # disabled
number_slider_5 = Slider(10, range=0..10)  # disabled

panel_5 = Panel(ghpython_script_11.AddChildLayer)  # disabled

number_slider_6 = Slider(62, range=0..100)  # disabled
number_slider_7 = Slider(2, range=0..10)  # disabled
number_slider_8 = Slider(10, range=0..10)  # disabled
number_slider_9 = Slider(3, range=0..10)  # disabled
number_slider_10 = Slider(2, range=0..10)  # disabled

# ----
# Customized
number_slider_11 = Slider(17, range=0..100)  # disabled

# ----
# Customized
number_slider_12 = Slider(0, range=0..2)  # disabled
number_slider_13 = Slider(0, range=0..10)  # disabled
number_slider_14 = Slider(0, range=0..10)  # disabled
number_slider_15 = Slider(3.03, range=0..6)  # disabled
bold_ariel = Panel("helvitica")  # disabled
number_slider_16 = Slider(0, range=0..10)  # disabled
panel_6 = Panel("dEVIL_dANTE")  # disabled
unit_x = UnitX(Factor=1)  # disabled
unit_y = UnitY(Factor=1)  # disabled
unit_z = UnitZ(Factor=1)  # disabled

# ----
# Customized
number_slider_17 = Slider(10, range=0..10)  # disabled
number_slider_18 = Slider(0, range=0..10)  # disabled
number_slider_19 = Slider(5, range=0..5)  # disabled
number_slider_20 = Slider(0, range=0..10)  # disabled
number_slider_21 = Slider(1.25, range=0..2)  # disabled
unit_x_2 = UnitX(Factor=1)  # disabled
unit_y_2 = UnitY(Factor=1)  # disabled
unit_z_2 = UnitZ(Factor=1)  # disabled

# ----
# Customized
number_slider_22 = Slider(6, range=0..100)  # disabled
number_slider_23 = Slider(0, range=0..100)  # disabled
panel_7 = Panel("2")  # disabled

# ----
# Customized
number_slider_24 = Slider(10, range=0..10)  # disabled
number_slider_25 = Slider(0, range=0..10)  # disabled
number_slider_26 = Slider(7, range=0..10)  # disabled
point = Point(Point(-6.426388837, 61.61644501, 61.29739006))  # disabled

# ----
# Customized
number_slider_27 = Slider(10, range=0..20)  # disabled
number_slider_28 = Slider(7, range=0..10)  # disabled
number_slider_29 = Slider(46, range=0..100)  # disabled

number_slider_30 = Slider(0, range=0..100)  # disabled
number_slider_31 = Slider(49, range=0..100)  # disabled
number_slider_32 = Slider(29, range=0..100)  # disabled
yz_plane = YZPlane(Origin=Point(0, 0, 0))  # disabled
xy_plane = XYPlane(Origin=Point(0, 0, 0))  # disabled
xz_plane = XZPlane(Origin=Point(0, 0, 0))  # disabled
point_2 = Point(Point(48.70155212, 37.44829863, 40.77563004))  # disabled
point_3 = Point(Point(-0.9260979995, 8.132475623, 0))  # disabled

vector_xyz = VectorXYZ(XComponent=number_slider, YComponent=number_slider_2, ZComponent=number_slider)  # -> Vector, Length; disabled
construct_point = ConstructPoint(XCoordinate=0, YCoordinate=0, ZCoordinate=0)  # disabled
construct_point_2 = ConstructPoint(XCoordinate=number_slider_4, YCoordinate=number_slider_5, ZCoordinate=number_slider_4)  # disabled
construct_point_3 = ConstructPoint(XCoordinate=number_slider_4, YCoordinate=number_slider_5, ZCoordinate=number_slider_5)  # disabled
construct_point_4 = ConstructPoint(XCoordinate=number_slider_5, YCoordinate=number_slider_4, ZCoordinate=number_slider_4)  # disabled

number_slider_33 = Slider(110, range=0..110)  # disabled
number_slider_34 = Slider(4, range=0..10)  # disabled
number_slider_35 = Slider(49, range=0..110)  # disabled

number_slider_36 = Slider(63, range=0..110)  # disabled
ghpython_script_16 = GhPythonScript(radius=number_slider_7, factor=number_slider_8, start=number_slider_9, stop=number_slider_6, step=number_slider_10)  # -> out, a; inputs radius: Int32, start: Int32, stop: Int32, step: Int32; disabled
# ---------- ghpython_script_16: Python ----------
import Rhino
import scriptcontext
import System.Guid
import random
import math

pts = []
for i in range(start, stop, step):
    pt = Rhino.Geometry.Point3d(random.uniform(0,100), random.uniform(0,100),random.uniform(0,100))
    pts.append(pt)

    def AddCylinder():
        center_point = Rhino.Geometry.Point3d(pt.Y - i, pt.X - i , pt.Z - i)
        height_point = Rhino.Geometry.Point3d(pt.X + i, pt.Y + i, pt.Z + i)
        zaxis = height_point-center_point
        plane = Rhino.Geometry.Plane(center_point, zaxis)
        radiusB = factor * radius * math.sin(factor * i)
        circle = Rhino.Geometry.Circle(plane, radiusB)
        cylinder = Rhino.Geometry.Cylinder(circle, zaxis.Length)
        brep = cylinder.ToBrep(True, True)
        if brep:
            if Rhino.RhinoDoc.ActiveDoc.Objects.AddBrep(brep)!=System.Guid.Empty:
                Rhino.RhinoDoc.ActiveDoc.Views.Redraw()
                return Rhino.Commands.Result.Success
        return Rhino.Commands.Result.Failure
    
    if __name__=="__main__":
        AddCylinder()
# ---------- end ghpython_script_16 ----------
construct_point_5 = ConstructPoint(XCoordinate=number_slider_24, YCoordinate=number_slider_26, ZCoordinate=number_slider_25)  # disabled
construct_point_6 = ConstructPoint(XCoordinate=number_slider_13, YCoordinate=number_slider_14, ZCoordinate=number_slider_16)  # disabled
pi = Pi(Factor=number_slider_12)  # disabled
construct_point_7 = ConstructPoint(XCoordinate=number_slider_20, YCoordinate=number_slider_17, ZCoordinate=number_slider_18)  # disabled
range = Range(Domain=number_slider_29, Steps=number_slider_29)  # disabled
point_4 = Point(construct_point_2)  # disabled
center_box = CenterBox(Base=PlaneXY(0, 0, 0), X=number_slider_22, Y=number_slider_22, Z=number_slider_22)  # disabled
point_5 = Point(construct_point_4)  # disabled
point_6 = Point(construct_point_3)  # disabled
pi_2 = Pi(Factor=number_slider_21)  # disabled
construct_plane = ConstructPlane(Origin=Point(0, 0, 0), XAxis=Vector(1, 0, 0), YAxis=vector_xyz.Vector)  # disabled
pi_3 = Pi(Factor=number_slider_3)  # disabled
line_sdl = LineSDL(Start=construct_point, Direction=vector_xyz.Vector, Length=1)  # disabled
ghpython_script_17 = GhPythonScript(pt0=construct_point_5, pt1=point)  # -> out, AddBrepBox; inputs pt0: Point3d, pt1: Point3d; disabled
# ---------- ghpython_script_17: Python ----------
import Rhino
import scriptcontext
import System.Guid

def AddBrepBox():
    #pt0 = Rhino.Geometry.Point3d(0, 0, 0)
    #pt1 = Rhino.Geometry.Point3d(10, 10, 10)
    box = Rhino.Geometry.BoundingBox(pt0, pt1)
    brep = box.ToBrep()
    rc = Rhino.Commands.Result.Failure
    if( Rhino.RhinoDoc.ActiveDoc.Objects.AddBrep(brep) != System.Guid.Empty ):
        rc = Rhino.Commands.Result.Success
        Rhino.RhinoDoc.ActiveDoc.Views.Redraw()
    return rc

if( __name__ == "__main__" ):
    AddBrepBox()
# ---------- end ghpython_script_17 ----------
cosine = Cosine(Value=range)  # disabled
ghpython_script_18 = GhPythonScript(origin=point_2, offset=point_3, x=number_slider_31, y=number_slider_30, z=number_slider_32, plane=xy_plane)  # -> out, dimension, linePt, a; inputs origin: Point3d, offset: Point3d, x: Int32, y: Int32, z: Int32, plane: Plane; disabled
# ---------- ghpython_script_18: Python ----------
import Rhino
import scriptcontext
import System.Guid

def AddLinearDimension2():
    #origin = Rhino.Geometry.Point3d(1,1,0)
    #offset = Rhino.Geometry.Point3d(11,1,0)
    pt = Rhino.Geometry.Point3d((offset.X-origin.X)/x,y,z)
    #plane = Rhino.Geometry.Plane.WorldXY
    plane.Origin = origin

    rc, u, v = plane.ClosestParameter(origin)
    ext1 = Rhino.Geometry.Point2d(u,v)
    rc, u, v = plane.ClosestParameter(offset)
    ext2 = Rhino.Geometry.Point2d(u,v)
    rc, u, v = plane.ClosestParameter(pt)
    linePt = Rhino.Geometry.Point2d(u,v)

    dimension = Rhino.Geometry.LinearDimension(plane, ext1, ext2, linePt)
    if Rhino.RhinoDoc.ActiveDoc.Objects.AddLinearDimension(dimension)!=System.Guid.Empty:
        Rhino.RhinoDoc.ActiveDoc.Views.Redraw()
        return Rhino.Commands.Result.Success
    return Rhino.Commands.Result.Failure

if __name__=="__main__":
    AddLinearDimension2()
    

pt = Rhino.Geometry.Point3d((offset.X-origin.X)/x,y,z)
plane.Origin = origin
rc, u, v = plane.ClosestParameter(origin)
ext1 = Rhino.Geometry.Point2d(u,v)
rc, u, v = plane.ClosestParameter(offset)
ext2 = Rhino.Geometry.Point2d(u,v)
rc, u, v = plane.ClosestParameter(pt)
linePt = Rhino.Geometry.Point2d(u,v)
dimension = Rhino.Geometry.LinearDimension(plane, ext1, ext2, linePt)
# ---------- end ghpython_script_18 ----------
sine = Sine(Value=range)  # disabled
ghpython_script_19 = GhPythonScript(x=point_4, y=point_6, z=point_5)  # -> out, id; inputs x: Int32, y: Int32, z: Int32; disabled
# ---------- ghpython_script_19: Python ----------
import Rhino
import scriptcontext
import System.Guid
import random
import math


def AddLine():
    """
    gp = Rhino.Input.Custom.GetPoint()
    gp.SetCommandPrompt("Start of line")
    gp.Get()
    if gp.CommandResult()!=Rhino.Commands.Result.Success:
        return gp.CommandResult()
    pt_start = gp.Point()

    gp.SetCommandPrompt("End of line")
    gp.SetBasePoint(pt_start, False)
    gp.DrawLineFromPoint(pt_start, True)
    gp.Get()
    if gp.CommandResult() != Rhino.Commands.Result.Success:
        return gp.CommandResult()
    pt_end = gp.Point()
    v = pt_end - pt_start
    if v.IsTiny(Rhino.RhinoMath.ZeroTolerance):
        return Rhino.Commands.Result.Nothing
        """
    for i in range(12):
        
        pt_start = Rhino.Geometry.Point3d(x,y,z)
        pt_end = Rhino.Geometry.Point3d(x+12,y+12,z+12)
    
        id = Rhino.RhinoDoc.ActiveDoc.Objects.AddLine(pt_start, pt_end)
        if id!=System.Guid.Empty:
            Rhino.RhinoDoc.ActiveDoc.Views.Redraw()
            return Rhino.Commands.Result.Success
        return Rhino.Commands.Result.Failure

if __name__=="__main__":
    AddLine()

for i in range(12):
    pt_start = Rhino.Geometry.Point3d(x,y,z)
    pt_end = Rhino.Geometry.Point3d(x+12,y+12,z+12)
    id = Rhino.RhinoDoc.ActiveDoc.Objects.AddLine(pt_start, pt_end)
# ---------- end ghpython_script_19 ----------
line_sdl_2 = LineSDL(Start=construct_point_6, Direction=unit_x, Length=1)  # disabled
populate_3d = Populate3D(Region=center_box, Count=panel_7, Seed=number_slider_23)  # disabled
construct_plane_2 = ConstructPlane(Origin=construct_point_6, XAxis=Vector(1, 0, 0), YAxis=Vector(0, 1, 0))  # disabled

number_slider_37 = Slider(1, range=0..10)  # disabled
number_slider_38 = Slider(4.53, range=0..10)  # disabled
number_slider_39 = Slider(1, range=0..10)  # disabled
number_slider_40 = Slider(60, range=0..100)  # disabled
number_slider_41 = Slider(4, range=0..10)  # disabled

number_slider_42 = Slider(100, range=0..100)  # disabled
line_sdl_3 = LineSDL(Start=construct_point_7, Direction=unit_y_2, Length=1)  # disabled
construct_plane_3 = ConstructPlane(Origin=construct_point_7, XAxis=Vector(1, 0, 0), YAxis=Vector(0, 1, 0))  # disabled
rotate_3d = Rotate3D(Geometry=construct_plane, Angle=pi_3, Center=Point(0, 0, 0), Axis=line_sdl)  # -> Geometry, Transform; disabled
panel_8 = Panel(ghpython_script_19.id)  # disabled
panel_9 = Panel(ghpython_script_18.dimension)  # disabled
geometry = Geometry(ghpython_script_18.a)  # disabled
multiplication = Multiplication(A=cosine, B=number_slider_28)  # disabled
dispatch = Dispatch(List=flatten(populate_3d), DispatchPattern=[True, False])  # -> ListA, ListB; disabled
construct_point_8 = ConstructPoint(XCoordinate=number_slider_34, YCoordinate=number_slider_33, ZCoordinate=number_slider_35)  # disabled
construct_point_9 = ConstructPoint(XCoordinate=number_slider_33, YCoordinate=number_slider_34, ZCoordinate=number_slider_35)  # disabled
construct_point_10 = ConstructPoint(XCoordinate=number_slider_33, YCoordinate=number_slider_35, ZCoordinate=number_slider_36)  # disabled
rotate_3d_2 = Rotate3D(Geometry=construct_plane_3, Angle=pi_2, Center=construct_point_7, Axis=line_sdl_3)  # -> Geometry, Transform; disabled
construct_point_11 = ConstructPoint(XCoordinate=0, YCoordinate=0, ZCoordinate=0)  # disabled
panel_10 = Panel(geometry)
rotate_3d_3 = Rotate3D(Geometry=construct_plane_2, Angle=pi, Center=construct_point_6, Axis=line_sdl_2)  # -> Geometry, Transform; disabled
ghpython_script_20 = GhPythonScript(plane=rotate_3d.Geometry, height=number_slider, radius=number_slider_2)  # -> out, AddCone, cone; inputs plane: Plane, height: Int32, radius: Int32; disabled
# ---------- ghpython_script_20: Python ----------
import Rhino
import scriptcontext

def AddCone():
    #plane = Rhino.Geometry.Plane.WorldXY
    #height = 10
    #radius = 5
    cone = Rhino.Geometry.Cone(plane, height, radius)
    if cone.IsValid:
        cap_bottom = True
        cone_brep = cone.ToBrep(cap_bottom)
        if cone_brep:
            Rhino.RhinoDoc.ActiveDoc.Objects.AddBrep(cone_brep)
            Rhino.RhinoDoc.ActiveDoc.Views.Redraw()
    return Rhino.Commands.Result.Success

if __name__=="__main__":
    AddCone()

cone = Rhino.Geometry.Cone(plane, height, radius)
# ---------- end ghpython_script_20 ----------
construct_point_12 = ConstructPoint(XCoordinate=multiplication, YCoordinate=sine, ZCoordinate=range)  # disabled
ghpython_script_21 = GhPythonScript(
    radius=number_slider_37,
    factor=number_slider_38,
    start=number_slider_39,
    stop=number_slider_40,
    step=number_slider_41,
    num=number_slider_42)  # -> out; inputs radius: Int32, start: Int32, stop: Int32, step: Int32, num: Int32; disabled
# ---------- ghpython_script_21: Python ----------
import Rhino
import scriptcontext
import System.Guid
import random
import math

pts = []
for i in range(start, stop, step):
    pt = Rhino.Geometry.Point3d(random.uniform(0,100), random.uniform(0,100),random.uniform(0,100))
    pts.append(pt)

boolean = []

for i in range(len(pts)):
    if pt.Z < num:
        boolean.append(pts[i])
    if pt.Z >= num:
        boolean.append(pts[i])

    def AddCylinder():
        center_point = Rhino.Geometry.Point3d(pt.Y - i, pt.X - i , pt.Z - i)
        height_point = Rhino.Geometry.Point3d(pt.X + i, pt.Y + i, pt.Z + i)
        zaxis = height_point-center_point
        plane = Rhino.Geometry.Plane(center_point, zaxis)
        radiusB = factor * radius * math.sin(factor * i)
        radiusC = factor * radius * math.cos(factor * i)
        circleB = Rhino.Geometry.Circle(plane, radiusB)
        circleC = Rhino.Geometry.Circle(plane, radiusC)
        cylinderB = Rhino.Geometry.Cylinder(circleB, zaxis.Length)
        cylinderC = Rhino.Geometry.Cylinder(circleC, zaxis.Length)
        brepB = cylinderB.ToBrep(True, True)
        brepC = cylinderC.ToBrep(True, True)
        if brepB:
            if Rhino.RhinoDoc.ActiveDoc.Objects.AddBrep(brepB)!=System.Guid.Empty:
                Rhino.RhinoDoc.ActiveDoc.Views.Redraw()
                return Rhino.Commands.Result.Success
        return Rhino.Commands.Result.Failure
        if brepC:
            if Rhino.RhinoDoc.ActiveDoc.Objects.AddBrep(brepC)!=System.Guid.Empty:
                Rhino.RhinoDoc.ActiveDoc.Views.Redraw()
                return Rhino.Commands.Result.Success
        return Rhino.Commands.Result.Failure
    
    if __name__=="__main__":
        AddCylinder()
# ---------- end ghpython_script_21 ----------
ghpython_script_22 = GhPythonScript()  # -> Out, A; disabled
ghpython_script_23 = GhPythonScript(pt=construct_plane_2, text=panel_6, height=number_slider_15, font=bold_ariel, plane=rotate_3d_3.Geometry)  # -> out, AddAnnotationText; inputs pt: Point3d, plane: Plane; disabled
# ---------- ghpython_script_23: Python ----------
import Rhino
import scriptcontext
import System.Guid

def AddAnnotationText():
    #pt = Rhino.Geometry.Point3d(10, 0, 0)
    #text = "Hello RhinoCommon"
    #height = 2.0
    #font = "Arial"
    #plane = Rhino.RhinoDoc.ActiveDoc.Views.ActiveView.ActiveViewport.ConstructionPlane()
    plane.Origin = pt
    id = Rhino.RhinoDoc.ActiveDoc.Objects.AddText(text, plane, height, font, False, False)
    if id!=System.Guid.Empty:
        Rhino.RhinoDoc.ActiveDoc.Views.Redraw()
        return Rhino.Commands.Result.Success
    return Rhino.Commands.Result.Failure


if __name__=="__main__":
    AddAnnotationText()

id = id
# ---------- end ghpython_script_23 ----------
ghpython_script_24 = GhPythonScript(center_point=construct_point_11, height_point=construct_point_7, plane=rotate_3d_2.Geometry, radius=number_slider_19)  # -> out, AddCylinder, brep; inputs center_point: Point3d, height_point: Point3d, plane: Plane, radius: Int32; disabled
# ---------- ghpython_script_24: Python ----------
import Rhino
import scriptcontext
import System.Guid

#center_point = Rhino.Geometry.Point3d(0, 0, 0)
#height_point = Rhino.Geometry.Point3d(0, 0, 10)
zaxis = height_point-center_point
#plane = Rhino.Geometry.Plane(center_point, zaxis)
#radius = 5
circle = Rhino.Geometry.Circle(plane, radius)
cylinder = Rhino.Geometry.Cylinder(circle, zaxis.Length)
brep = cylinder.ToBrep(True, True)

def AddCylinder():
    #center_point = Rhino.Geometry.Point3d(0, 0, 0)
    #height_point = Rhino.Geometry.Point3d(0, 0, 10)
    zaxis = height_point-center_point
    #plane = Rhino.Geometry.Plane(center_point, zaxis)
    #radius = 5
    circle = Rhino.Geometry.Circle(plane, radius)
    cylinder = Rhino.Geometry.Cylinder(circle, zaxis.Length)
    brep = cylinder.ToBrep(True, True)
    if brep:
        if Rhino.RhinoDoc.ActiveDoc.Objects.AddBrep(brep)!=System.Guid.Empty:
            Rhino.RhinoDoc.ActiveDoc.Views.Redraw()
            return Rhino.Commands.Result.Success
    return Rhino.Commands.Result.Failure

if __name__=="__main__":
    AddCylinder()
# ---------- end ghpython_script_24 ----------
ghpython_script_25 = GhPythonScript(w=number_slider_11, h=number_slider_11)  # -> out, AddBackgroundBitmap; inputs w: Int32, h: Int32; disabled
# ---------- ghpython_script_25: Python ----------
import Rhino
import scriptcontext
import System.Windows.Forms.DialogResult
import System.Drawing.Image

def AddBackgroundBitmap():
    # Allow the user to select a bitmap file
    fd = Rhino.UI.OpenFileDialog()
    fd.Filter = "Image Files (*.bmp;*.png;*.jpg)|*.bmp;*.png;*.jpg"
    if not fd.ShowDialog():
        return Rhino.Commands.Result.Cancel

    # Verify the file that was selected
    image = None
    try:
        image = System.Drawing.Image.FromFile(fd.FileName)
    except:
        return Rhino.Commands.Result.Failure

    # Allow the user to pick the bitmap origin
    gp = Rhino.Input.Custom.GetPoint()
    gp.SetCommandPrompt("Bitmap Origin")
    gp.ConstrainToConstructionPlane(True)
    gp.Get()
    if gp.CommandResult()!=Rhino.Commands.Result.Success:
        return gp.CommandResult()

    # Get the view that the point was picked in.
    # This will be the view that the bitmap appears in.
    view = gp.View()
    if view is None:
        view = scriptcontext.doc.Views.ActiveView
        if view is None: return Rhino.Commands.Result.Failure

    # Allow the user to specify the bitmap with in model units
    #gn = Rhino.Input.Custom.GetNumber()
    #gn.SetCommandPrompt("Bitmap width")
    #gn.SetLowerLimit(1.0, False)
    #gn.Get()
    #if gn.CommandResult()!=Rhino.Commands.Result.Success:
    #    return gn.CommandResult()

    # Cook up some scale factors
    #w = gn.Number()
    #h = w * (image.Width / image.Height)

    plane = view.ActiveViewport.ConstructionPlane()
    plane.Origin = gp.Point()
    view.ActiveViewport.SetTraceImage(fd.FileName, plane, w, h, False, False)
    view.Redraw()
    return Rhino.Commands.Result.Success

if __name__=="__main__":
    AddBackgroundBitmap()
# ---------- end ghpython_script_25 ----------
ghpython_script_26 = GhPythonScript(pt1=dispatch.ListA, pt2=dispatch.ListB)  # -> out, ObjectDecoration; inputs pt1: Point3d, pt2: Point3d; disabled
# ---------- ghpython_script_26: Python ----------
import Rhino
import scriptcontext

def ObjectDecoration():
    # Define a line
    line = Rhino.Geometry.Line(pt1, pt2)

    # Make a copy of Rhino's default object attributes
    attribs = Rhino.RhinoDoc.ActiveDoc.CreateDefaultAttributes()

    # Modify the object decoration style
    attribs.ObjectDecoration = Rhino.DocObjects.ObjectDecoration.BothArrowhead

    # Create a new curve object with our attributes
    Rhino.RhinoDoc.ActiveDoc.Objects.AddLine(line, attribs)
    Rhino.RhinoDoc.ActiveDoc.Views.Redraw()

if __name__ == "__main__":
    ObjectDecoration()
# ---------- end ghpython_script_26 ----------
panel_11 = Panel(ghpython_script_20.AddCone)  # disabled
sphere = Sphere(Base=construct_point, Radius=number_slider)  # disabled
ghpython_script_27 = GhPythonScript(center=construct_point_12, radius=number_slider_27)  # -> out, AddCircle, c; inputs center: Point3d, radius: Int32; disabled
# ---------- ghpython_script_27: Python ----------
import Rhino
import scriptcontext
import System.Guid

def AddCircle():
    #center = Rhino.Geometry.Point3d(0, 0, 0)
    #radius = 10.0
    c = Rhino.Geometry.Circle(center, radius)
    if Rhino.RhinoDoc.ActiveDoc.Objects.AddCircle(c)!=System.Guid.Empty:
        Rhino.RhinoDoc.ActiveDoc.Views.Redraw()
        return Rhino.Commands.Result.Success
    return Rhino.Commands.Result.Failure

if __name__=="__main__":
    AddCircle()
    
c = Rhino.Geometry.Circle(center, radius)
# ---------- end ghpython_script_27 ----------
geometry_2 = Geometry(ghpython_script_20.cone)  # disabled
ghpython_script_28 = GhPythonScript(x=construct_point_8, y=construct_point_9, z=construct_point_10)  # -> out, AddCircle, id; inputs x: Point3d, y: Point3d, z: Point3d; disabled
# ---------- ghpython_script_28: Python ----------
import Rhino
import scriptcontext
import System.Guid

def AddClippingPlane():
    # Define the corners of the clipping plane
    #rc, corners = Rhino.Input.RhinoGet.GetRectangle()
    #if rc!=Rhino.Commands.Result.Success: return rc

    # Get the active view
    view = Rhino.RhinoDoc.ActiveDoc.Views.ActiveView
    if view is None: return Rhino.Commands.Result.Failure

    #p0, p1, p2, p3 = corners
    # Create a plane from the corner points
    #plane = Rhino.Geometry.Plane(p0, p1, p3)
    plane = Rhino.Geometry.Plane(x, y, z)

    # Add a clipping plane object to the document
    id = Rhino.RhinoDoc.ActiveDoc.Objects.AddClippingPlane(plane, x.DistanceTo(y), y.DistanceTo(z), view.ActiveViewportID)
    if id!=System.Guid.Empty:
        Rhino.RhinoDoc.ActiveDoc.Views.Redraw()
        return Rhino.Commands.Result.Success
    return Rhino.Commands.Result.Failure

if __name__=="__main__":
    AddClippingPlane()
    
view = Rhino.RhinoDoc.ActiveDoc.Views.ActiveView
plane = Rhino.Geometry.Plane(x, y, z)
id = Rhino.RhinoDoc.ActiveDoc.Objects.AddClippingPlane(plane, x.DistanceTo(y), y.DistanceTo(z), view.ActiveViewportID)
# ---------- end ghpython_script_28 ----------
panel_12 = Panel(ghpython_script_27.AddCircle)  # disabled
panel_13 = Panel(ghpython_script_27.c)  # disabled
panel_14 = Panel(ghpython_script_23.AddAnnotationText)  # disabled
panel_15 = Panel(ghpython_script_24.AddCylinder)  # disabled
panel_16 = Panel(ghpython_script_17.AddBrepBox)  # disabled
panel_17 = Panel(ghpython_script_26.ObjectDecoration)  # disabled
panel_18 = Panel(ghpython_script_25.AddBackgroundBitmap)  # disabled
panel_19 = Panel(ghpython_script_28.AddCircle)  # disabled
plane = Plane(ghpython_script_28.id)  # disabled
loft = Loft(
    Curves=ghpython_script_27.c,
    Options={Adjust=False, Closed=False, LoftEnds=0, LoftSimp=0, LoftType=0, Rebuild=10, Refit=0.01})  # disabled

panel_20 = Panel(ghpython_script_24.brep)  # disabled
brep = Brep(ghpython_script_24.brep)  # disabled
