# Grasshopper definition 0.1_Rhino_Grasshopper_Python_WickersonStudios_Geometry_010_RhinoCourse.gh (Grasshopper 1.0.7)
# plug-ins: Bifocals

number_slider = Slider(7, range=0..10)  # disabled
number_slider_2 = Slider(27, range=0..100)  # disabled
number_slider_3 = Slider(22, range=0..100)  # disabled
number_slider_4 = Slider(17, range=0..100)  # disabled
curve = Curve(<curve referenced from the Rhino model>)  # disabled
number_slider_5 = Slider(3, range=0..10)  # disabled
number_slider_6 = Slider(71, range=0..100)  # disabled
number_slider_7 = Slider(20, range=0..20)  # disabled
number_slider_8 = Slider(4, range=0..10)  # disabled
number_slider_9 = Slider(4, range=0..10)  # disabled
number_slider_10 = Slider(6, range=0..10)  # disabled
number_slider_11 = Slider(8, range=0..10)  # disabled
number_slider_12 = Slider(1, range=0..10)  # disabled
number_slider_13 = Slider(1, range=0..3)  # disabled
number_slider_14 = Slider(10, range=0..10)  # disabled
number_slider_15 = Slider(8, range=0..10)  # disabled
number_slider_16 = Slider(4, range=0..10)  # disabled
number_slider_17 = Slider(3, range=0..13)  # disabled
# Point
number_slider_18 = Slider(3.84, range=0..10)  # disabled
number_slider_19 = Slider(2, range=0..10)  # disabled
number_slider_20 = Slider(2, range=1..5)  # disabled
number_slider_21 = Slider(16.114, range=0..100)  # disabled

xy_plane = XYPlane(Origin=Point(0, 0, 0))  # disabled
curve_2 = Curve(<curve referenced from the Rhino model>)  # disabled
# Points in Closed Curve
ghpython_script = GhPythonScript(curve=curve_2, plane=xy_plane)  # -> out, pts, a, b, pt_in_or_not, boolean; inputs curve: Curve, plane: Plane; disabled
# ---------- ghpython_script: Python ----------
import Rhino
import rhinoscriptsyntax as rs
import random

pts = []
for i in range(12):
    pt = Rhino.Geometry.Point3d(random.uniform(0,10), random.uniform(0,10), 0)
    pts.append(pt)
    
boolean = []
ptIn = []
ptOut = []


for i in range(len(pts)):
    pt_in_or_not = rs.PointInPlanarClosedCurve(pts[i], curve)
    boolean.append(pt_in_or_not)
    
    if boolean[i] == True:
        ptIn.append(pts[i])
    if boolean[i] == False:
        ptOut.append(pts[i])
        
a = ptIn
b = ptOut
# ---------- end ghpython_script ----------
point = Point(ghpython_script.a)  # disabled
point_2 = Point(ghpython_script.b)  # disabled
point_3 = Point(ghpython_script.pts)  # disabled
panel = Panel(ghpython_script.boolean)  # disabled
panel_2 = Panel(ghpython_script.pt_in_or_not)  # disabled

xy_plane_2 = XYPlane(Origin=Point(0, 0, 0))  # disabled
curve_3 = Curve(curve)  # disabled
# Points in Closed Curve
ghpython_script_2 = GhPythonScript(curve=curve_3, plane=xy_plane_2)  # -> out, pts, ptIn_Out, ptOut_Out, pt_in_or_not, boolean; inputs curve: Curve, plane: Plane; disabled
# ---------- ghpython_script_2: Python ----------
import Rhino
import random

pts = []
for i in range(120):
    pt = Rhino.Geometry.Point3d(random.uniform(0,10), random.uniform(0,10), 0)
    pts.append(pt)
    
boolean = []
ptIn = []
ptOut = []


for i in range(len(pts)):
    pt_in_or_not = Rhino.Geometry.Curve.Contains(curve, pts[i], plane, 0.001)
    boolean.append(pt_in_or_not)
    
    if boolean[i] == Rhino.Geometry.PointContainment.Inside:
        ptIn.append(pts[i])
    if boolean[i] == Rhino.Geometry.PointContainment.Outside:
        ptOut.append(pts[i])
    
    ptIn_Out = ptIn
    ptOut_Out = ptOut
# ---------- end ghpython_script_2 ----------
point_4 = Point(ghpython_script_2.pts)  # disabled
point_5 = Point(ghpython_script_2.ptOut_Out)  # disabled
point_6 = Point(ghpython_script_2.ptIn_Out)  # disabled
panel_3 = Panel(ghpython_script_2.boolean)  # disabled
panel_4 = Panel(ghpython_script_2.pt_in_or_not)  # disabled

populate_3d = Populate3D(Region={Plane=PlaneXY(0, 0, 0), X=Domain(0, 10), Y=Domain(0, 10), Z=Domain(0, 2)}, Count=number_slider, Seed=1)  # disabled
point_7 = Point(Point(-98.97135323, 120.8404155, -17.68475344))  # disabled
point_8 = Point(Point(-19.24491, -60.15829396, 0))  # disabled
# Random Library
ghpython_script_3 = GhPythonScript(seed=number_slider_5, n=number_slider_6)  # -> out, a; inputs seed: Int32, n: Int32; disabled
# ---------- ghpython_script_3: Python ----------
import Rhino
import random

pts = []

for i in range(n):
    pt = Rhino.Geometry.Point3d(random.uniform(0,10), random.uniform(0,10), 0)
    pts.append(pt)

a = pts
# ---------- end ghpython_script_3 ----------
# Random Library
ghpython_script_4 = GhPythonScript(step=number_slider_7)  # -> out, pts_Out, a, b, c; inputs step: Int32; disabled
# ---------- ghpython_script_4: Python ----------
import Rhino

pts = []
R = []
G = []
B = []

for i in range(0,256,step):
    for j in range(0,256,step):
        for k in range(0,256,step):
            pt = Rhino.Geometry.Point3d(i,j,k)
            pts.append(pt)
            R.append(i)
            G.append(j)
            B.append(k)

pts_Out = pts
a = R
b = G
c = B
# ---------- end ghpython_script_4 ----------
# Base Script
# Point3d
ghpython_script_5 = GhPythonScript(x=number_slider_18, y=number_slider_18, z=number_slider_18)  # -> out, point; disabled
# ---------- ghpython_script_5: Python ----------
import Rhino

point = Rhino.Geometry.Point3d(x,y,z)
# ---------- end ghpython_script_5 ----------
# Random Library
ghpython_script_6 = GhPythonScript()  # -> out, a, b, c; inputs x: Int32, y: Int32; disabled
# ---------- ghpython_script_6: Python ----------
import Rhino
import random
import math

ran1 = random.random()
ran2 = random.randint(0,math.sqrt(100))
ran3 = random.uniform(0,100)

a = ran1
b = ran2
c = ran3
# ---------- end ghpython_script_6 ----------
# Curve by Random Points
ghpython_script_7 = GhPythonScript(n=number_slider_2, m=number_slider_4, p=number_slider_3)  # -> out, pts, crv_Out; inputs n: Int32, m: Int32, p: Int32; disabled
# ---------- ghpython_script_7: Python ----------
import Rhino
import random

pts = []

for i in range(0,30
:
    x = random.uniform(0,n)
    y = random.uniform(0,m)
    z = random.uniform(0,p)
    pt = Rhino.Geometry.Point3d(x,y,z)
    pts.append(pt)

curve = Rhino.Geometry.NurbsCurve.Create(False, 3, pts)
crv_Out = curve
# ---------- end ghpython_script_7 ----------
# Condition  Array of Points
ghpython_script_8 = GhPythonScript(num1=number_slider_9, num2=number_slider_8, step=number_slider_19)  # -> out, a, b, d, c; inputs num1: Int32, num2: Int32, step: Int32; disabled
# ---------- ghpython_script_8: Python ----------
import Rhino

pts1 = []
pts2 = []
pts3 = []

for i in range(0,50,step):
    for j in range(0,50,step):
        pt = Rhino.Geometry.Point3d(i, j, 0)
        if i % num1 == 0 and j % num2 == 0:
            pts1.append(pt)
        elif i % num1 == 0 or j % num2 == 0:
            pts2.append(pt)
        else:
            pts3.append(pt)

a = pts1
b = pts2
c = pts3
# ---------- end ghpython_script_8 ----------
# Line and curve
ghpython_script_9 = GhPythonScript(pt1=point_7, pt2=point_8)  # -> out, line_Out; inputs pt1: Point3d, pt2: Point3d; disabled
# ---------- ghpython_script_9: Python ----------
import Rhino

line = Rhino.Geometry.Line(pt1, pt2)

line_Out = line
# ---------- end ghpython_script_9 ----------
# 2D  Array of Points
ghpython_script_10 = GhPythonScript(n=number_slider_10, m=number_slider_11)  # -> out, a; inputs n: Int32, m: Int32; disabled
# ---------- ghpython_script_10: Python ----------
import Rhino

#point = Rhino.Geometry.Point3d(x,y,z)

pts = []

for i in range(n):
    for j in range(m):
        pt = Rhino.Geometry.Point3d(i, j, i * j)
        pts.append(pt)

a = pts
# ---------- end ghpython_script_10 ----------
# Math Library
ghpython_script_11 = GhPythonScript(n=number_slider_21)  # -> out, pts; disabled
# ---------- ghpython_script_11: Python ----------
import rhinoscriptsyntax as rs
import Rhino.Geometry as rg
import math

pts = []

for i in rs.frange(0.1,n,0.2):
    x = i * math.sin(i)
    y = i * math.cos(i)
    z = i
    
    pt = rg.Point3d(x,y,z)
    pts.append(pt)

pts_Out = pts
# ---------- end ghpython_script_11 ----------
# Array of Points
ghpython_script_12 = GhPythonScript(x=number_slider_12, y=number_slider_15, z=number_slider_13)  # -> out, a; inputs x: Int32, y: Int32, z: Int32; disabled
# ---------- ghpython_script_12: Python ----------
import Rhino

#point = Rhino.Geometry.Point3d(x,y,z)

pts = []

for i in range(x,y,z):
    pt = Rhino.Geometry.Point3d(i, i*i, i*2)
    pts.append(pt)

a = pts
# ---------- end ghpython_script_12 ----------
# Condition_001  Array of Points
ghpython_script_13 = GhPythonScript(x=number_slider_14, y=number_slider_16, z=number_slider_17)  # -> out, a; inputs x: Int32, y: Int32, z: Int32; disabled
# ---------- ghpython_script_13: Python ----------
import Rhino

pts = []

for i in range(x):
    if i < y:
        pt = Rhino.Geometry.Point3d(i, 0, 0)
        pts.append(pt)
    else:
        pt = Rhino.Geometry.Point3d(i, 0, z)
        pts.append(pt)

a = pts
# ---------- end ghpython_script_13 ----------
# Line and curve
ghpython_script_14 = GhPythonScript(pts=populate_3d, degree=number_slider_20)  # -> out, crvA; inputs pts: list of Point3d, degree: Int32; disabled
# ---------- ghpython_script_14: Python ----------
import Rhino

crvA = Rhino.Geometry.NurbsCurve.Create(True, degree, pts)
# ---------- end ghpython_script_14 ----------
point_9 = Point(ghpython_script_5.point)  # disabled
point_10 = Point(ghpython_script_3.a)  # disabled
panel_5 = Panel([ghpython_script_6.a, ghpython_script_6.b, ghpython_script_6.c])  # disabled
point_11 = Point(ghpython_script_11.pts)  # disabled
curve_4 = Curve(ghpython_script_7.crv_Out)  # disabled
point_12 = Point(ghpython_script_7.pts)  # disabled
point_13 = Point(ghpython_script_8.c)  # disabled
point_14 = Point(ghpython_script_8.b)  # disabled
point_15 = Point(ghpython_script_12.a)  # disabled
point_16 = Point(ghpython_script_13.a)  # disabled
point_17 = Point(ghpython_script_10.a)  # disabled
point_18 = Point(ghpython_script_8.a)  # disabled
line = Line(ghpython_script_9.line_Out)  # disabled
colour_rgb = ColourRGB(Alpha=ghpython_script_4.a, Red=ghpython_script_4.b, Green=ghpython_script_4.c, Blue=0)  # disabled
curve_5 = Curve(ghpython_script_14.crvA)  # disabled
panel_6 = Panel(ghpython_script_5.point)  # disabled
custom_preview = CustomPreview(Geometry=ghpython_script_4.pts_Out, Material=colour_rgb)  # disabled
number_slider_22 = Slider(8.81, range=0..10)
# GhPython Course at
# Wickerson Studios
# Vector
# Base Script
number_slider_23 = Slider(2.94, range=0..10)  # disabled
# Vector Unitize
ghpython_script_15 = GhPythonScript(
    x=number_slider_22,
    y=number_slider_22,
    z=number_slider_22,
    multi=Slider(4.01, range=0..10),
    radians=Slider(4.12, range=0..12))  # -> out, a, vector, b, c, d, e
# ---------- ghpython_script_15: Python ----------
import Rhino

vector = Rhino.Geometry.Vector3d(x,y,z)
vectorUnitize = Rhino.Geometry.Vector3d.Unitize(vector)
vectorScale = Rhino.Geometry.Vector3d.Multiply(vector, multi)
vectorReverse = Rhino.Geometry.Vector3d.Reverse(vector)

rotationAxis = Rhino.Geometry.Vector3d(0,1,0)
vectorRotate = Rhino.Geometry.Vector3d.Rotate(vector, radians, rotationAxis)

a = vectorUnitize
b = vectorScale
c = vectorReverse
d = vectorRotate
# ---------- end ghpython_script_15 ----------
# Vector Length
ghpython_script_16 = GhPythonScript(x=number_slider_23, y=number_slider_23, z=number_slider_23)  # -> out, a, vector; disabled
# ---------- ghpython_script_16: Python ----------
import Rhino

vector = Rhino.Geometry.Vector3d(x,y,z)

vecLength_out = Rhino.Geometry.Vector3d.Length.GetValue(vector)

a = vecLength_out
# ---------- end ghpython_script_16 ----------
construct_point = ConstructPoint(XCoordinate=0, YCoordinate=0, ZCoordinate=0)  # disabled
panel_7 = Panel(ghpython_script_16.a)  # disabled
panel_8 = Panel(ghpython_script_15.d)
panel_9 = Panel(ghpython_script_15.a)
panel_10 = Panel(ghpython_script_15.b)
panel_11 = Panel(ghpython_script_15.c)
vector = Vector(ghpython_script_16.vector)  # disabled
vector_display = VectorDisplay(Anchor=construct_point, Vector=vector)  # disabled
construct_point_2 = ConstructPoint(XCoordinate=0, YCoordinate=0, ZCoordinate=0)
vector_2 = Vector(ghpython_script_15.vector)
vector_display_2 = VectorDisplay(Anchor=construct_point_2, Vector=vector_2)
