# Grasshopper definition 0.1_Rhino_Grasshopper_Python_WickersonStudios_Geometry_Inspect_003.gh (Grasshopper 1.0.7)
# Copyright: bernhard muller bijoutiers

# Get Import Statement
python = GhPythonScript()  # -> importStatements
# ---------- python: Python ----------
import rhinoscriptsyntax as rs
import inspect

importStatements = []
srcFile = inspect.getsourcefile(rs.SplitBrep)
srcOpen = open(srcFile)
for l in srcOpen:
    if "import" in l:
        l = l.strip()
        if l not in importStatements:
            importStatements.append(l)
# ---------- end python ----------
# Inspect rhinoscriptsyntax
ghpython_script = GhPythonScript()  # -> out, a
# ---------- ghpython_script: Python ----------
import rhinoscriptsyntax as rs
import inspect
print inspect.getsource(rs.SplitBrep)
# ---------- end ghpython_script ----------
panel = Panel(python)
# Output
panel_2 = Panel(ghpython_script.out)
