# Grasshopper definition 0.1_Rhino_Grasshopper_Python_WickersonStudios_Geometry_Surface_Revit2021_007.gh (Grasshopper 1.0.7)
# plug-ins: Bifocals, Rhino.Inside for Autodesk Revit

number_slider = Slider(7, range=0..10)  # disabled
number_slider_2 = Slider(27, range=0..100)  # disabled
number_slider_3 = Slider(22, range=0..100)  # disabled
number_slider_4 = Slider(17, range=0..100)  # disabled
curve = Curve(<curve referenced from the Rhino model>)  # disabled
number_slider_5 = Slider(3, range=0..10)  # disabled
number_slider_6 = Slider(71, range=0..100)  # disabled
number_slider_7 = Slider(20, range=0..20)  # disabled
number_slider_8 = Slider(4, range=0..10)  # disabled
ghpython_script = GhPythonScript()  # -> out, a; disabled
# ---------- ghpython_script: Python ----------
import rhinoscriptsyntax as rs
import inspect
print inspect.getsource(rs.SplitBrep)
# ---------- end ghpython_script ----------
number_slider_9 = Slider(4, range=0..10)  # disabled
number_slider_10 = Slider(6, range=0..10)  # disabled
number_slider_11 = Slider(8, range=0..10)  # disabled
number_slider_12 = Slider(1, range=0..10)  # disabled
number_slider_13 = Slider(1, range=0..3)  # disabled
number_slider_14 = Slider(10, range=0..10)  # disabled
number_slider_15 = Slider(8, range=0..10)  # disabled
number_slider_16 = Slider(4, range=0..10)  # disabled
number_slider_17 = Slider(3, range=0..13)  # disabled
# Point
number_slider_18 = Slider(3.84, range=0..10)  # disabled
number_slider_19 = Slider(2, range=0..10)  # disabled
number_slider_20 = Slider(2, range=1..5)  # disabled
number_slider_21 = Slider(16.114, range=0..100)  # disabled

xy_plane = XYPlane(Origin=Point(0, 0, 0))  # disabled
curve_2 = Curve(<curve referenced from the Rhino model>)  # disabled
# Points in Closed Curve
ghpython_script_2 = GhPythonScript(curve=curve_2, plane=xy_plane)  # -> out, pts, a, b, pt_in_or_not, boolean; inputs curve: Curve, plane: Plane; disabled
# ---------- ghpython_script_2: Python ----------
import Rhino
import rhinoscriptsyntax as rs
import random

pts = []
for i in range(12):
    pt = Rhino.Geometry.Point3d(random.uniform(0,10), random.uniform(0,10), 0)
    pts.append(pt)
    
boolean = []
ptIn = []
ptOut = []


for i in range(len(pts)):
    pt_in_or_not = rs.PointInPlanarClosedCurve(pts[i], curve)
    boolean.append(pt_in_or_not)
    
    if boolean[i] == True:
        ptIn.append(pts[i])
    if boolean[i] == False:
        ptOut.append(pts[i])
        
a = ptIn
b = ptOut
# ---------- end ghpython_script_2 ----------
point = Point(ghpython_script_2.a)  # disabled
point_2 = Point(ghpython_script_2.b)  # disabled
point_3 = Point(ghpython_script_2.pts)  # disabled
panel = Panel(ghpython_script_2.boolean)  # disabled
panel_2 = Panel(ghpython_script_2.pt_in_or_not)  # disabled

xy_plane_2 = XYPlane(Origin=Point(0, 0, 0))  # disabled
curve_3 = Curve(curve)  # disabled
# Points in Closed Curve
ghpython_script_3 = GhPythonScript(curve=curve_3, plane=xy_plane_2)  # -> out, pts, ptIn_Out, ptOut_Out, pt_in_or_not, boolean; inputs curve: Curve, plane: Plane; disabled
# ---------- ghpython_script_3: Python ----------
import Rhino
import random

pts = []
for i in range(120):
    pt = Rhino.Geometry.Point3d(random.uniform(0,10), random.uniform(0,10), 0)
    pts.append(pt)
    
boolean = []
ptIn = []
ptOut = []


for i in range(len(pts)):
    pt_in_or_not = Rhino.Geometry.Curve.Contains(curve, pts[i], plane, 0.001)
    boolean.append(pt_in_or_not)
    
    if boolean[i] == Rhino.Geometry.PointContainment.Inside:
        ptIn.append(pts[i])
    if boolean[i] == Rhino.Geometry.PointContainment.Outside:
        ptOut.append(pts[i])
    
    ptIn_Out = ptIn
    ptOut_Out = ptOut
# ---------- end ghpython_script_3 ----------
point_4 = Point(ghpython_script_3.pts)  # disabled
point_5 = Point(ghpython_script_3.ptOut_Out)  # disabled
point_6 = Point(ghpython_script_3.ptIn_Out)  # disabled
panel_3 = Panel(ghpython_script_3.boolean)  # disabled
panel_4 = Panel(ghpython_script_3.pt_in_or_not)  # disabled

# ----
# AddAnnotation
# Rhino Common Namespaces
# Rhino
# AddAnnotation
ghpython_script_4 = GhPythonScript()  # -> out, a; disabled
# ---------- ghpython_script_4: Python ----------
import Rhino
#import scriptcontext
import Rhino.RhinoDoc
import System.Guid

def AddAnnotationText():
    pt = Rhino.Geometry.Point3d(10, 0, 0)
    text = "Hello RhinoCommon"
    height = 2.0
    font = "Arial"
    plane = Rhino.RhinoDoc.ActiveDoc.Views.ActiveView.ActiveViewport.ConstructionPlane()
    plane.Origin = pt
    id = Rhino.RhinoDoc.ActiveDoc.Objects.AddText(text, plane, height, font, False, False)
    if id!=System.Guid.Empty:
        Rhino.RhinoDoc.ActiveDoc.Views.Redraw()
        return Rhino.Commands.Result.Success
    return Rhino.Commands.Result.Failure


if __name__=="__main__":
    AddAnnotationText()
# ---------- end ghpython_script_4 ----------
ghpython_script_5 = GhPythonScript()  # -> out, a; disabled; same code as ghpython_script_4

populate_3d = Populate3D(Region={Plane=PlaneXY(0, 0, 0), X=Domain(0, 10), Y=Domain(0, 10), Z=Domain(0, 2)}, Count=number_slider, Seed=1)  # disabled
# Inspect rhinoscriptsyntax
panel_5 = Panel(ghpython_script.out)  # disabled
point_7 = Point(Point(-98.97135323, 120.8404155, -17.68475344))  # disabled
point_8 = Point(Point(-19.24491, -60.15829396, 0))  # disabled
# Random Library
ghpython_script_6 = GhPythonScript(seed=number_slider_5, n=number_slider_6)  # -> out, a; inputs seed: Int32, n: Int32; disabled
# ---------- ghpython_script_6: Python ----------
import Rhino
import random

pts = []

for i in range(n):
    pt = Rhino.Geometry.Point3d(random.uniform(0,10), random.uniform(0,10), 0)
    pts.append(pt)

a = pts
# ---------- end ghpython_script_6 ----------
# Random Library
ghpython_script_7 = GhPythonScript(step=number_slider_7)  # -> out, pts_Out, a, b, c; inputs step: Int32; disabled
# ---------- ghpython_script_7: Python ----------
import Rhino

pts = []
R = []
G = []
B = []

for i in range(0,256,step):
    for j in range(0,256,step):
        for k in range(0,256,step):
            pt = Rhino.Geometry.Point3d(i,j,k)
            pts.append(pt)
            R.append(i)
            G.append(j)
            B.append(k)

pts_Out = pts
a = R
b = G
c = B
# ---------- end ghpython_script_7 ----------
# Base Script
# Point3d
ghpython_script_8 = GhPythonScript(x=number_slider_18, y=number_slider_18, z=number_slider_18)  # -> out, point; disabled
# ---------- ghpython_script_8: Python ----------
import Rhino

point = Rhino.Geometry.Point3d(x,y,z)
# ---------- end ghpython_script_8 ----------
# Random Library
ghpython_script_9 = GhPythonScript()  # -> out, a, b, c; inputs x: Int32, y: Int32; disabled
# ---------- ghpython_script_9: Python ----------
import Rhino
import random
import math

ran1 = random.random()
ran2 = random.randint(0,math.sqrt(100))
ran3 = random.uniform(0,100)

a = ran1
b = ran2
c = ran3
# ---------- end ghpython_script_9 ----------
# Curve by Random Points
ghpython_script_10 = GhPythonScript(n=number_slider_2, m=number_slider_4, p=number_slider_3)  # -> out, pts, crv_Out; inputs n: Int32, m: Int32, p: Int32; disabled
# ---------- ghpython_script_10: Python ----------
import Rhino
import random

pts = []

for i in range(0,30
:
    x = random.uniform(0,n)
    y = random.uniform(0,m)
    z = random.uniform(0,p)
    pt = Rhino.Geometry.Point3d(x,y,z)
    pts.append(pt)

curve = Rhino.Geometry.NurbsCurve.Create(False, 3, pts)
crv_Out = curve
# ---------- end ghpython_script_10 ----------
# Condition  Array of Points
ghpython_script_11 = GhPythonScript(num1=number_slider_9, num2=number_slider_8, step=number_slider_19)  # -> out, a, b, d, c; inputs num1: Int32, num2: Int32, step: Int32; disabled
# ---------- ghpython_script_11: Python ----------
import Rhino

pts1 = []
pts2 = []
pts3 = []

for i in range(0,50,step):
    for j in range(0,50,step):
        pt = Rhino.Geometry.Point3d(i, j, 0)
        if i % num1 == 0 and j % num2 == 0:
            pts1.append(pt)
        elif i % num1 == 0 or j % num2 == 0:
            pts2.append(pt)
        else:
            pts3.append(pt)

a = pts1
b = pts2
c = pts3
# ---------- end ghpython_script_11 ----------
# Line and curve
ghpython_script_12 = GhPythonScript(pt1=point_7, pt2=point_8)  # -> out, line_Out; inputs pt1: Point3d, pt2: Point3d; disabled
# ---------- ghpython_script_12: Python ----------
import Rhino

line = Rhino.Geometry.Line(pt1, pt2)

line_Out = line
# ---------- end ghpython_script_12 ----------
# 2D  Array of Points
ghpython_script_13 = GhPythonScript(n=number_slider_10, m=number_slider_11)  # -> out, a; inputs n: Int32, m: Int32; disabled
# ---------- ghpython_script_13: Python ----------
import Rhino

#point = Rhino.Geometry.Point3d(x,y,z)

pts = []

for i in range(n):
    for j in range(m):
        pt = Rhino.Geometry.Point3d(i, j, i * j)
        pts.append(pt)

a = pts
# ---------- end ghpython_script_13 ----------
# Math Library
ghpython_script_14 = GhPythonScript(n=number_slider_21)  # -> out, pts; disabled
# ---------- ghpython_script_14: Python ----------
import rhinoscriptsyntax as rs
import Rhino.Geometry as rg
import math

pts = []

for i in rs.frange(0.1,n,0.2):
    x = i * math.sin(i)
    y = i * math.cos(i)
    z = i
    
    pt = rg.Point3d(x,y,z)
    pts.append(pt)

pts_Out = pts
# ---------- end ghpython_script_14 ----------
# Array of Points
ghpython_script_15 = GhPythonScript(x=number_slider_12, y=number_slider_15, z=number_slider_13)  # -> out, a; inputs x: Int32, y: Int32, z: Int32; disabled
# ---------- ghpython_script_15: Python ----------
import Rhino

#point = Rhino.Geometry.Point3d(x,y,z)

pts = []

for i in range(x,y,z):
    pt = Rhino.Geometry.Point3d(i, i*i, i*2)
    pts.append(pt)

a = pts
# ---------- end ghpython_script_15 ----------
# Condition_001  Array of Points
ghpython_script_16 = GhPythonScript(x=number_slider_14, y=number_slider_16, z=number_slider_17)  # -> out, a; inputs x: Int32, y: Int32, z: Int32; disabled
# ---------- ghpython_script_16: Python ----------
import Rhino

pts = []

for i in range(x):
    if i < y:
        pt = Rhino.Geometry.Point3d(i, 0, 0)
        pts.append(pt)
    else:
        pt = Rhino.Geometry.Point3d(i, 0, z)
        pts.append(pt)

a = pts
# ---------- end ghpython_script_16 ----------
# Line and curve
ghpython_script_17 = GhPythonScript(pts=populate_3d, degree=number_slider_20)  # -> out, crvA; inputs pts: list of Point3d, degree: Int32; disabled
# ---------- ghpython_script_17: Python ----------
import Rhino

crvA = Rhino.Geometry.NurbsCurve.Create(True, degree, pts)
# ---------- end ghpython_script_17 ----------
point_9 = Point(ghpython_script_8.point)  # disabled
point_10 = Point(ghpython_script_6.a)  # disabled
panel_6 = Panel([ghpython_script_9.a, ghpython_script_9.b, ghpython_script_9.c])  # disabled
point_11 = Point(ghpython_script_14.pts)  # disabled
curve_4 = Curve(ghpython_script_10.crv_Out)  # disabled
point_12 = Point(ghpython_script_10.pts)  # disabled
point_13 = Point(ghpython_script_11.c)  # disabled
point_14 = Point(ghpython_script_11.b)  # disabled
point_15 = Point(ghpython_script_15.a)  # disabled
point_16 = Point(ghpython_script_16.a)  # disabled
point_17 = Point(ghpython_script_13.a)  # disabled
point_18 = Point(ghpython_script_11.a)  # disabled
line = Line(ghpython_script_12.line_Out)  # disabled
colour_rgb = ColourRGB(Alpha=ghpython_script_7.a, Red=ghpython_script_7.b, Green=ghpython_script_7.c, Blue=0)  # disabled
curve_5 = Curve(ghpython_script_17.crvA)  # disabled
panel_7 = Panel(ghpython_script_8.point)  # disabled
custom_preview = CustomPreview(Geometry=ghpython_script_7.pts_Out, Material=colour_rgb)  # disabled
number_slider_22 = Slider(6.31, range=0..10)  # disabled
c_script = CSharpScript()  # -> Out, A; disabled
ghpython_script_18 = GhPythonScript()  # -> Out, A; disabled
number_slider_23 = Slider(1.77, range=0..10)  # disabled
number_slider_24 = Slider(0, range=0..10)  # disabled
# Vector
# Base Script
number_slider_25 = Slider(4.31, range=0..10)  # disabled
number_slider_26 = Slider(5.21, range=0..10)  # disabled
# Vector Function: Add/Subtract/CrossProduct/Angle
number_slider_27 = Slider(2.88, range=0..12)  # disabled
number_slider_28 = Slider(8.81, range=0..10)  # disabled
# Moving Object By Vector
number_slider_29 = Slider(10.01, range=-10..10.01)  # disabled
number_slider_30 = Slider(-10, range=-10..10.01)  # disabled
number_slider_31 = Slider(10, range=0..10)  # disabled
# Moving Object By Vector
number_slider_32 = Slider(0, range=0..10)  # disabled
number_slider_33 = Slider(30, range=0..30)  # disabled
number_slider_34 = Slider(10, range=0..10)  # disabled
number_slider_35 = Slider(10, range=0..10)  # disabled
number_slider_36 = Slider(0, range=0..10)  # disabled
number_slider_37 = Slider(10, range=0..10)  # disabled
number_slider_38 = Slider(0, range=0..10)  # disabled
# Moving Object By Vector
number_slider_39 = Slider(0.94, range=0..10)  # disabled
number_slider_40 = Slider(1.6, range=0..10)  # disabled
number_slider_41 = Slider(3.39, range=0..10)  # disabled
number_slider_42 = Slider(3, range=1..5)  # disabled
number_slider_43 = Slider(2, range=1..5)  # disabled
# Vector Unitize/Scale/Reverse/Rotate
ghpython_script_19 = GhPythonScript(x=number_slider_28, y=number_slider_28, z=number_slider_28, multi=number_slider_26, radians=number_slider_27)  # -> out, a, vector, b, c, d, e; disabled
# ---------- ghpython_script_19: Python ----------
import Rhino

vector = Rhino.Geometry.Vector3d(x,y,z)
vectorUnitize = Rhino.Geometry.Vector3d.Unitize(vector)
vectorScale = Rhino.Geometry.Vector3d.Multiply(vector, multi)
vectorReverse = Rhino.Geometry.Vector3d.Reverse(vector)

rotationAxis = Rhino.Geometry.Vector3d(0,1,0)
vectorRotate = Rhino.Geometry.Vector3d.Rotate(vector, radians, rotationAxis)

a = vectorUnitize
b = vectorScale
c = vectorReverse
d = vectorRotate
# ---------- end ghpython_script_19 ----------
plane = Plane(PlaneXY(0, 0, 0))  # disabled
# Vector Length
ghpython_script_20 = GhPythonScript(x=number_slider_25, y=number_slider_25, z=number_slider_25)  # -> out, a, vector, b; disabled
# ---------- ghpython_script_20: Python ----------
import Rhino

vector = Rhino.Geometry.Vector3d(x,y,z)
vector2 = Rhino.Geometry.Vector3d(2,4,6)

vecLength_out = Rhino.Geometry.Vector3d.Length.GetValue(vector)

a = vecLength_out
b = vector2
# ---------- end ghpython_script_20 ----------
ghpython_script_21 = GhPythonScript(x=number_slider_22, y=number_slider_24, z=number_slider_23)  # -> out, vectorA, vectorB, vecAdd, vecSubtract, vecCrossProd, vecAngle; disabled
# ---------- ghpython_script_21: Python ----------
import Rhino

vectorA = Rhino.Geometry.Vector3d(x,y,z)
vectorB = Rhino.Geometry.Vector3d(y+12,2*x+5,3*z+3)

vecAdd = Rhino.Geometry.Vector3d.Add(vectorA, vectorB)
vecSubtract = Rhino.Geometry.Vector3d.Subtract(vectorA, vectorB)
vecCrossProd = Rhino.Geometry.Vector3d.CrossProduct(vectorA, vectorB)

planeNormal = Rhino.Geometry.Plane(Rhino.Geometry.Point3d(x,y,z), vectorA, vectorB)
vecAngle = Rhino.Geometry.Vector3d.VectorAngle(vectorA, vectorB, planeNormal)
# ---------- end ghpython_script_21 ----------
ghpython_script_22 = GhPythonScript(x=number_slider_29, y=number_slider_29, z=number_slider_37, n=number_slider_33, degree=number_slider_42)  # -> out, pt, a, vec, nurbsCurve; inputs n: Int32, degree: Int32; disabled
# ---------- ghpython_script_22: Python ----------
import Rhino
import random

pts = []
pt = Rhino.Geometry.Point3d(0,0,0)
pts.append(pt)

for i in range(n):
    xDir = random.uniform(-x, x)
    yDir = random.uniform(-y, y)
    zDir = random.uniform(z, 10.0)
    vec = Rhino.Geometry.Vector3d(xDir, yDir, zDir)
    newPt = Rhino.Geometry.Point3d(vec*i)
    pts.append(newPt)

a = pts
nurbsCurve = Rhino.Geometry.NurbsCurve.Create(False, degree, pts)
# ---------- end ghpython_script_22 ----------
ghpython_script_23 = GhPythonScript(x=number_slider_39, y=number_slider_40, z=number_slider_41, n=number_slider_34, degree=number_slider_43)  # -> out, pt, a, vec, nurbsCurve; inputs n: Int32, degree: Int32; disabled
# ---------- ghpython_script_23: Python ----------
import Rhino

pts = []
pt = Rhino.Geometry.Point3d(x,y,z)
pts.append(pt)

vec = Rhino.Geometry.Vector3d(x +2, y+ 0,z + 0)
vec2 = Rhino.Geometry.Vector3d(x + 0,y + 2,z + 0)

for i in range(n):
    newPt = Rhino.Geometry.Point3d(vec*i)
    pts.append(newPt)
    newPt = Rhino.Geometry.Point3d(vec2*i)
    pts.append(newPt)

a = pts
nurbsCurve = Rhino.Geometry.NurbsCurve.Create(True, degree, pts)
# ---------- end ghpython_script_23 ----------
ghpython_script_24 = GhPythonScript(x=number_slider_32, y=number_slider_32, z=number_slider_32, n=number_slider_31)  # -> out, pt, a, vec, newPt; inputs n: Int32; disabled
# ---------- ghpython_script_24: Python ----------
import Rhino

pts = []
#pt = Rhino.Geometry.Point3d(x,y,z)
pts.append(pt)

vec = Rhino.Geometry.Vector3d(1,0,0)

for i in range(n):
    newPt = Rhino.Geometry.Point3d(vec*i)
    pts.append(newPt)

a = pts
# ---------- end ghpython_script_24 ----------
circle = Circle(Plane=plane, Radius=number_slider_35)  # disabled
curve_6 = Curve(ghpython_script_22.nurbsCurve)  # disabled
panel_8 = Panel(ghpython_script_19.d)  # disabled
panel_9 = Panel(ghpython_script_19.a)  # disabled
panel_10 = Panel(ghpython_script_19.c)  # disabled
panel_12 = Panel(ghpython_script_21.vecAngle)  # disabled
construct_point = ConstructPoint(XCoordinate=0, YCoordinate=0, ZCoordinate=0)  # disabled
panel_13 = Panel(ghpython_script_20.a)  # disabled
point_19 = Point(ghpython_script_24.a)  # disabled
panel_14 = Panel(ghpython_script_24.a)  # disabled
panel_15 = Panel(ghpython_script_24.pt)  # disabled
panel_16 = Panel(ghpython_script_24.vec)  # disabled
vector_display = VectorDisplay(Anchor=ghpython_script_21.vectorA, Vector=ghpython_script_21.vectorB)  # disabled
vector_display_2 = VectorDisplay(Anchor=ghpython_script_21.vectorA, Vector=ghpython_script_21.vectorA)  # disabled
sweep1 = Sweep1(Rail=reparameterize(curve_6), Sections=circle, Miter=1)  # disabled
point_20 = Point(ghpython_script_22.a)  # disabled
panel_17 = Panel(ghpython_script_22.pt)  # disabled
point_21 = Point(ghpython_script_23.a)  # disabled
panel_18 = Panel(ghpython_script_22.vec)  # disabled
panel_19 = Panel(ghpython_script_23.pt)  # disabled
panel_20 = Panel(ghpython_script_23.vec)  # disabled
curve_7 = Curve(ghpython_script_23.nurbsCurve)  # disabled
vector = Vector(ghpython_script_19.vector)  # disabled
vector_display_3 = VectorDisplay(Anchor=ghpython_script_21.vectorA, Vector=ghpython_script_21.vecCrossProd)  # disabled
vector_display_4 = VectorDisplay(Anchor=ghpython_script_21.vectorA, Vector=ghpython_script_21.vecSubtract)  # disabled
vector_display_5 = VectorDisplay(Anchor=ghpython_script_21.vectorA, Vector=ghpython_script_21.vecAdd)  # disabled
param_viewer = ParamViewer(ghpython_script_22.a)  # disabled
panel_21 = Panel(ghpython_script_22.a)  # disabled
vector_display_6 = VectorDisplay(Anchor=construct_point, Vector=ghpython_script_20.vector)  # disabled
construct_point_2 = ConstructPoint(XCoordinate=0, YCoordinate=0, ZCoordinate=0)  # disabled
param_viewer_2 = ParamViewer(ghpython_script_23.a)  # disabled
panel_22 = Panel(ghpython_script_23.a)  # disabled
vector_display_7 = VectorDisplay(Anchor=construct_point, Vector=ghpython_script_20.b)  # disabled
vector_display_8 = VectorDisplay(Anchor=construct_point_2, Vector=vector)  # disabled
# Moving Object By Vector
ghpython_script_25 = GhPythonScript()  # -> out, a, b, c; disabled
# ---------- ghpython_script_25: Python ----------
import Rhino
import scriptcontext

def constrainedcopy():
    #get a single closed curve
    go = Rhino.Input.Custom.GetObject()
    go.SetCommandPrompt("Select curve")
    go.GeometryFilter = Rhino.DocObjects.ObjectType.Curve
    go.GeometryAttributeFilter = Rhino.Input.Custom.GeometryAttributeFilter.ClosedCurve
    go.Get()
    if go.CommandResult() != Rhino.Commands.Result.Success: return
    objref = go.Object(0)
    base_curve = objref.Curve()
    first_point = objref.SelectionPoint()
    if not base_curve or not first_point.IsValid:
        return
    isplanar, plane = base_curve.TryGetPlane()
    if not isplanar: return

    gp = Rhino.Input.Custom.GetPoint()
    gp.SetCommandPrompt("Offset point")
    gp.DrawLineFromPoint(first_point, True)
    line = Rhino.Geometry.Line(first_point, first_point + plane.Normal)
    gp.Constrain(line)
    gp.Get()
    if gp.CommandResult() != Rhino.Commands.Result.Success:
        return
    second_point = gp.Point()
    vec = second_point - first_point
    if vec.Length > 0.001:
        xf = Rhino.Geometry.Transform.Translation(vec)
        id = Rhino.RhinoDoc.ActiveDoc.Objects.Transform(objref, xf, False)
        Rhino.RhinoDoc.ActiveDoc.Views.Redraw()
        return id

if __name__=="__main__":
    constrainedcopy()
# ---------- end ghpython_script_25 ----------
number_slider_44 = Slider(2, range=0..2)  # disabled

# ----
# GhPython Course at
# Wickerson Studios
# Vector from Attractor Point
# Vector From Attractor points
number_slider_45 = Slider(4.4, range=0..10)  # disabled
number_slider_46 = Slider(3.1, range=0..10)  # disabled
number_slider_47 = Slider(2.62, range=0..10)  # disabled
xy_plane_3 = XYPlane(Origin=Point(0, 0, 0))  # disabled
point_22 = Point(<point referenced from the Rhino model>)  # disabled
ghpython_script_26 = GhPythonScript(
    size=number_slider_45,
    attPt=point_22,
    scale=number_slider_46,
    plane=xy_plane_3,
    x=number_slider_47,
    y=number_slider_47,
    z=number_slider_47)  # -> out, pt2D; inputs attPt: Point3d; disabled
# ---------- ghpython_script_26: Python ----------
import Rhino
import rhinoscriptsyntax as rs

def ScalingVector(pt1, pt2, scale):
    tmpVec = Rhino.Geometry.Vector3d(x,y,z)
    #tmpVec = rs.VectorCreate(pt2, pt1)
    #unitVec = Rhino.Geometry.Vector3d.Unitize(tmpVec)
    unitVec = rs.VectorUnitize(tmpVec)
    #vec = Rhino.Geometry.Transform.Scale(plane, x, y, z)
    vec = rs.VectorScale(unitVec, scale)
    #newPt = Rhino.Geometry.Transform.Translation(x,y,z)
    newPt = rs.CopyObject(pt1,vec)
    #vLine = Rhino.Geometry.Line(pt1, newPt)
    vLine = rs.AddLine(pt1, newPt)
    
    return newPt, vLine


pt2D = []
newPt = []
lineList = []

for i in range(10):
    for j in range(10):
        pt2D.append(Rhino.Geometry.Point3d(size*i, size*j,0))
        
        
for i in range(len(pt2D)):
    #pt, line = Rhino.Geometry.Transform.Scale(plane, x,y,z)
    pt,line = ScalingVector(pt2D[i], attPt, scale)
    newPt.append(pt)
    lineList.append(line)

pt2D_out = pt2D
newPt_out = newPt
lineList_out = lineList
# ---------- end ghpython_script_26 ----------
panel_23 = Panel(ghpython_script_26.out)  # disabled

number_slider_48 = Slider(10, range=0..10)  # disabled
number_slider_49 = Slider(3.35, range=0..10)  # disabled
number_slider_50 = Slider(0, range=0..10)  # disabled
number_slider_51 = Slider(10, range=0..10)  # disabled
# Pattern with One Attractor Curve
number_slider_52 = Slider(9.9, range=0..10)  # disabled
# Rotation Rectangle Pattern with One Attractor Point
number_slider_53 = Slider(40, range=0..100)  # disabled
# Pattern with Multiple Attractor Points
number_slider_54 = Slider(4.2, range=0..10)  # disabled
curve_8 = Curve(<curve referenced from the Rhino model>)  # disabled
number_slider_55 = Slider(18, range=0..100)  # disabled
number_slider_56 = Slider(10, range=0..10)  # disabled
number_slider_57 = Slider(10, range=0..10)  # disabled
number_slider_58 = Slider(10, range=0..10)  # disabled
number_slider_59 = Slider(43, range=0..100)  # disabled

# ----
# Vector From Attractor points
number_slider_60 = Slider(4.4, range=0..10)  # disabled
number_slider_61 = Slider(3.1, range=0..10)  # disabled
point_23 = Point(<point referenced from the Rhino model>)  # disabled
ghpython_script_27 = GhPythonScript(size=number_slider_60, attPt=point_23, scale=number_slider_61)  # -> out, pt2D_out, newPt_out, lineList_out; inputs attPt: Point3d; disabled
# ---------- ghpython_script_27: Python ----------
import rhinoscriptsyntax as rs

def ScalingVector(pt1, pt2, scale):
    tmpVec = rs.VectorCreate(pt2, pt1)
    unitVec = rs.VectorUnitize(tmpVec)
    vec = rs.VectorScale(unitVec, scale)
    newPt = rs.CopyObject(pt1,vec)
    vLine = rs.AddLine(pt1, newPt)
    
    return newPt, vLine


pt2D = []
newPt = []
lineList = []

for i in range(10):
    for j in range(10):
        pt2D.append(rs.AddPoint(size*i, size*j,0))
        
        
for i in range(len(pt2D)):
    pt,line = ScalingVector(pt2D[i], attPt, scale)
    newPt.append(pt)
    lineList.append(line)

pt2D_out = pt2D
newPt_out = newPt
lineList_out = lineList
# ---------- end ghpython_script_27 ----------
panel_24 = Panel(ghpython_script_27.pt2D_out)  # disabled
panel_25 = Panel(ghpython_script_27.lineList_out)  # disabled
panel_26 = Panel(ghpython_script_27.newPt_out)  # disabled

# ----
# Rotation Rectangle Pattern with One Attractor Point Wickerson Studios_001
number_slider_62 = Slider(40, range=0..100)  # disabled
# Spiral Graphic
number_slider_63 = Slider(10, range=0..10)  # disabled
# Remapping Numbers by Trigonometric Function
number_slider_64 = Slider(40, range=0..100)  # disabled
# Pattern with Attractors
number_slider_65 = Slider(100, range=0..100)  # disabled
number_slider_66 = Slider(5, range=0..10)  # disabled
number_slider_67 = Slider(5, range=1..5)  # disabled
number_slider_68 = Slider(10, range=0..10)  # disabled
# Pattern with Multiple Attractor Curves
number_slider_69 = Slider(29, range=0..100)  # disabled
curve_middle = CurveMiddle(Curve=curve_8)  # disabled
pi = Pi(Factor=number_slider_44)  # disabled
point_24 = Point([<point referenced from the Rhino model> x2])  # disabled
point_25 = Point(<point referenced from the Rhino model>)  # disabled
point_26 = Point(<point referenced from the Rhino model>)  # disabled
point_27 = Point(<point referenced from the Rhino model>)  # disabled
point_28 = Point(<point referenced from the Rhino model>)  # disabled
point_29 = Point(<point referenced from the Rhino model>)  # disabled
number_slider_70 = Slider(10, range=0..10)  # disabled
ghpython_script_28 = GhPythonScript(num=number_slider_55, size=number_slider_49, attPt=point_25)  # -> out, pt2D_out, distanceList_out, circleList_out; inputs num: Int32; disabled
# ---------- ghpython_script_28: Python ----------
import Rhino
import rhinoscriptsyntax as rs

pt2D = []
for i in range(num):
    for j in range(num):
        pt2D.append(Rhino.Geometry.Point3d(size*i, size*j, 0))

distanceList = []

for i in range(len(pt2D)):
    distance = rs.Distance(pt2D[i], attPt)
    distanceList.append(distance)

circleList = []

for i in range(len(pt2D)):
    radius = (distanceList[i]/max(distanceList))*size/2
    circle = Rhino.Geometry.Circle(pt2D[i], radius)
    circleList.append(circle)
    
pt2D_out = pt2D
distanceList_out = distanceList
circleList_out = circleList
# ---------- end ghpython_script_28 ----------
ghpython_script_29 = GhPythonScript(num=number_slider_59, size=number_slider_52, attPts=point_24)  # -> out, circleList; inputs num: Int32, attPts: list; disabled
# ---------- ghpython_script_29: Python ----------
import Rhino
import rhinoscriptsyntax as rs
import math

pt2D = []
for i in range(num):
    for j in range(num):
        pt2D.append(rs.AddPoint(size*i, size*j, 0))

closestAttPtList = []
distanceList = []

for i in range(len(pt2D)):
    index = rs.PointArrayClosestPoint(attPts, pt2D[i])
    closestAttPt = attPts[index]
    distance = rs.Distance(pt2D[i],closestAttPt)
    closestAttPtList.append(closestAttPt)
    distanceList.append(distance)

circleList = []

for i in range(len(pt2D)):
    radius = (distanceList[i]/max(distanceList))*size/2
    circle = rs.AddCircle(pt2D[i], radius)
    circleList.append(circle)
    
circletList_out = circleList
# ---------- end ghpython_script_29 ----------
ghpython_script_30 = GhPythonScript(
    n=number_slider_63,
    size=number_slider_66,
    degree=number_slider_67,
    attPt=point_27,
    mult=number_slider_58,
    angle=number_slider_65)  # -> out, a, c; inputs n: Int32, size: Int32, degree: Int32, attPt: Point3d; disabled
# ---------- ghpython_script_30: Python ----------
import Rhino
import rhinoscriptsyntax as rs

pt2D = []
curveList = []

for i in range(n):
    for j in range(n):
        pt2D.append(Rhino.Geometry.Point3d(size*i,size*j,0))

for k in range(len(pt2D)):
    IPCPts = []
    for m in range(degree):
        tmpVector = rs.VectorCreate(attPt,pt2D[k])
        unitVector = rs.VectorUnitize(tmpVector)
        vector = rs.VectorScale(unitVector,mult)
        vector = rs.VectorRotate(vector,angle,[0,0,1])
        newPt = rs.CopyObject(pt2D[k], vector)
        IPCPts.append(newPt)
        pt2D[k] = newPt
        
    #curve = Rhino.Geometry.NurbsCurve.Create(False, degree, IPCPts)
    curve = rs.AddInterpCurve(IPCPts, 3)
    curveList.append(curve)

a = pt2D
c = curveList
# ---------- end ghpython_script_30 ----------
ghpython_script_31 = GhPythonScript(num=number_slider_53, size=number_slider_48, attPt=point_26, f=number_slider_50)  # -> out, rectList; inputs num: Int32; disabled
# ---------- ghpython_script_31: Python ----------
import Rhino
import rhinoscriptsyntax as rs
import math

pt2D = []
for i in range(num):
    for j in range(num):
        pt2D.append(Rhino.Geometry.Point3d(size*i, size*j, 0))

distanceList = []

for i in range(len(pt2D)):
    distance = rs.Distance(pt2D[i], attPt)
    distanceList.append(distance)

rectList = []

for i in range(len(pt2D)):
    angle = distanceList[i]
    plane = rs.PlaneFromNormal(pt2D[i], rs.VectorAdd([0,0,0], [0,0,1]))
    rect = rs.AddRectangle(plane, size/1.6,size/1.6)
    rotateRect = rs.RotateObject(rect,pt2D[i],angle*f)
    rectList.append(rotateRect)
    

rectList_out = rectList
# ---------- end ghpython_script_31 ----------
number_slider_71 = Slider(29, range=0..100)  # disabled
ghpython_script_32 = GhPythonScript(num=number_slider_62, size=number_slider_51, attPt=point_29, f=number_slider_54)  # -> out, rectList; inputs num: Int32; disabled
# ---------- ghpython_script_32: Python ----------
import Rhino
import rhinoscriptsyntax as rs
import math

pt2D = []
for i in range(num):
    for j in range(num):
        pt2D.append(Rhino.Geometry.Point3d(size*i, size*j, 0))

distanceList = []

for i in range(len(pt2D)):
    distance = rs.Distance(pt2D[i], attPt)
    distanceList.append(distance)

rectList = []

for i in range(len(pt2D)):
    angle = distanceList[i]
    plane = rs.PlaneFromNormal(pt2D[i], rs.VectorAdd([1,1,0], [0,0,1]))
    rect = rs.AddRectangle(plane, size/1.6,size/1.6)
    rotateRect = rs.RotateObject(rect,pt2D[i],angle*f)
    rectList.append(rotateRect)
    

rectList_out = rectList
# ---------- end ghpython_script_32 ----------
curve_9 = Curve([<curve referenced from the Rhino model> x3])  # disabled
ghpython_script_33 = GhPythonScript(num=number_slider_64, size=number_slider_56, attPt=point_28, f=number_slider_57)  # -> out, pt2D_out, circleList; inputs num: Int32; disabled
# ---------- ghpython_script_33: Python ----------
import Rhino
import rhinoscriptsyntax as rs
import math

pt2D = []
for i in range(num):
    for j in range(num):
        pt2D.append(Rhino.Geometry.Point3d(size*i, size*j, 0))

distanceList = []

for i in range(len(pt2D)):
    distance = rs.Distance(pt2D[i], attPt)
    distanceList.append(distance)

circleList = []

for i in range(len(pt2D)):
    radius = abs(math.sin(math.radians(distanceList[i])*f)*size/2)
    circle = Rhino.Geometry.Circle(pt2D[i], radius)
    circleList.append(circle)
    
pt2D_out = pt2D
circleList_out = circleList
# ---------- end ghpython_script_33 ----------
number_slider_72 = Slider(2, range=0..10)  # disabled
rotate_3d = Rotate3D(Geometry=curve_8, Angle=pi, Center=curve_middle, Axis=Vector(0, 0, 1))  # -> Geometry, Transform; disabled
ghpython_script_34 = GhPythonScript(num=number_slider_69, size=number_slider_68, curve=curve_9)  # -> out, circleList_out; inputs num: Int32, curve: list of Curve; disabled
# ---------- ghpython_script_34: Python ----------
import Rhino
import rhinoscriptsyntax as rs
import math

pt2D = []
for i in range(num):
    for j in range(num):
        pt2D.append(rs.AddPoint(size*i, size*j, 0))

ptOnCurveList = []
distanceList = []
circleList = []

t = []
for i in range(len(pt2D)):
    for j in curve:
        t = rs.CurveClosestPoint(j, pt2D[i])
        ptOnCurve = rs.EvaluateCurve(j, t)
        ptOnCurveList.append(ptOnCurve)
    minDist = -1
    for k in range(len(ptOnCurveList)):
        dist = rs.Distance(pt2D[i], ptOnCurveList[k])
        if(minDist < 0 or dist < minDist):
            minDist = dist
    distanceList.append(minDist)

for i in range(len(pt2D)):
    radius = (distanceList[i]/max(distanceList))*size/2
    circle = rs.AddCircle(pt2D[i], radius)
    circleList.append(circle)
    
circleList_out = circleList
# ---------- end ghpython_script_34 ----------
curve_10 = Curve(ghpython_script_30.c)  # disabled
point_30 = Point(ghpython_script_30.a)  # disabled
curve_11 = Curve(ghpython_script_31.rectList)  # disabled
curve_12 = Curve(ghpython_script_33.circleList)  # disabled
curve_13 = Curve(ghpython_script_32.rectList)  # disabled
curve_14 = Curve(ghpython_script_29.circleList)  # disabled
point_31 = Point(ghpython_script_33.pt2D_out)  # disabled
point_32 = Point(ghpython_script_28.pt2D_out)  # disabled
curve_15 = Curve(ghpython_script_28.circleList_out)  # disabled
panel_27 = Panel(ghpython_script_28.distanceList_out)  # disabled
ghpython_script_35 = GhPythonScript(num=number_slider_71, size=number_slider_70, curve=rotate_3d.Geometry)  # -> out, circleList_out; inputs num: Int32, curve: Curve; disabled
# ---------- ghpython_script_35: Python ----------
import Rhino
import rhinoscriptsyntax as rs
import math

pt2D = []
for i in range(num):
    for j in range(num):
        pt2D.append(rs.AddPoint(size*i, size*j, 0))


distanceList = []

for i in range(len(pt2D)):
    t = rs.CurveClosestPoint(curve, pt2D[i])
    ptOnCurve = rs.EvaluateCurve(curve, t)
    distance = rs.Distance(ptOnCurve, pt2D[i])
    distanceList.append(distance)

circleList = []

for i in range(len(pt2D)):
    radius = (distanceList[i]/max(distanceList))*size/2
    circle = rs.AddCircle(pt2D[i], radius)
    circleList.append(circle)
    
circleList_out = circleList
# ---------- end ghpython_script_35 ----------
pipe = Pipe(Curve=curve_10, Radius=1, Caps=number_slider_72)  # disabled
curve_16 = Curve(ghpython_script_34.circleList_out)  # disabled
curve_17 = Curve(ghpython_script_35.circleList_out)  # disabled
number_slider_73 = Slider(8, range=0..10)  # disabled
number_slider_74 = Slider(3.9, range=0..10)  # disabled
number_slider_75 = Slider(3, range=1..5)  # disabled
number_slider_76 = Slider(2.2, range=0..10)  # disabled
number_slider_77 = Slider(10, range=0..10)  # disabled
number_slider_78 = Slider(4, range=0..100)  # disabled
number_slider_79 = Slider(6, range=0..10)  # disabled
number_slider_80 = Slider(2.1, range=0..10)  # disabled
number_slider_81 = Slider(10, range=0..10)  # disabled
# Spiral along Spiral 2.0 Rhino Forum for Help
number_slider_82 = Slider(25, range=0..100)  # disabled
number_slider_83 = Slider(0.9, range=0..10)  # disabled
number_slider_84 = Slider(10, range=0..10)  # disabled
number_slider_85 = Slider(2, range=0..10)  # disabled
number_slider_86 = Slider(2, range=1..5)  # disabled
number_slider_87 = Slider(5.3, range=0..10)  # disabled
number_slider_88 = Slider(14, range=0..100)  # disabled
number_slider_89 = Slider(6.7, range=0..10)  # disabled
number_slider_90 = Slider(1.4, range=0..10)  # disabled
number_slider_91 = Slider(2, range=0..10)  # disabled
number_slider_92 = Slider(3.33, range=0..10)  # disabled
number_slider_93 = Slider(15, range=0..100)  # disabled
number_slider_94 = Slider(7.84, range=0..10)  # disabled
number_slider_95 = Slider(3.33, range=0..10)  # disabled
number_slider_96 = Slider(15, range=0..100)  # disabled
number_slider_97 = Slider(7.84, range=0..10)  # disabled
number_slider_98 = Slider(13, range=0..20)  # disabled
number_slider_99 = Slider(14, range=0..100)  # disabled
number_slider_100 = Slider(0, range=0..1)  # disabled
number_slider_101 = Slider(1, range=0..1)  # disabled
number_slider_102 = Slider(14, range=0..100)  # disabled
curve_18 = Curve(reparameterize(<curve referenced from the Rhino model>))  # disabled
curve_19 = Curve(<curve referenced from the Rhino model>)  # disabled
xy_plane_4 = XYPlane(Origin=Point(0, 0, 0))  # disabled
curve_20 = Curve(<curve referenced from the Rhino model>)  # disabled
# Divide Curve
curve_21 = Curve(reparameterize(<curve referenced from the Rhino model>))  # disabled
# Curve
# Curve Domain
curve_22 = Curve(reparameterize(<curve referenced from the Rhino model>))  # disabled
# Spiral along Spiral
ghpython_script_36 = GhPythonScript(n=number_slider_88, scaleX=number_slider_87, scaleY=number_slider_89, scaleZ=number_slider_90, degree=number_slider_86)  # -> out, curve_out; inputs n: Int32, degree: Int32; disabled
# ---------- ghpython_script_36: Python ----------
#import rhinoscriptsyntax as rs
import Rhino.Geometry as rg
import math

pts = []

for i in range(n):
    x = math.sin(i)*scaleX
    y = math.cos(i)*scaleY
    z = i * scaleZ
    
    #pt = rs.AddPoint(x,y,z)
    pt = rg.Point3d(x,y,z)
    vec = rg.Vector3d(x,y,z)
    pt = rg.Point3d.Add(pt, vec)
    
    #pt = Rhino.Geometry.Point3d(x,y,z)
    #vec = Rhino.Geometry.Vector3d(x,y,z)
    #pt = Rhino.Geometry.Point3d.Add(pt, vec)
    pts.append(pt)
    
#curve = rs.AddInterpCurve(pts)
curve = rg.NurbsCurve.Create(False, degree, pts)
#curve = Rhino.Geometry.NurbsCurve.Create(False, degree, pts)

curve_out = curve
# ---------- end ghpython_script_36 ----------
# Spiral along Spiral 2.0
ghpython_script_37 = GhPythonScript(
    n=number_slider_78,
    scale=number_slider_74,
    scaleX=number_slider_77,
    scaleY=number_slider_79,
    scaleZ=number_slider_80,
    degree=number_slider_75)  # -> out, curve_out, spiralSurface_out, curveFrame; inputs n: Int32, degree: Int32; disabled
# ---------- ghpython_script_37: Python ----------
#import Rhino
import rhinoscriptsyntax as rs
#import Rhino.Geometry as rg
import math

pts = []

for i in range(n):
    x = math.sin(i)*scaleX
    y = math.cos(i)*scaleY
    z = i * scaleZ
    
    pt = rs.AddPoint(x,y,z)
    #pt = rg.Point3d(x,y,z)
    #vec = rg.Vector3d(x,y,z)
    #pt = rg.Point3d.Add(pt, vec)
    
    #pt = Rhino.Geometry.Point3d(x,y,z)
    #vec = Rhino.Geometry.Vector3d(x,y,z)
    #pt = Rhino.Geometry.Point3d.Add(pt, vec)
    pts.append(pt)
    
curve = rs.AddInterpCurve(pts)
#curve = rg.NurbsCurve.Create(False, degree, pts)
#curve = Rhino.Geometry.NurbsCurve.Create(False, degree, pts)

curveDomain = rs.CurveDomain(curve)
lineList = []

for i in range(n**2):
    i = ((curveDomain[1]-curveDomain[0])/n**2)*i
    t = rs.EvaluateCurve(curve,i)
    pt2 = rs.AddPoint(t)
    curveFrame = rs.CurvePerpFrame(curve,i)
    #vector = rs.VectorRotate(curveFrame[1],720*i,curveFrame[3])
    vector = rs.VectorRotate([1,0,0], 720*i, [0,0,1])
    pt3 = rs.CopyObject(pt2,vector*math.sin(i)*scale)
    line = rs.AddLine(pt2,pt3)
    lineList.append(line)

spiralSurface = rs.AddLoftSrf(lineList)

curve_out = curve
spiralSurface_out = spiralSurface
# ---------- end ghpython_script_37 ----------
ghpython_script_38 = GhPythonScript(n=number_slider_82, scale=number_slider_76, scaleX=number_slider_81, scaleY=number_slider_84, scaleZ=number_slider_83)  # -> out, curve_out, spiralSurface_out, curveFrame; inputs n: Int32; disabled
# ---------- ghpython_script_38: Python ----------
import rhinoscriptsyntax as rs
import math

pts = []

for i in range(n):
    x = math.sin(i)*scaleX
    y = math.cos(i)*scaleY
    z = i * scaleZ
    pt = rs.AddPoint(x,y,z)
    pts.append(pt)
    
curve = rs.AddInterpCurve(pts)

curveDomain = rs.CurveDomain(curve)
lineList = []

for i in range(n**2):
    i = ((curveDomain[1]-curveDomain[0])/n**2)*i
    t = rs.EvaluateCurve(curve,i)
    pt2 = rs.AddPoint(t)
    curveFrame = rs.CurvePerpFrame(curve,i)
    
    #vector = rs.VectorRotate(curveFrame[1],720*i,curveFrame[3])
    vector = rs.VectorRotate([1,1,0], 720*i, [0,1,1])
    
    pt3 = rs.CopyObject(pt2,vector*math.sin(i)*scale)
    line = rs.AddLine(pt2,pt3)
    lineList.append(line)

spiralSurface = rs.AddLoftSrf(lineList)

curve_out = curve
spiralSurface_out = spiralSurface
# ---------- end ghpython_script_38 ----------
# Divide Curve
ghpython_script_39 = GhPythonScript(curve=curve_18, divideNum=number_slider_73)  # -> out, dividePts_out; inputs curve: Curve, divideNum: Int32; disabled
# ---------- ghpython_script_39: Python ----------
import rhinoscriptsyntax as rs
import Rhino

dividePts = []

#domain = rs.CurveDomain(curve)
domain = Rhino.Geometry.Curve.Domain.GetValue(curve)

startDomain = domain[0]
endDomain = domain[1]
step = (endDomain-startDomain)/divideNum

for t in rs.frange(startDomain,endDomain,step):
    point = Rhino.Geometry.Curve.PointAt(curve, t)
    dividePts.append(point)

dividePts_out = dividePts
# ---------- end ghpython_script_39 ----------
ghpython_script_40 = GhPythonScript(curve=curve_21, divideNum=number_slider_98, plane=xy_plane_4)  # -> out, dividePts_out, tanLine_out, normalLine_out, CPLine_out; inputs curve: Curve, divideNum: Int32, plane: Plane; disabled
# ---------- ghpython_script_40: Python ----------
import rhinoscriptsyntax as rs
import Rhino

dividePts = []
tanLine = []
normalLine = []
CPLine = []

domain = Rhino.Geometry.Curve.Domain.GetValue(curve)
stPt = domain[0]
edPt = domain[1]
step = (edPt-stPt)/divideNum

for t in rs.fxrange(stPt,edPt,step):
    point = Rhino.Geometry.Curve.PointAt(curve, t)
    dividePts.append(point)
    
    #tan = rs.CurveTangent(curve, t)
    tan = Rhino.Geometry.Curve.TangentAt(curve, t)
    #pointTan = rs.PointAdd(point, tan)
    pointTan = Rhino.Geometry.Point3d.Add(point, tan) 
    #tanLine.append(rs.AddLine(point, pointTan))
    tanLine.append(Rhino.Geometry.Line(point, pointTan))
    
    normal = rs.CurveNormal(curve, t)
    #interesting switch of Normal directions
    #normal = Rhino.Geometry.Curve.NormalizedLengthParameter(curve, t)
    normal = rs.VectorScale(normal, 3)
    #trans = Rhino.Geometry.Transform.Scale(plane,.3,.3,.3)
    #normal = Rhino.Geometry.Vector3d.Transform(normal, trans)
    
    #pointNor = rs.PointAdd(point,tan)
    pointNor = Rhino.Geometry.Point3d.Add(point, tan)
    #normalLine.append(rs.AddLine(point,pointNor))
    normalLine.append(Rhino.Geometry.Line(point, pointNor))
    
    #vecCP = rs.VectorCrossProduct(tan, normal)
    vecCP = Rhino.Geometry.Vector3d.CrossProduct(tan,normal)
    vecCP = rs.VectorUnitize(vecCP)
    #vecCP = Rhino.Geometry.Vector3d.Unitize(vecCP)
    vecCP = rs.VectorScale(vecCP, 3)
    #transCP = Rhino.Geometry.Transform.Scale(plane,.3,.3,.3)
    #vecCP = Rhino.Geometry.Vector3d.Transform(vecCP,transCP)
    #pointCP = rs.PointAdd(point,vecCP)
    pointCP = Rhino.Geometry.Point3d.Add(point,vecCP)
    #CPLine.append(rs.AddLine(point,pointCP))
    CPLine.append(Rhino.Geometry.Line(point,pointCP))
    
    
    dividePts_out = dividePts
    tanLine_out = tanLine
    normalLine_out = normalLine
    CPLine_out = CPLine
# ---------- end ghpython_script_40 ----------
# Brick Wall
ghpython_script_41 = GhPythonScript(
    curve=curve_20,
    divideNum=number_slider_93,
    width=number_slider_92,
    length=number_slider_94,
    height=number_slider_85,
    layer=number_slider_102)  # -> out, brickWall_out; inputs curve: Curve, divideNum: Int32, layer: Int32; disabled
# ---------- ghpython_script_41: Python ----------
import rhinoscriptsyntax as rs
import Rhino.Geometry as rg

brickList = []

domain = rs.CurveDomain(curve)
#domain = rg.Curve.Domain.GetValue(curve)
stp = domain[0]
edp = domain[1]
step = (edp-stp)/divideNum

for t in rs.frange(stp,edp,step):
#for t in rg.frange(stp,edp,step):
    pt = rs.EvaluateCurve(curve, t)
    tan = rs.CurveTangent(curve,t)
    normal = rs.CurveNormal(curve, t)
    vecCP = rs.VectorCrossProduct(tan, normal)
    
    tanPt = rs.CopyObject(pt, tan)
    vecCPPt = rs.CopyObject(pt,vecCP)
    plane = rs.PlaneFromPoints(pt,tanPt,vecCPPt)
    rect = rs.AddRectangle(plane, length, width)
    rect = rs.MoveObject(rect,-(tan*length/2+vecCP*width/2))
    
    vector = height * normal
    pt2 = rs.CopyObject(pt,vector)
    line = rs.AddLine(pt,pt2)
    brick = rs.ExtrudeCurve(rect, line)
    rs.CapPlanarHoles(brick)
    brickList.append(brick)
    
brickList_out = brickList

brickWall = []
for i in range(len(brickList)):
    if i % 2 == 0:
        for j in range(layer):
            brick = rs.CopyObject(brickList[i], [0,0,height*2*j])
            brickWall.append(brick)
    else:
        rs.MoveObject(brickList[i], [0,0,height])
        for j in range(layer):
            brick = rs.CopyObject(brickList[i],[0,0,height*2*j])
            brickWall.append(brick)
            
brickWall_out = brickWall
# ---------- end ghpython_script_41 ----------
ghpython_script_42 = GhPythonScript(curve=curve_22, t=number_slider_101, tt=number_slider_100)  # -> out, domain, startPoint_out, endPoint_out; inputs curve: Curve; disabled
# ---------- ghpython_script_42: Python ----------
import rhinoscriptsyntax as rs
import Rhino

#domain = rs.CurveDomain(curve)
domain = Rhino.Geometry.Curve.Domain.GetValue(curve)

startDomain = domain[0]
endDomain = domain[1]

#startPoint = rs.EvaluateCurve(curve,startDomain)
startPoint = Rhino.Geometry.Curve.PointAt(curve, t)
#endPoint = rs.EvaluateCurve(curve,endDomain)
endPoint = Rhino.Geometry.Curve.PointAt(curve, tt)

print(domain)
startPoint_out = startPoint
endPoint_out = endPoint
# ---------- end ghpython_script_42 ----------
# Brick Wall
ghpython_script_43 = GhPythonScript(
    curve=curve_20,
    divideNum=number_slider_96,
    width=number_slider_95,
    length=number_slider_97,
    height=number_slider_91,
    layer=number_slider_99)  # -> out, brickWall_out; inputs curve: Curve, divideNum: Int32, layer: Int32; disabled
# ---------- ghpython_script_43: Python ----------
import rhinoscriptsyntax as rs
import Rhino.Geometry as rg
import Rhino

brickList = []

#domain = rs.CurveDomain(curve)
domain = rg.Curve.Domain.GetValue(curve)
stp = domain[0]
edp = domain[1]
step = (edp-stp)/divideNum

for t in rs.frange(stp,edp,step):
    #pt = rs.EvaluateCurve(curve, t)
    pt = rg.Curve.PointAt(curve, t)
    #tan = rs.CurveTangent(curve,t)
    tan = rg.Curve.TangentAt(curve, t)
    normal = rs.CurveNormal(curve, t)
    #normal = rg.Curve.
    #vecCP = rs.VectorCrossProduct(tan, normal)
    vecCP = rg.Vector3d.CrossProduct(tan, normal)
    tanPt = rs.CopyObject(pt, tan)
    #tanPt = rg.Transform.Translation(
    vecCPPt = rs.CopyObject(pt,vecCP)
    #vecCPPt = rg.Transform.Translation(
    plane = rs.PlaneFromPoints(pt,tanPt,vecCPPt)
    #plane = rg.Plane.FitPlaneToPoints(pt,tanPt,vecCPPt)
    #rect = rs.AddRectangle(plane, length, width)
    rect = rg.Rectangle3d(plane, length, width)
    rect = rs.MoveObject(rect,-(tan*length/2+vecCP*width/2))
    #rect = rg.Transform.Translation(rect,-(tan*length/2+vecCP*width/2))
    
    
    vector = height*normal
    pt2 = rs.CopyObject(pt,vector)
    line = rs.AddLine(pt,pt2)
    brick = rs.ExtrudeCurve(rect, line)
    rs.CapPlanarHoles(brick)
    brickList.append(brick)
    
brickList_out = brickList

brickWall = []
for i in range(len(brickList)):
    if i % 2 == 0:
        for j in range(layer):
            brick = rs.CopyObject(brickList[i], [0,0,height*2*j])
            brickWall.append(brick)
    else:
        rs.MoveObject(brickList[i], [0,0,height])
        for j in range(layer):
            brick = rs.CopyObject(brickList[i],[0,0,height*2*j])
            brickWall.append(brick)
            
brickWall_out = brickWall
# ---------- end ghpython_script_43 ----------
curve_23 = Curve(ghpython_script_36.curve_out)  # disabled
range = Range(Domain=Domain(0, 1), Steps=10)  # disabled
surface = Surface(ghpython_script_38.spiralSurface_out)  # disabled
geometry = Geometry(ghpython_script_38.curveFrame)  # disabled
surface_2 = Surface(ghpython_script_37.spiralSurface_out)  # disabled
curve_24 = Curve(ghpython_script_38.curve_out)  # disabled
geometry_2 = Geometry(ghpython_script_37.curveFrame)  # disabled
curve_25 = Curve(ghpython_script_37.curve_out)  # disabled
point_33 = Point(ghpython_script_40.dividePts_out)  # disabled
curve_26 = Curve(ghpython_script_40.tanLine_out)  # disabled
curve_27 = Curve(ghpython_script_40.normalLine_out)  # disabled
curve_28 = Curve(ghpython_script_40.tanLine_out)  # disabled
panel_28 = Panel(ghpython_script_42.startPoint_out)  # disabled
panel_29 = Panel(ghpython_script_42.endPoint_out)  # disabled
brep = Brep(ghpython_script_41.brickWall_out)  # disabled
point_34 = Point(ghpython_script_39.dividePts_out)  # disabled
brep_2 = Brep(ghpython_script_43.brickWall_out)  # disabled
panel_30 = Panel(ghpython_script_42.out)  # disabled
panel_31 = Panel(ghpython_script_42.domain)  # disabled
graph_mapper = GraphMapper(
    range,
    x0=0,
    x1=5,
    y0=0,
    y1=5,
    container_name="Sine",
    Equation_px=[0, 0.1177500859],
    Equation_py=[0.2782565951, 0.8619004488])  # disabled
panel_32 = Panel("2")  # disabled
pipe_variable = PipeVariable(Curve=reparameterize(curve_23), Parameters=range, Radii=graph_mapper, Caps=panel_32)  # disabled
number_slider_103 = Slider(1.3, range=0.1..10)  # disabled
number_slider_104 = Slider(1.2, range=0.1..10)  # disabled
# Surface Domain
surface_3 = Surface(<surface referenced from the Rhino model>)  # disabled
# Evaluate Surface and Normal
surface_4 = Surface(<surface referenced from the Rhino model>)  # disabled
number_slider_105 = Slider(1.95, range=1..10)  # disabled
number_slider_106 = Slider(3.37, range=1..10)  # disabled
brep_3 = Brep(<brep referenced from the Rhino model>)

# ---- group: Use a DS Category selector and a DS from geometry component
# Surface Curvature
categories = DirectShapeCategories({"Air Terminals": -2008013, "Bridge Abutments": -2006130, "Bridge Arches": -2006134, "Bridge Bearings": -2006138, "Bridge Cables": -2006133, "Bridge Decks": -2006135, "Bridge Foundations": -2006136, "Bridge Girders": -2006137, "Bridge Piers": -2006131, "Bridge Towers": -2006132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}, selected="Generic Models": -2000151)
bygeometry = AddDirectShapeByGeometry(Category=categories, Geometry=brep_3)

# ----
# Surface
ghpython_script_44 = GhPythonScript(surface=surface_3)  # -> out, domainU_out, domainV_out; inputs surface: Surface; disabled
# ---------- ghpython_script_44: Python ----------
import rhinoscriptsyntax as rs
import Rhino.Geometry as rg
import random
import math

domainU = rs.SurfaceDomain(surface, 0)
domainV = rs.SurfaceDomain(surface, 1)

domainU_out = domainU
domainV_out = domainV
# ---------- end ghpython_script_44 ----------
ghpython_script_45 = GhPythonScript(surface=surface_4, divA=number_slider_103, divB=number_slider_104)  # -> out, centerPoint_out, normalVectorLine_out; inputs surface: Surface; disabled
# ---------- ghpython_script_45: Python ----------
import rhinoscriptsyntax as rs
import math
import random

domainU = rs.SurfaceDomain(surface, 0)
domainV = rs.SurfaceDomain(surface, 1)

u = (domainU[1] - domainU[0])/divA
v = (domainV[1] - domainV[0])/divB
centerPoint = rs.EvaluateSurface(surface, u, v)
centerPoint_out = centerPoint

normal = rs.SurfaceNormal(surface, [u, v])
normal  = rs.VectorScale(normal, 12)
startPt = centerPoint
endPt = rs.CopyObject(startPt, normal)
normalVectorLine = rs.AddLine(startPt, endPt)

normalVectorLine_out = normalVectorLine
# ---------- end ghpython_script_45 ----------

# ---- group: Right-click to select multiple Rhino breps
brep_4 = Brep(<brep referenced from the Rhino model>)  # disabled

# ---- group: Use a DS Category selector and a DS from geometry component
# Surface Curvature
categories_2 = DirectShapeCategories({"Air Terminals": -2008013, "Bridge Abutments": -2006130, "Bridge Arches": -2006134, "Bridge Bearings": -2006138, "Bridge Cables": -2006133, "Bridge Decks": -2006135, "Bridge Foundations": -2006136, "Bridge Girders": -2006137, "Bridge Piers": -2006131, "Bridge Towers": -2006132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}, selected="Generic Models": -2000151)  # disabled
bygeometry_2 = AddDirectShapeByGeometry(Category=categories_2, Geometry=brep_4)  # disabled

# ----
number_slider_107 = Slider(74, range=0..100)  # disabled
number_slider_108 = Slider(3, range=0..10)  # disabled
panel_33 = Panel("2")  # disabled
curve_29 = Curve(ghpython_script_45.normalVectorLine_out)  # disabled
ghpython_script_46 = GhPythonScript(surface=brep_4, divA=number_slider_105, divB=number_slider_106)  # -> out, pt_out, normalDir_out, maxCurvature_out, maxCurvatureDir_out, minCurvature_out, minCurvatureDir_out, gaussianCurvature_out, meanCurvature_out; inputs surface: Surface; disabled
# ---------- ghpython_script_46: Python ----------
import rhinoscriptsyntax as rs
import math
import random

domainU = rs.SurfaceDomain(surface, 0)
domainV = rs.SurfaceDomain(surface, 1)

u = (domainU[1] - domainU[0])/divA
v = (domainV[1] - domainV[0])/divB

curvatureParameter = rs.SurfaceCurvature(surface, [u,v])

pt_out = curvatureParameter[0]
normalDir_out = curvatureParameter[1]
maxCurvature_out = curvatureParameter[2]
maxCurvatureDir_out = curvatureParameter[3]
minCurvature_out = curvatureParameter[4]
minCurvatureDir_out = curvatureParameter[5]
gaussianCurvature_out = curvatureParameter[6]
meanCurvature_out = curvatureParameter[7]
# ---------- end ghpython_script_46 ----------
point_35 = Point(ghpython_script_45.centerPoint_out)  # disabled
ghpython_script_47 = GhPythonScript(surface=brep_3, divU=Slider(5, range=0..10), divV=Slider(6, range=0..10))  # -> out, pts_out, domainU_out, domainV_out; inputs surface: Surface, divU: Int32, divV: Int32
# ---------- ghpython_script_47: Python ----------
import rhinoscriptsyntax as rs
import math
import random

domainU = rs.SurfaceDomain(surface, 0)
domainV = rs.SurfaceDomain(surface, 1)

du = (domainU[1] - domainU[0])/divU
dv = (domainV[1] - domainV[0])/divV

pts = []

for i in range(divU + 1):
    for j in  range(divV+1):
        pt = rs.EvaluateSurface(surface, du*i, dv*j)
        pts.append(pt)
        
domainU_out = domainU
domainV_out = domainV
pts_out = pts
# ---------- end ghpython_script_47 ----------
panel_34 = Panel(ghpython_script_44.domainU_out)  # disabled
panel_35 = Panel(ghpython_script_44.domainV_out)  # disabled
panel_36 = Panel(bygeometry_2)  # disabled
number_slider_109 = Slider(12, range=0..100)  # disabled
amplitude = Amplitude(Vector=curve_29, Amplitude=number_slider_107)  # disabled
pipe_2 = Pipe(Curve=curve_29, Radius=number_slider_108, Caps=panel_33)  # disabled
panel_37 = Panel(bygeometry)
point_36 = Point(ghpython_script_47.pts_out)
panel_38 = Panel(ghpython_script_47.domainU_out)
panel_39 = Panel(ghpython_script_47.domainV_out)
point_37 = Point(ghpython_script_46.pt_out)  # disabled
vector_display_9 = VectorDisplay(Anchor=point_35, Vector=amplitude)  # disabled
panel_40 = Panel(ghpython_script_46.normalDir_out)  # disabled
panel_41 = Panel(ghpython_script_46.maxCurvatureDir_out)  # disabled
panel_42 = Panel(ghpython_script_46.minCurvature_out)  # disabled
panel_43 = Panel(ghpython_script_46.minCurvatureDir_out)  # disabled
panel_44 = Panel(ghpython_script_46.maxCurvature_out)  # disabled
panel_45 = Panel(ghpython_script_46.gaussianCurvature_out)  # disabled
panel_46 = Panel(ghpython_script_46.meanCurvature_out)  # disabled
sphere = Sphere(Base=point_36, Radius=Slider(12, range=0..100))
sphere_2 = Sphere(Base=point_37, Radius=number_slider_109)  # disabled
