# Grasshopper definition 0.1_Rhino_Grasshopper_Python_WickersonStudios_Geometry_Surface_Revit2021_008.gh (Grasshopper 1.0.7)
# Copyright: bernhard muller bijoutiers
# plug-ins: Workshop, Bifocals, Rhino.Inside for Autodesk Revit

wickerson_s_first_grasshopper_component = WickersonsFirstGrasshopperComponent()
polygon = Polygon(Plane=PlaneXY(0, 0, 0), Radius=3, Segments=6, FilletRadius=0)  # -> Polygon, Length
curve = Curve(<curve referenced from the Rhino model>)
center_box = CenterBox(Base=PlaneXY(0, 0, 0), X=1, Y=1, Z=Slider(7, range=0..10))
unit_x = UnitX(Factor=Slider(12, range=0..100))
unit_z = UnitZ(Factor=Slider(12, range=0..100))
deconstruct_brep = DeconstructBrep(Brep=center_box)  # -> Faces, Edges, Vertices
move = Move(Geometry=polygon.Polygon, Motion=unit_x)  # -> Geometry, Transform
move_2 = Move(Geometry=move.Geometry, Motion=unit_z)  # -> Geometry, Transform
populate_3d = Populate3D(Region=center_box, Count=Slider(3, range=0..10), Seed=Slider(29, range=0..100))
curve_2 = Curve(polygon.Polygon)
list_item = ListItem(List=deconstruct_brep.Edges, Index=Slider(9, range=0..11), Wrap=True)
add_beam = AddBeam(Curve=curve)
add_column = AddColumn(Curve=list_item)
add_component_location = AddComponentLocation()
add_component_adaptive = AddComponentAdaptive(Points=populate_3d)
add_floor = AddFloor(Boundary=move.Geometry)
add_roof = AddRoof(Boundary=move_2.Geometry)
add_railing = AddRailing(Curve=curve_2)
surface = Surface(<surface referenced from the Rhino model>)
ghpython_script = GhPythonScript(surface=surface, uDiv=Slider(5, range=0..10), vDiv=Slider(5, range=0..10), radius=Slider(3, range=0..3))  # -> out, flatten(circleList_out); inputs surface: Surface, uDiv: Int32, vDiv: Int32
# ---------- ghpython_script: Python ----------
import rhinoscriptsyntax as rs

domainU = rs.SurfaceDomain(surface,0)
domainV = rs.SurfaceDomain(surface,1)

du = (domainU[1]-domainU[0])/uDiv
dv = (domainV[1]-domainV[0])/vDiv

circleList = []

for i in range(vDiv+1):
    for j in range(vDiv+1):
        pt = rs.EvaluateSurface(surface,du*i, dv*j)
        normal = rs.SurfaceNormal(surface,[du*i,dv*j])
        plane = rs.PlaneFromNormal(pt,normal)
        circle = rs.AddCircle(plane, radius)
        circleList.append(circle)

circleList_out = circleList
# ---------- end ghpython_script ----------
deconstruct_brep_2 = DeconstructBrep(Brep=surface)  # -> Faces, Edges, Vertices
add_railing_2 = AddRailing(Curve=ghpython_script.circleList_out)
clean_tree = CleanTree(RemoveNulls=True, RemoveInvalid=True, RemoveEmpty=False, Tree=add_railing_2)
add_beam_2 = AddBeam(Curve=deconstruct_brep_2.Edges)
graphical_element = GraphicalElement(clean_tree)
