# Grasshopper definition 0.1_Rhino_Grasshopper_Python_WickersonStudios_Geometry_Surface_Revit2021_009.gh (Grasshopper 1.0.7)
# Copyright: bernhard muller bijoutiers
# plug-ins: Rhino.Inside for Autodesk Revit

number_slider = Slider(10, range=0..10)
number_slider_2 = Slider(2, range=0..10)
surface = Surface(<surface referenced from the Rhino model>)
multiplication = Multiplication(A=number_slider, B=Slider(3, range=0..10))
ghpython_script = GhPythonScript(surface=surface, uDiv=number_slider_2, vDiv=number_slider_2, radius=multiplication, height=number_slider)  # -> out, coneList_out, ptList_out; inputs surface: Surface, uDiv: Int32, vDiv: Int32
# ---------- ghpython_script: Python ----------
import rhinoscriptsyntax as rs

domainU = rs.SurfaceDomain(surface,0)
domainV = rs.SurfaceDomain(surface,1)

du = (domainU[1]-domainU[0])/uDiv
dv = (domainV[1]-domainV[0])/vDiv

coneList = []
ptList = []

for i in range(vDiv+1):
    for j in range(vDiv+1):
        pt = rs.EvaluateSurface(surface,du*i, dv*j)
        normal = rs.SurfaceNormal(surface,[du*i,dv*j])
        plane = rs.PlaneFromNormal(pt,normal)
        circle = rs.AddCircle(plane, radius)
        
        vec = height*normal
        tip = rs.CopyObject(pt,vec)
        cone = rs.ExtrudeCurvePoint(circle,tip)
        
        coneList.append(cone)
        ptList.append(pt)


coneList_out = coneList
ptList_out = ptList
# ---------- end ghpython_script ----------
range = Range(Domain=Slider(100, range=0..100), Steps=Slider(24, range=0..100))
negative = Negative(Value=range)
sine = Sine(Value=range)
cosine = Cosine(Value=range)
point = Point(ghpython_script.ptList_out)
construct_point = ConstructPoint(XCoordinate=sine, YCoordinate=cosine, ZCoordinate=negative)
interpolate = Interpolate(Vertices=construct_point, Degree=3, Periodic=False, KnotStyle=1)  # -> Curve, Length, Domain
orient = Orient(Geometry=interpolate.Curve, Source=PlaneXY(0, 0, 0), Target=point)  # -> Geometry, Transform
surface_2 = Surface(ghpython_script.coneList_out)
add_beam = AddBeam(Curve=orient.Geometry)
