# Grasshopper definition 0.1_Rhino_Grasshopper_Python_WickersonStudios_Geometry_Surface_Revit2021_010.gh (Grasshopper 1.0.7)
# Copyright: bernhard muller bijoutiers
# plug-ins: Rhino.Inside for Autodesk Revit, Bifocals

number_slider = Slider(10, range=0..10)
surface = Surface(<surface referenced from the Rhino model>)  # disabled
number_slider_2 = Slider(2, range=0..10)
surface_2 = Surface(<surface referenced from the Rhino model>)
number_slider_3 = Slider(100, range=0..100)  # disabled
deconstruct_brep = DeconstructBrep(Brep=surface)  # -> Faces, Edges, Vertices; disabled
unit_z = UnitZ(Factor=number_slider_3)  # disabled
multiplication = Multiplication(A=number_slider, B=Slider(3, range=0..10))
curve = Curve(deconstruct_brep.Edges)  # disabled
negative = Negative(Value=unit_z)  # disabled
ghpython_script = GhPythonScript(surface=surface_2, uDiv=number_slider_2, vDiv=number_slider_2, radius=multiplication, height=number_slider)  # -> out, coneList_out, ptList_out; inputs surface: Surface, uDiv: Int32, vDiv: Int32
# ---------- ghpython_script: Python ----------
import rhinoscriptsyntax as rs

domainU = rs.SurfaceDomain(surface,0)
domainV = rs.SurfaceDomain(surface,1)

du = (domainU[1]-domainU[0])/uDiv
dv = (domainV[1]-domainV[0])/vDiv

coneList = []
ptList = []

for i in range(vDiv+1):
    for j in range(vDiv+1):
        pt = rs.EvaluateSurface(surface,du*i, dv*j)
        normal = rs.SurfaceNormal(surface,[du*i,dv*j])
        plane = rs.PlaneFromNormal(pt,normal)
        circle = rs.AddCircle(plane, radius)
        
        vec = height*normal
        tip = rs.CopyObject(pt,vec)
        cone = rs.ExtrudeCurvePoint(circle,tip)
        
        coneList.append(cone)
        ptList.append(pt)


coneList_out = coneList
ptList_out = ptList
# ---------- end ghpython_script ----------
move = Move(Geometry=curve, Motion=negative)  # -> Geometry, Transform; disabled
range = Range(Domain=Slider(100, range=0..100), Steps=Slider(24, range=0..100))
negative_2 = Negative(Value=range)
sine = Sine(Value=range)
cosine = Cosine(Value=range)
list_item = ListItem(List=curve, Index=0, Wrap=True)  # -> Item, Item1, Item2, Item3; disabled
list_item_2 = ListItem(List=move.Geometry, Index=0, Wrap=True)  # -> Item, Item1, Item2, Item3; disabled
point = Point(ghpython_script.ptList_out)
number_slider_4 = Slider(1, range=0..10)  # disabled
number_slider_5 = Slider(2, range=0..10)  # disabled
construct_point = ConstructPoint(XCoordinate=sine, YCoordinate=cosine, ZCoordinate=negative_2)
loft = Loft(
    Curves=[list_item.Item, list_item_2.Item],
    Options={Adjust=True, Closed=False, LoftEnds=0, LoftSimp=0, LoftType=0, Rebuild=10, Refit=0.01})  # disabled
loft_2 = Loft(
    Curves=[list_item.Item1, list_item_2.Item1],
    Options={Adjust=True, Closed=False, LoftEnds=0, LoftSimp=0, LoftType=0, Rebuild=10, Refit=0.01})  # disabled
loft_3 = Loft(
    Curves=[list_item_2.Item2, list_item.Item2],
    Options={Adjust=True, Closed=False, LoftEnds=0, LoftSimp=0, LoftType=0, Rebuild=10, Refit=0.01})  # disabled
loft_4 = Loft(
    Curves=[list_item_2.Item3, list_item.Item3],
    Options={Adjust=True, Closed=False, LoftEnds=0, LoftSimp=0, LoftType=0, Rebuild=10, Refit=0.01})  # disabled
interpolate = Interpolate(Vertices=construct_point, Degree=3, Periodic=False, KnotStyle=1)  # -> Curve, Length, Domain
merge = Merge(Data1=loft, Data2=loft_2, Data3=loft_3, Data4=loft_4, Data5=surface)  # -> graft(Result); disabled
number_slider_6 = Slider(0.31, range=0..1)  # disabled
number_slider_7 = Slider(6.91, range=0..10)  # disabled
number_slider_8 = Slider(8, range=0..10)  # disabled
number_slider_9 = Slider(4.6, range=0..10)  # disabled
number_slider_10 = Slider(1.84, range=0..10)  # disabled
orient = Orient(Geometry=interpolate.Curve, Source=PlaneXY(0, 0, 0), Target=point)  # -> Geometry, Transform
surface_3 = Surface(ghpython_script.coneList_out)
panel = Panel(merge)  # disabled
ghpython_script_2 = GhPythonScript(
    surface=merge,
    uDiv=number_slider_5,
    vDiv=number_slider_5,
    radiusA=number_slider_6,
    heightB=number_slider_7,
    radiusB=number_slider_10,
    heightC=number_slider_8,
    radiusC=number_slider_9)  # -> out, tubeList_out, ptList_out; inputs surface: Surface, uDiv: Int32, vDiv: Int32; disabled
# ---------- ghpython_script_2: Python ----------
import rhinoscriptsyntax as rs
import math
import random

domainU = rs.SurfaceDomain(surface,0)
domainV = rs.SurfaceDomain(surface,1)

du = (domainU[1]-domainU[0])/uDiv
dv = (domainV[1]-domainV[0])/vDiv

tubeList = []
ptList = []

for i in range(vDiv+1):
    for j in range(vDiv+1):
        pt = rs.EvaluateSurface(surface,du*i, dv*j)
        normal = rs.SurfaceNormal(surface,[du*i,dv*j])
        planeA = rs.PlaneFromNormal(pt,normal)
        
        circleA = rs.AddCircle(planeA, radiusA)
        
        vecB = heightB*normal
        ptB = rs.CopyObject(pt,vecB)
        planeB = rs.PlaneFromNormal(ptB,normal)
        circleB = rs.AddCircle(planeB, radiusB)
        
        vecC = heightC*normal
        ptC = rs.CopyObject(pt,vecC)
        planeC = rs.PlaneFromNormal(ptC, normal)
        circleC = rs.AddCircle(planeC,radiusC)
        
        tube = rs.AddLoftSrf([circleA,circleB,circleC],
        None,None,0,0,0,False)
        
        print tubeList
        tubeList.extend(tube)

tubeList_out = tubeList
# ---------- end ghpython_script_2 ----------
add_beam = AddBeam(Curve=orient.Geometry)
surface_4 = Surface(ghpython_script_2.tubeList_out)  # disabled
