# Grasshopper definition 0.1_Rhino_Grasshopper_Python_WickersonStudios_Geometry_Surface_Revit2021_012.gh (Grasshopper 1.0.7)
# Copyright: bernhard muller bijoutiers
# plug-ins: Workshop, Rhino.Inside for Autodesk Revit, Bifocals

wickerson_s_first_grasshopper_component = WickersonsFirstGrasshopperComponent()  # disabled
model = ModelCategoriesPicker({"Abutments": -2006130, "Air Systems": -2001008, "Air Terminals": -2008013, "Analysis Display Style": -2000304, "Analysis Results": -2000303, "Areas": -2003200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}, selected="Walls": -2000011)  # disabled
graphical_element = GraphicalElement(<wall referenced from the Revit model>)  # disabled
graphical_element_2 = GraphicalElement(<wall referenced from the Revit model>)  # disabled
graphical_element_3 = GraphicalElement(<wall referenced from the Revit model>)  # disabled
graphical_element_4 = GraphicalElement(<wall referenced from the Revit model>)  # disabled

graphical_element_5 = GraphicalElement(<wall referenced from the Revit model>)
ghpython_script = GhPythonScript(E=graphical_element_5)  # -> G
# ---------- ghpython_script: Python ----------
import clr

clr.AddReference('RevitAPI') 

from RhinoInside.Revit import Convert
from Autodesk.Revit import DB

clr.ImportExtensions(Convert.Geometry)

G = [x.ToBrep() for x in E.Geometry[DB.Options()]]
# ---------- end ghpython_script ----------
panel = Panel(ghpython_script)

panel_2 = Panel(graphical_element_3)  # disabled
element_geometry = ElementGeometry(Elements=graphical_element_3)  # disabled
number_slider = Slider(34.15, range=0..100)  # disabled
elementtype_picker = ElementTypePicker(
    model,
    {"Basic Wall : Exterior - Brick and CMU on MTL. Stud": 47381, "Basic Wall : Exterior - Brick on CMU": 250, "Basic Wall : Exterior - Brick on Mtl. Stud": 221, "Basic Wall : Exterior - CMU Insulated": 256, "Basic Wall : Exterior - CMU on Mtl. Stud": 83171, "Basic Wall : Exterior - EIFS on Mtl. Stud": 264, "Basic Wall : Foundation - 12\" Concrete": 29243, "Basic Wall : Generic - 12": 251, "Basic Wall : Generic - 12\" Masonry": 253, "Basic Wall : Generic - 4\" Brick": 257, "Basic Wall : Generic - 5": 252, "Basic Wall : Generic - 6": 219, "Basic Wall : Generic - 6\" Masonry": 255, "Basic Wall : Generic - 8": 249, "Basic Wall : Generic - 8\" - Filled": 43831, "Basic Wall : Generic - 8\" Masonry": 254, "Basic Wall : Interior - 3 1/8\" Partition (1-hr)": 258, "Basic Wall : Interior - 4 7/8\" Partition (1-hr)": 261, "Basic Wall : Interior - 5 1/2\" Partition (1-hr)": 263, "Basic Wall : Interior - 5\" Partition (2-hr)": 220, "Basic Wall : Interior - 6 1/8\" Partition (2-hr)": 262, "Basic Wall : Retaining - 12\" Concrete": 29244, "Basic Wall : Soffit - 1/2\" GWB & Metal Stud": 45098, "Curtain Wall : Curtain Wall 1": 21854, "Curtain Wall : Exterior Glazing": 56766, "Curtain Wall : Storefront": 56765}, selected="Basic Wall : Exterior - Brick on Mtl. Stud")  # disabled
level = LevelsPicker({"Level 2": 9946, "Level 1": 30}, selected="Level 2")  # disabled
curve = Curve(<curve referenced from the Rhino model>)  # disabled
number_slider_2 = Slider(1, range=0..5)  # disabled
brep = Brep(element_geometry)  # disabled
deconstruct_brep = DeconstructBrep(Brep=brep)  # -> Faces, Edges, Vertices; disabled
add_wall = AddWall(Curve=curve, Type=elementtype_picker, Level=level, Height=number_slider)  # disabled
list_item = ListItem(List=deconstruct_brep.Faces, Index=number_slider_2, Wrap=True)  # disabled
surface = Surface(list_item)  # disabled
element_geometry_2 = ElementGeometry(Elements=add_wall)  # disabled
panel_3 = Panel(surface)  # disabled
