# Grasshopper definition 0.1_Rhino_Grasshopper_Python_WickersonStudios_Geometry_Surface_Revit2021_013.gh (Grasshopper 1.0.7)
# Copyright: bernhard muller bijoutiers
# plug-ins: Workshop

wickerson_s_first_grasshopper_component = WickersonsFirstGrasshopperComponent()  # disabled
surface = Surface(<surface referenced from the Rhino model>)
ghpython_script = GhPythonScript(surface=surface, uDiv=Slider(8, range=0..10), vDiv=Slider(5, range=0..10))  # -> out, trimSurf; inputs surface: Surface, uDiv: Int32, vDiv: Int32
# ---------- ghpython_script: Python ----------
import rhinoscriptsyntax as rs

trimSurf = []

domainU = rs.SurfaceDomain(surface,0)
domainV = rs.SurfaceDomain(surface,1)

du = (domainU[1]-domainU[0])/uDiv
dv = (domainV[1]-domainV[0])/vDiv

for i in range(uDiv):
    for j in range(vDiv):
        u = du*i,du*(i+1)
        v = dv*j,dv*(j+1)
        
        subSurf = rs.TrimSurface(surface,2,[u,v])
        trimSurf.append(subSurf)
        
trimSurf_out = trimSurf
# ---------- end ghpython_script ----------
surface_2 = Surface(ghpython_script.trimSurf)
