# Grasshopper definition 0.1_Rhino_Grasshopper_Python_WickersonStudios_Geometry_Vector_002.gh (Grasshopper 1.0.7)
# plug-ins: Bifocals

number_slider = Slider(7, range=0..10)  # disabled
number_slider_2 = Slider(27, range=0..100)  # disabled
number_slider_3 = Slider(22, range=0..100)  # disabled
number_slider_4 = Slider(17, range=0..100)  # disabled
curve = Curve(<curve referenced from the Rhino model>)  # disabled
number_slider_5 = Slider(3, range=0..10)  # disabled
number_slider_6 = Slider(71, range=0..100)  # disabled
number_slider_7 = Slider(20, range=0..20)  # disabled
number_slider_8 = Slider(4, range=0..10)  # disabled
number_slider_9 = Slider(4, range=0..10)  # disabled
number_slider_10 = Slider(6, range=0..10)  # disabled
number_slider_11 = Slider(8, range=0..10)  # disabled
number_slider_12 = Slider(1, range=0..10)  # disabled
number_slider_13 = Slider(1, range=0..3)  # disabled
number_slider_14 = Slider(10, range=0..10)  # disabled
number_slider_15 = Slider(8, range=0..10)  # disabled
number_slider_16 = Slider(4, range=0..10)  # disabled
number_slider_17 = Slider(3, range=0..13)  # disabled
# Point
number_slider_18 = Slider(3.84, range=0..10)  # disabled
number_slider_19 = Slider(2, range=0..10)  # disabled
number_slider_20 = Slider(2, range=1..5)  # disabled
number_slider_21 = Slider(16.114, range=0..100)  # disabled

xy_plane = XYPlane(Origin=Point(0, 0, 0))  # disabled
curve_2 = Curve(<curve referenced from the Rhino model>)  # disabled
# Points in Closed Curve
ghpython_script = GhPythonScript(curve=curve_2, plane=xy_plane)  # -> out, pts, a, b, pt_in_or_not, boolean; inputs curve: Curve, plane: Plane; disabled
# ---------- ghpython_script: Python ----------
import Rhino
import rhinoscriptsyntax as rs
import random

pts = []
for i in range(12):
    pt = Rhino.Geometry.Point3d(random.uniform(0,10), random.uniform(0,10), 0)
    pts.append(pt)
    
boolean = []
ptIn = []
ptOut = []


for i in range(len(pts)):
    pt_in_or_not = rs.PointInPlanarClosedCurve(pts[i], curve)
    boolean.append(pt_in_or_not)
    
    if boolean[i] == True:
        ptIn.append(pts[i])
    if boolean[i] == False:
        ptOut.append(pts[i])
        
a = ptIn
b = ptOut
# ---------- end ghpython_script ----------
point = Point(ghpython_script.a)  # disabled
point_2 = Point(ghpython_script.b)  # disabled
point_3 = Point(ghpython_script.pts)  # disabled
panel = Panel(ghpython_script.boolean)  # disabled
panel_2 = Panel(ghpython_script.pt_in_or_not)  # disabled

xy_plane_2 = XYPlane(Origin=Point(0, 0, 0))  # disabled
curve_3 = Curve(curve)  # disabled
# Points in Closed Curve
ghpython_script_2 = GhPythonScript(curve=curve_3, plane=xy_plane_2)  # -> out, pts, ptIn_Out, ptOut_Out, pt_in_or_not, boolean; inputs curve: Curve, plane: Plane; disabled
# ---------- ghpython_script_2: Python ----------
import Rhino
import random

pts = []
for i in range(120):
    pt = Rhino.Geometry.Point3d(random.uniform(0,10), random.uniform(0,10), 0)
    pts.append(pt)
    
boolean = []
ptIn = []
ptOut = []


for i in range(len(pts)):
    pt_in_or_not = Rhino.Geometry.Curve.Contains(curve, pts[i], plane, 0.001)
    boolean.append(pt_in_or_not)
    
    if boolean[i] == Rhino.Geometry.PointContainment.Inside:
        ptIn.append(pts[i])
    if boolean[i] == Rhino.Geometry.PointContainment.Outside:
        ptOut.append(pts[i])
    
    ptIn_Out = ptIn
    ptOut_Out = ptOut
# ---------- end ghpython_script_2 ----------
point_4 = Point(ghpython_script_2.pts)  # disabled
point_5 = Point(ghpython_script_2.ptOut_Out)  # disabled
point_6 = Point(ghpython_script_2.ptIn_Out)  # disabled
panel_3 = Panel(ghpython_script_2.boolean)  # disabled
panel_4 = Panel(ghpython_script_2.pt_in_or_not)  # disabled

populate_3d = Populate3D(Region={Plane=PlaneXY(0, 0, 0), X=Domain(0, 10), Y=Domain(0, 10), Z=Domain(0, 2)}, Count=number_slider, Seed=1)  # disabled
point_7 = Point(Point(-98.97135323, 120.8404155, -17.68475344))  # disabled
point_8 = Point(Point(-19.24491, -60.15829396, 0))  # disabled
# Random Library
ghpython_script_3 = GhPythonScript(seed=number_slider_5, n=number_slider_6)  # -> out, a; inputs seed: Int32, n: Int32; disabled
# ---------- ghpython_script_3: Python ----------
import Rhino
import random

pts = []

for i in range(n):
    pt = Rhino.Geometry.Point3d(random.uniform(0,10), random.uniform(0,10), 0)
    pts.append(pt)

a = pts
# ---------- end ghpython_script_3 ----------
# Random Library
ghpython_script_4 = GhPythonScript(step=number_slider_7)  # -> out, pts_Out, a, b, c; inputs step: Int32; disabled
# ---------- ghpython_script_4: Python ----------
import Rhino

pts = []
R = []
G = []
B = []

for i in range(0,256,step):
    for j in range(0,256,step):
        for k in range(0,256,step):
            pt = Rhino.Geometry.Point3d(i,j,k)
            pts.append(pt)
            R.append(i)
            G.append(j)
            B.append(k)

pts_Out = pts
a = R
b = G
c = B
# ---------- end ghpython_script_4 ----------
# Base Script
# Point3d
ghpython_script_5 = GhPythonScript(x=number_slider_18, y=number_slider_18, z=number_slider_18)  # -> out, point; disabled
# ---------- ghpython_script_5: Python ----------
import Rhino

point = Rhino.Geometry.Point3d(x,y,z)
# ---------- end ghpython_script_5 ----------
# Random Library
ghpython_script_6 = GhPythonScript()  # -> out, a, b, c; inputs x: Int32, y: Int32; disabled
# ---------- ghpython_script_6: Python ----------
import Rhino
import random
import math

ran1 = random.random()
ran2 = random.randint(0,math.sqrt(100))
ran3 = random.uniform(0,100)

a = ran1
b = ran2
c = ran3
# ---------- end ghpython_script_6 ----------
# Curve by Random Points
ghpython_script_7 = GhPythonScript(n=number_slider_2, m=number_slider_4, p=number_slider_3)  # -> out, pts, crv_Out; inputs n: Int32, m: Int32, p: Int32; disabled
# ---------- ghpython_script_7: Python ----------
import Rhino
import random

pts = []

for i in range(0,30
:
    x = random.uniform(0,n)
    y = random.uniform(0,m)
    z = random.uniform(0,p)
    pt = Rhino.Geometry.Point3d(x,y,z)
    pts.append(pt)

curve = Rhino.Geometry.NurbsCurve.Create(False, 3, pts)
crv_Out = curve
# ---------- end ghpython_script_7 ----------
# Condition  Array of Points
ghpython_script_8 = GhPythonScript(num1=number_slider_9, num2=number_slider_8, step=number_slider_19)  # -> out, a, b, d, c; inputs num1: Int32, num2: Int32, step: Int32; disabled
# ---------- ghpython_script_8: Python ----------
import Rhino

pts1 = []
pts2 = []
pts3 = []

for i in range(0,50,step):
    for j in range(0,50,step):
        pt = Rhino.Geometry.Point3d(i, j, 0)
        if i % num1 == 0 and j % num2 == 0:
            pts1.append(pt)
        elif i % num1 == 0 or j % num2 == 0:
            pts2.append(pt)
        else:
            pts3.append(pt)

a = pts1
b = pts2
c = pts3
# ---------- end ghpython_script_8 ----------
# Line and curve
ghpython_script_9 = GhPythonScript(pt1=point_7, pt2=point_8)  # -> out, line_Out; inputs pt1: Point3d, pt2: Point3d; disabled
# ---------- ghpython_script_9: Python ----------
import Rhino

line = Rhino.Geometry.Line(pt1, pt2)

line_Out = line
# ---------- end ghpython_script_9 ----------
# 2D  Array of Points
ghpython_script_10 = GhPythonScript(n=number_slider_10, m=number_slider_11)  # -> out, a; inputs n: Int32, m: Int32; disabled
# ---------- ghpython_script_10: Python ----------
import Rhino

#point = Rhino.Geometry.Point3d(x,y,z)

pts = []

for i in range(n):
    for j in range(m):
        pt = Rhino.Geometry.Point3d(i, j, i * j)
        pts.append(pt)

a = pts
# ---------- end ghpython_script_10 ----------
# Math Library
ghpython_script_11 = GhPythonScript(n=number_slider_21)  # -> out, pts; disabled
# ---------- ghpython_script_11: Python ----------
import rhinoscriptsyntax as rs
import Rhino.Geometry as rg
import math

pts = []

for i in rs.frange(0.1,n,0.2):
    x = i * math.sin(i)
    y = i * math.cos(i)
    z = i
    
    pt = rg.Point3d(x,y,z)
    pts.append(pt)

pts_Out = pts
# ---------- end ghpython_script_11 ----------
# Array of Points
ghpython_script_12 = GhPythonScript(x=number_slider_12, y=number_slider_15, z=number_slider_13)  # -> out, a; inputs x: Int32, y: Int32, z: Int32; disabled
# ---------- ghpython_script_12: Python ----------
import Rhino

#point = Rhino.Geometry.Point3d(x,y,z)

pts = []

for i in range(x,y,z):
    pt = Rhino.Geometry.Point3d(i, i*i, i*2)
    pts.append(pt)

a = pts
# ---------- end ghpython_script_12 ----------
# Condition_001  Array of Points
ghpython_script_13 = GhPythonScript(x=number_slider_14, y=number_slider_16, z=number_slider_17)  # -> out, a; inputs x: Int32, y: Int32, z: Int32; disabled
# ---------- ghpython_script_13: Python ----------
import Rhino

pts = []

for i in range(x):
    if i < y:
        pt = Rhino.Geometry.Point3d(i, 0, 0)
        pts.append(pt)
    else:
        pt = Rhino.Geometry.Point3d(i, 0, z)
        pts.append(pt)

a = pts
# ---------- end ghpython_script_13 ----------
# Line and curve
ghpython_script_14 = GhPythonScript(pts=populate_3d, degree=number_slider_20)  # -> out, crvA; inputs pts: list of Point3d, degree: Int32; disabled
# ---------- ghpython_script_14: Python ----------
import Rhino

crvA = Rhino.Geometry.NurbsCurve.Create(True, degree, pts)
# ---------- end ghpython_script_14 ----------
point_9 = Point(ghpython_script_5.point)  # disabled
point_10 = Point(ghpython_script_3.a)  # disabled
panel_5 = Panel([ghpython_script_6.a, ghpython_script_6.b, ghpython_script_6.c])  # disabled
point_11 = Point(ghpython_script_11.pts)  # disabled
curve_4 = Curve(ghpython_script_7.crv_Out)  # disabled
point_12 = Point(ghpython_script_7.pts)  # disabled
point_13 = Point(ghpython_script_8.c)  # disabled
point_14 = Point(ghpython_script_8.b)  # disabled
point_15 = Point(ghpython_script_12.a)  # disabled
point_16 = Point(ghpython_script_13.a)  # disabled
point_17 = Point(ghpython_script_10.a)  # disabled
point_18 = Point(ghpython_script_8.a)  # disabled
line = Line(ghpython_script_9.line_Out)  # disabled
colour_rgb = ColourRGB(Alpha=ghpython_script_4.a, Red=ghpython_script_4.b, Green=ghpython_script_4.c, Blue=0)  # disabled
curve_5 = Curve(ghpython_script_14.crvA)  # disabled
panel_6 = Panel(ghpython_script_5.point)  # disabled
custom_preview = CustomPreview(Geometry=ghpython_script_4.pts_Out, Material=colour_rgb)  # disabled
# GhPython Course at
# Wickerson Studios
# Vector
# Base Script
number_slider_22 = Slider(2.94, range=0..10)
# Vector Function: Add/Subtract/CrossProduct/Angle
number_slider_23 = Slider(4.12, range=0..12)
number_slider_24 = Slider(8.81, range=0..10)
# Moving Object By Vector
number_slider_25 = Slider(10.01, range=-10..10.01)
number_slider_26 = Slider(-10, range=-10..10.01)
# Moving Object By Vector
number_slider_27 = Slider(0, range=0..10)
# Moving Object By Vector
number_slider_28 = Slider(0, range=0..10)
# Vector Unitize/Scale/Reverse/Rotate
ghpython_script_15 = GhPythonScript(x=number_slider_24, y=number_slider_24, z=number_slider_24, multi=Slider(1.8, range=0..10), radians=number_slider_23)  # -> out, a, vector, b, c, d, e
# ---------- ghpython_script_15: Python ----------
import Rhino

vector = Rhino.Geometry.Vector3d(x,y,z)
#vectorUnitize = Rhino.Geometry.Vector3d.Unitize(vector)
vectorScale = Rhino.Geometry.Vector3d.Multiply(vector, multi)
vectorReverse = Rhino.Geometry.Vector3d.Reverse(vector)

rotationAxis = Rhino.Geometry.Vector3d(0,1,0)
vectorRotate = Rhino.Geometry.Vector3d.Rotate(vector, radians, rotationAxis)

#a = vectorUnitize
b = vectorScale
c = vectorReverse
d = vectorRotate
# ---------- end ghpython_script_15 ----------
# Vector Length
ghpython_script_16 = GhPythonScript(x=number_slider_22, y=number_slider_22, z=number_slider_22)  # -> out, a, vector
# ---------- ghpython_script_16: Python ----------
import Rhino

vector = Rhino.Geometry.Vector3d(x,y,z)

vecLength_out = Rhino.Geometry.Vector3d.Length.GetValue(vector)

a = vecLength_out
# ---------- end ghpython_script_16 ----------
ghpython_script_17 = GhPythonScript(x=Slider(5.51, range=0..10), y=Slider(0, range=0..10), z=Slider(0, range=0..10))  # -> out, vectorA, vectorB, vecAdd, vecSubtract, vecCrossProd, vecAngle
# ---------- ghpython_script_17: Python ----------
import Rhino

vectorA = Rhino.Geometry.Vector3d(x,y,z)
vectorB = Rhino.Geometry.Vector3d(y+12,2*x+5,3*z+3)

vecAdd = Rhino.Geometry.Vector3d.Add(vectorA, vectorB)
vecSubtract = Rhino.Geometry.Vector3d.Subtract(vectorB, vectorA)
vecCrossProd = Rhino.Geometry.Vector3d.CrossProduct(vectorA, vectorB)

planeNormal = Rhino.Geometry.Plane(Rhino.Geometry.Point3d(x,y,z), vectorA, vectorB)
vecAngle = Rhino.Geometry.Vector3d.VectorAngle(vectorA, vectorB, planeNormal)
# ---------- end ghpython_script_17 ----------
ghpython_script_18 = GhPythonScript(
    x=number_slider_25,
    y=number_slider_25,
    z=Slider(10, range=0..10),
    n=Slider(30, range=0..30),
    degree=Slider(5, range=1..5))  # -> out, pt, a, vec, nurbsCurve; inputs n: Int32, degree: Int32
# ---------- ghpython_script_18: Python ----------
import Rhino
import random

pts = []
pt = Rhino.Geometry.Point3d(0,0,0)
pts.append(pt)



for i in range(n):
    xDir = random.uniform(-x, x)
    yDir = random.uniform(-y, y)
    zDir = random.uniform(z, 10.0)
    vec = Rhino.Geometry.Vector3d(xDir, yDir, zDir)
    newPt = Rhino.Geometry.Point3d(vec*i)
    pts.append(newPt)

a = pts
nurbsCurve = Rhino.Geometry.NurbsCurve.Create(False, degree, pts)
# ---------- end ghpython_script_18 ----------
ghpython_script_19 = GhPythonScript(
    x=number_slider_28,
    y=Slider(0, range=0..10),
    z=Slider(0, range=0..10),
    n=Slider(10, range=0..10),
    degree=Slider(2, range=1..5))  # -> out, pt, a, vec, nurbsCurve; inputs n: Int32, degree: Int32
# ---------- ghpython_script_19: Python ----------
import Rhino

pts = []
pt = Rhino.Geometry.Point3d(x,y,z)
pts.append(pt)

vec = Rhino.Geometry.Vector3d(x +2, y+ 0,z + 0)
vec2 = Rhino.Geometry.Vector3d(x + 0,y + 2,z + 0)

for i in range(n):
    newPt = Rhino.Geometry.Point3d(vec*i)
    pts.append(newPt)
    newPt = Rhino.Geometry.Point3d(vec2*i)
    pts.append(newPt)

a = pts
nurbsCurve = Rhino.Geometry.NurbsCurve.Create(False, degree, pts)
# ---------- end ghpython_script_19 ----------
ghpython_script_20 = GhPythonScript(x=number_slider_27, y=Slider(0, range=0..10), z=Slider(0, range=0..10), n=Slider(10, range=0..10))  # -> out, pt, a, vec, newPt; inputs n: Int32
# ---------- ghpython_script_20: Python ----------
import Rhino

pts = []
pt = Rhino.Geometry.Point3d(x,y,z)
pts.append(pt)

vec = Rhino.Geometry.Vector3d(1,0,0)

for i in range(n):
    newPt = Rhino.Geometry.Point3d(vec*i)
    pts.append(newPt)

a = pts
# ---------- end ghpython_script_20 ----------
construct_point = ConstructPoint(XCoordinate=0, YCoordinate=0, ZCoordinate=0)
panel_7 = Panel(ghpython_script_16.a)
plane = Plane(PlaneXY(0, 0, 0))
panel_8 = Panel(ghpython_script_15.d)
panel_9 = Panel(ghpython_script_15.a)
panel_10 = Panel(ghpython_script_15.c)
vector = Vector(ghpython_script_16.vector)
panel_12 = Panel(ghpython_script_17.vecAngle)
point_19 = Point(ghpython_script_20.a)
panel_13 = Panel(ghpython_script_20.a)
panel_14 = Panel(ghpython_script_20.pt)
panel_15 = Panel(ghpython_script_20.vec)
vector_display = VectorDisplay(Anchor=ghpython_script_17.vectorA, Vector=ghpython_script_17.vectorB)
circle = Circle(Plane=plane, Radius=Slider(10, range=0..10))
vector_display_2 = VectorDisplay(Anchor=ghpython_script_17.vectorA, Vector=ghpython_script_17.vectorA)
point_20 = Point(ghpython_script_18.a)
panel_16 = Panel(ghpython_script_18.pt)
point_21 = Point(ghpython_script_19.a)
panel_17 = Panel(ghpython_script_18.vec)
panel_18 = Panel(ghpython_script_19.pt)
panel_19 = Panel(ghpython_script_19.vec)
curve_6 = Curve(ghpython_script_18.nurbsCurve)
curve_7 = Curve(ghpython_script_19.nurbsCurve)
vector_display_3 = VectorDisplay(Anchor=construct_point, Vector=vector)
vector_display_4 = VectorDisplay(Anchor=ghpython_script_17.vectorA, Vector=ghpython_script_17.vecSubtract)
vector_display_5 = VectorDisplay(Anchor=ghpython_script_17.vectorA, Vector=ghpython_script_17.vecAdd)
vector_display_6 = VectorDisplay(Anchor=ghpython_script_17.vectorA, Vector=ghpython_script_17.vecCrossProd)
sweep1 = Sweep1(Rail=reparameterize(curve_6), Sections=circle, Miter=1)
param_viewer = ParamViewer(ghpython_script_18.a)
panel_20 = Panel(ghpython_script_18.a)
construct_point_2 = ConstructPoint(XCoordinate=0, YCoordinate=0, ZCoordinate=0)
param_viewer_2 = ParamViewer(ghpython_script_19.a)
panel_21 = Panel(ghpython_script_19.a)
vector_2 = Vector(ghpython_script_15.vector)
vector_display_7 = VectorDisplay(Anchor=construct_point_2, Vector=vector_2)
# Moving Object By Vector
ghpython_script_21 = GhPythonScript()  # -> out, a, b, c
# ---------- ghpython_script_21: Python ----------
import Rhino
import scriptcontext

def constrainedcopy():
    #get a single closed curve
    go = Rhino.Input.Custom.GetObject()
    go.SetCommandPrompt("Select curve")
    go.GeometryFilter = Rhino.DocObjects.ObjectType.Curve
    go.GeometryAttributeFilter = Rhino.Input.Custom.GeometryAttributeFilter.ClosedCurve
    go.Get()
    if go.CommandResult() != Rhino.Commands.Result.Success: return
    objref = go.Object(0)
    base_curve = objref.Curve()
    first_point = objref.SelectionPoint()
    if not base_curve or not first_point.IsValid:
        return
    isplanar, plane = base_curve.TryGetPlane()
    if not isplanar: return

    gp = Rhino.Input.Custom.GetPoint()
    gp.SetCommandPrompt("Offset point")
    gp.DrawLineFromPoint(first_point, True)
    line = Rhino.Geometry.Line(first_point, first_point + plane.Normal)
    gp.Constrain(line)
    gp.Get()
    if gp.CommandResult() != Rhino.Commands.Result.Success:
        return
    second_point = gp.Point()
    vec = second_point - first_point
    if vec.Length > 0.001:
        xf = Rhino.Geometry.Transform.Translation(vec)
        id = Rhino.RhinoDoc.ActiveDoc.Objects.Transform(objref, xf, False)
        Rhino.RhinoDoc.ActiveDoc.Views.Redraw()
        return id

if __name__=="__main__":
    constrainedcopy()
# ---------- end ghpython_script_21 ----------

# ----
# Vector from Attractor Point
# Vector From Attractor points
number_slider_29 = Slider(4.4, range=0..10)  # disabled
number_slider_30 = Slider(3.1, range=0..10)  # disabled
number_slider_31 = Slider(2.62, range=0..10)  # disabled
xy_plane_3 = XYPlane(Origin=Point(0, 0, 0))  # disabled
point_22 = Point(<point referenced from the Rhino model>)  # disabled
ghpython_script_22 = GhPythonScript(
    size=number_slider_29,
    attPt=point_22,
    scale=number_slider_30,
    plane=xy_plane_3,
    x=number_slider_31,
    y=number_slider_31,
    z=number_slider_31)  # -> out, pt2D; inputs attPt: Point3d; disabled
# ---------- ghpython_script_22: Python ----------
import Rhino
import rhinoscriptsyntax as rs

def ScalingVector(pt1, pt2, scale):
    tmpVec = Rhino.Geometry.Vector3d(x,y,z)
    #tmpVec = rs.VectorCreate(pt2, pt1)
    #unitVec = Rhino.Geometry.Vector3d.Unitize(tmpVec)
    unitVec = rs.VectorUnitize(tmpVec)
    #vec = Rhino.Geometry.Transform.Scale(plane, x, y, z)
    vec = rs.VectorScale(unitVec, scale)
    #newPt = Rhino.Geometry.Transform.Translation(x,y,z)
    newPt = rs.CopyObject(pt1,vec)
    #vLine = Rhino.Geometry.Line(pt1, newPt)
    vLine = rs.AddLine(pt1, newPt)
    
    return newPt, vLine


pt2D = []
newPt = []
lineList = []

for i in range(10):
    for j in range(10):
        pt2D.append(Rhino.Geometry.Point3d(size*i, size*j,0))
        
        
for i in range(len(pt2D)):
    #pt, line = Rhino.Geometry.Transform.Scale(plane, x,y,z)
    pt,line = ScalingVector(pt2D[i], attPt, scale)
    newPt.append(pt)
    lineList.append(line)

pt2D_out = pt2D
newPt_out = newPt
lineList_out = lineList
# ---------- end ghpython_script_22 ----------
panel_22 = Panel(ghpython_script_22.out)  # disabled

number_slider_32 = Slider(5.61, range=0..10)  # disabled

# ----
# Vector From Attractor points
number_slider_33 = Slider(4.4, range=0..10)  # disabled
number_slider_34 = Slider(3.1, range=0..10)  # disabled
point_23 = Point(<point referenced from the Rhino model>)  # disabled
ghpython_script_23 = GhPythonScript(size=number_slider_33, attPt=point_23, scale=number_slider_34)  # -> out, pt2D_out, newPt_out, lineList_out; inputs attPt: Point3d; disabled
# ---------- ghpython_script_23: Python ----------
import rhinoscriptsyntax as rs

def ScalingVector(pt1, pt2, scale):
    tmpVec = rs.VectorCreate(pt2, pt1)
    unitVec = rs.VectorUnitize(tmpVec)
    vec = rs.VectorScale(unitVec, scale)
    newPt = rs.CopyObject(pt1,vec)
    vLine = rs.AddLine(pt1, newPt)
    
    return newPt, vLine


pt2D = []
newPt = []
lineList = []

for i in range(10):
    for j in range(10):
        pt2D.append(rs.AddPoint(size*i, size*j,0))
        
        
for i in range(len(pt2D)):
    pt,line = ScalingVector(pt2D[i], attPt, scale)
    newPt.append(pt)
    lineList.append(line)

pt2D_out = pt2D
newPt_out = newPt
lineList_out = lineList
# ---------- end ghpython_script_23 ----------
panel_23 = Panel(ghpython_script_23.pt2D_out)  # disabled
panel_24 = Panel(ghpython_script_23.lineList_out)  # disabled
panel_25 = Panel(ghpython_script_23.newPt_out)  # disabled

# ----
# Spiral Graphic
number_slider_35 = Slider(10, range=0..10)  # disabled
# Pattern with Attractors
number_slider_36 = Slider(77, range=0..100)  # disabled
number_slider_37 = Slider(3, range=0..10)  # disabled
number_slider_38 = Slider(3, range=1..5)  # disabled
point_24 = Point(<point referenced from the Rhino model>)  # disabled
ghpython_script_24 = GhPythonScript(
    n=number_slider_35,
    size=number_slider_37,
    degree=number_slider_38,
    attPt=point_24,
    mult=number_slider_32,
    angle=number_slider_36)  # -> out, a, c; inputs n: Int32, size: Int32, degree: Int32, attPt: Point3d; disabled
# ---------- ghpython_script_24: Python ----------
import Rhino
import rhinoscriptsyntax as rs

pt2D = []
curveList = []

for i in range(n):
    for j in range(n):
        pt2D.append(Rhino.Geometry.Point3d(size*i,size*j,0))

for k in range(len(pt2D)):
    IPCPts = []
    for m in range(degree):
        tmpVector = rs.VectorCreate(attPt,pt2D[k])
        unitVector = rs.VectorUnitize(tmpVector)
        vector = rs.VectorScale(unitVector,mult)
        vector = rs.VectorRotate(vector,angle,[0,0,1])
        newPt = rs.CopyObject(pt2D[k], vector)
        IPCPts.append(newPt)
        pt2D[k] = newPt
        
    #curve = Rhino.Geometry.NurbsCurve.Create(False, degree, IPCPts)
    curve = rs.AddInterpCurve(IPCPts, 3)
    curveList.append(curve)

a = pt2D
c = curveList
# ---------- end ghpython_script_24 ----------
ghpython_script_25 = GhPythonScript()  # -> Out, A
point_25 = Point(ghpython_script_24.a)  # disabled
curve_8 = Curve(ghpython_script_24.c)  # disabled
